# Grasshopper definition Konrad_Byron-Task1.gh (Grasshopper 0.9.76)

curve = Curve([<curve referenced from the Rhino model> x181])
curve_2 = Curve([<curve referenced from the Rhino model> x180])
curve_3 = Curve(curve)
md_slider = MDSlider(
    slider_value=Point(0.5107416293, 0.5047611144, 0.5),
    SliderMode=0,
    x_domain=Domain(0, 1),
    y_domain=Domain(0, 1),
    z_domain=Domain(0, 1))
explode = Explode(Curve=curve_2, Recursive=True)  # -> Segments, Vertices
area = Area(Geometry=curve_2)  # -> Area, graft(Centroid)
bounding_box = BoundingBox(Content=curve_2, Plane=PlaneXY(0, 0, 0), UnionBox=True)  # -> Box, Box_2
explode_2 = Explode(Curve=curve_3, Recursive=True)  # -> Segments, Vertices
area_2 = Area(Geometry=curve_3)  # -> Area, graft(Centroid)
md_slider_2 = MDSlider(
    slider_value=Point(0.502209361, 0.4967109866, 0.5),
    SliderMode=0,
    x_domain=Domain(0, 1),
    y_domain=Domain(0, 1),
    z_domain=Domain(0, 1))
line = Line(StartPoint=explode.Vertices, EndPoint=area.Centroid)
evaluate_surface = EvaluateSurface(Surface=reparameterize(bounding_box.Box), Point=[md_slider_2, md_slider])  # -> Point, Normal, Frame
line_2 = Line(StartPoint=explode_2.Vertices, EndPoint=area_2.Centroid)
point_on_curve = PointOnCurve(explode.Segments, parameter=0.5)
point = Point(evaluate_surface.Point)
point_on_curve_2 = PointOnCurve(explode_2.Segments, parameter=0.5)
point_2 = Point(area.Centroid)
point_3 = Point(area_2.Centroid)
point_4 = Point(evaluate_surface.Point)
closest_point = ClosestPoint(Point=point_2, Cloud=point)  # -> ClosestPoint, CPIndex, flatten(Distance)
closest_point_2 = ClosestPoint(Point=point_3, Cloud=point_4)  # -> ClosestPoint, CPIndex, flatten(Distance)
remap = Remap(data=closest_point.Distance, min=Slider(0.067, range=0..1), max=Slider(0.933, range=0..1))  # -> graft(R)
evaluate_curve = EvaluateCurve(Curve=line, Parameter=remap)  # -> Point, Tangent, Angle
weave = Weave(Pattern=[0, 1], Stream0=evaluate_curve.Point, Stream1=point_on_curve, NullGaps=False)
remap_2 = Remap(data=closest_point_2.Distance, min=Slider(0.164, range=0..1), max=Slider(1, range=0..1))  # -> graft(R)
evaluate_curve_2 = EvaluateCurve(Curve=line_2, Parameter=remap_2)  # -> Point, Tangent, Angle
weave_2 = Weave(Pattern=[0, 1], Stream0=evaluate_curve_2.Point, Stream1=point_on_curve_2, NullGaps=False)
polyline = PolyLine(Vertices=weave, Closed=False)
polyline_2 = PolyLine(Vertices=weave_2, Closed=False)

# ==== cluster Remap: Remaps numbers
data = ClusterInput()
min = ClusterInput()
max = ClusterInput()
bnd = Bounds(Numbers=data)
dom = ConstructDomain(DomainStart=min, DomainEnd=max)
remap = RemapNumbers(Value=data, Source=bnd, Target=dom)  # -> Mapped, Clipped
R = ClusterOutput(remap.Mapped)
