# Grasshopper definition Leonie_Sollermann-abg-1_Linien.gh (Grasshopper 1.0.7)

number_slider = Slider(240, range=0..300)
plane_surface = PlaneSurface(Plane=PlaneXY(0, 0, 0), XSize=Slider(80, range=0..100), YSize=Slider(80, range=0..100))
random = Random(Range=Slider(360, range=0..360), Number=number_slider, Seed=Slider(3, range=0..10))
populate_geometry = PopulateGeometry(Geometry=plane_surface, Count=number_slider, Seed=Slider(3, range=0..10))
surface_closest_point = SurfaceClosestPoint(Point=populate_geometry, Surface=plane_surface)  # -> Point, UVPoint, Distance
evaluate_surface = EvaluateSurface(Surface=plane_surface, Point=surface_closest_point.UVPoint)  # -> Point, Normal, UDirection, VDirection, Frame
plane = Plane(evaluate_surface.Frame)
rotate = Rotate(Geometry=plane, Angle=degrees(random), Plane=evaluate_surface.Frame)  # -> Geometry, Transform
deconstruct_plane = DeconstructPlane(Plane=rotate.Geometry)  # -> Origin, XAxis, YAxis, ZAxis
adjust_plane = AdjustPlane(Plane=rotate.Geometry, Normal=deconstruct_plane.XAxis)
brep_plane = BrepPlane(Brep=plane_surface, Plane=adjust_plane)  # -> Curves, Points
colour_picker = ColourPicker(PickedColour=RGB(8, 8, 8))
pipe = Pipe(Curve=brep_plane.Curves, Radius=Slider(0.1, range=0..0.1), Caps=0)
custom_preview = CustomPreview(Geometry=pipe, Material=colour_picker)
