# Grasshopper definition Sinan_Yeşildal-Assesment1.gh (Grasshopper 1.0.7)

number_slider = Slider(100, range=0..100)
division = Division(A=number_slider, B=2)
neg = Negative(Value=division)
series = Series(Start=neg, Step=Slider(1.5, range=0..10), Count=number_slider)  # -> graft(Series)
series_2 = Series(Start=0, Step=Slider(1.5, range=0..10), Count=Slider(1, range=0..100))  # -> graft(Series)
series_3 = Series(Start=0, Step=Slider(1.5, range=0..10), Count=number_slider)
phasenverschiebung = Slider(2, range=0..100)
pt = ConstructPoint(XCoordinate=series_3, YCoordinate=series, ZCoordinate=0)
pt_2 = ConstructPoint(XCoordinate=series_3, YCoordinate=series_2, ZCoordinate=0)
periodenlänge = Slider(6.354, range=0..10)
amplitude = Slider(1, range=0..10)
höhe = Slider(0.5054, range=0..2)
pdecon = Deconstruct(Point=pt_2)  # -> XComponent, YComponent, ZComponent
warping_using_gyroid_function = Expression(x=pdecon.XComponent, a=amplitude, b=periodenlänge, c=phasenverschiebung, d=höhe, Expression="a*sin(b*x+c)+d")
multiplication = Multiplication(A=warping_using_gyroid_function, B=Slider(44.488, range=0..100))
Y = UnitY(Factor=multiplication)
addition = Addition(A=pt_2, B=Y)
pline = PolyLine(Vertices=addition, Closed=False)
crv_cp = CurveClosestPoint(Point=pt, Curve=pline)  # -> Point, Parameter, Distance
division_2 = Division(A=1, B=crv_cp.Distance)
divdist = DivideDistance(Curve=pline, Distance=Slider(1, range=0..10))  # -> Points, Tangents, Parameters
bnd = Bounds(Numbers=flatten(division_2))
circle = CircleCNR(Center=divdist.Points, Normal=Vector(0, 0, 1), Radius=Slider(0.41, range=0..1))
dedomain = DeconstructDomain(Domain=bnd)  # -> Start, End
dom = ConstructDomain(DomainStart=dedomain.Start, DomainEnd=Slider(0.367, range=0..10))
remap = RemapNumbers(Value=division_2, Source=dom, Target=Domain(0, 1))  # -> Mapped, Clipped
multiplication_2 = Multiplication(A=remap.Clipped, B=Slider(14.862, range=0..100))
Y_2 = UnitY(Factor=multiplication_2)
addition_2 = Addition(A=pt, B=Y_2)
dist = Distance(PointA=pt, PointB=addition_2)
addition_3 = Addition(A=dist, B=1)
division_3 = Division(A=Slider(1, range=0..1), B=addition_3)
circle_2 = CircleCNR(Center=addition_2, Normal=Vector(0, 0, 1), Radius=division_3)
geo = Geometry([circle_2, circle])
