# Grasshopper definition kreise.gh (Grasshopper 1.0.7)

dom = ConstructDomain(DomainStart=Slider(0, range=0..100), DomainEnd=Slider(100, range=0..100))
range = Range(Domain=dom, Steps=Slider(40, range=0..100))
pt = ConstructPoint(XCoordinate=graft(range), YCoordinate=range, ZCoordinate=0)  # -> flatten(Point)
crv = Curve(<curve referenced from the Rhino model>)
crv_cp = CurveClosestPoint(Point=pt, Curve=crv)  # -> Point, Parameter, Distance
bnd = Bounds(Numbers=crv_cp.Distance)
dedomain = DeconstructDomain(Domain=bnd)  # -> Start, End
dom_2 = ConstructDomain(DomainStart=Slider(0, range=0..100), DomainEnd=Slider(1.5, range=0..10))
remap = RemapNumbers(Value=crv_cp.Distance, Source=bnd, Target=dom_2)  # -> Mapped, Clipped
cir = Circle(Plane=pt, Radius=remap.Mapped)
gradient = Gradient(
    LowerLimit=dedomain.Start,
    UpperLimit=dedomain.End,
    Parameter=crv_cp.Distance,
    stops=[0.237: RGB(192, 192, 192), 0.918: RGB(105, 105, 105)])
boundary = BoundarySurfaces(Edges=cir)
preview = CustomPreview(Geometry=boundary, Material=gradient)
