# Grasshopper definition Leonie_Sollermann-abg-1.gh (Grasshopper 1.0.7)

number_slider = Slider(1, range=0..1)
number_slider_2 = Slider(45, range=0..100)
number_slider_3 = Slider(30, range=0..100)
pt = ConstructPoint(XCoordinate=Slider(18.6, range=0..100), YCoordinate=0, ZCoordinate=0)
number_slider_4 = Slider(32, range=0..100)
pt_2 = Point([Point(2.69703648, 8.486565963, 0), Point(7.539613866, 3.487776403, 0), Point(16.44370777, 5.830959009, 0), Point(18.94310255, 11.29838509, 0), Point(14.25673734, 13.6415677, 0), Point(10.50764517, 11.92323379, 0), Point(3.868627783, 16.92202335, 0), Point(10.19522082, 20.51490334, 0), Point(19.33363299, 18.406039, 0)])
rectangle = Rectangle(Plane=PlaneXY(0, 0, 0), XSize=number_slider, YSize=number_slider, Radius=0)  # -> Rectangle, Length
number_slider_5 = Slider(100, range=0..100)
sqgrid = Square(Plane=PlaneXY(0, 0, 0), Size=Slider(0.5, range=0..1), ExtentX=number_slider_2, ExtentY=number_slider_2)  # -> Cells, Points
pcharge = PointCharge(Point=pt_2, Charge=Slider(1, range=0..1), Decay=Slider(2.6, range=0..10))
crv = Curve(rectangle.Rectangle)
arrpolar = PolarArray(Geometry=pt, Plane=PlaneXY(0, 0, 0), Count=Slider(3, range=0..100), Angle=6.283185307)  # -> Geometry, Transform
pt_3 = ConstructPoint(XCoordinate=Slider(19.3, range=0..100), YCoordinate=0, ZCoordinate=0)
sqgrid_2 = Square(Plane=PlaneXY(0, 0, 0), Size=1, ExtentX=number_slider_3, ExtentY=number_slider_3)  # -> Cells, flatten(Points)
number_slider_6 = Slider(30, range=0..100)
mergef = MergeFields(Fields=pcharge)
pt_4 = Point(flatten(sqgrid.Points))
arrrec = RectangularArray(Geometry=crv, Cell=crv, XCount=number_slider_4, YCount=number_slider_4)  # -> graft(Geometry), Transform
crv_2 = Curve([<curve referenced from the Rhino model> x2])
ln = Line(StartPoint=Point(0, 0, 0), EndPoint=arrpolar.Geometry)
series = Series(Start=0, Step=1, Count=number_slider_5)
series_2 = Series(Start=0, Step=1, Count=Slider(100, range=0..100))
pi = Pi(Factor=Slider(0.199, range=0..1))
arrpolar_2 = PolarArray(Geometry=pt_3, Plane=PlaneXY(0, 0, 0), Count=Slider(12, range=0..100), Angle=6.283185307)  # -> Geometry, Transform
evf = EvaluateField(Field=mergef, Point=pt_4)  # -> Tensor, Strength
crv_cp = CurveClosestPoint(Point=graft(sqgrid_2.Points), Curve=crv_2)  # -> Point, Parameter, Distance
vlen = VectorLength(Vector=evf.Tensor)
pcen = PolygonCenter(Polyline=arrrec.Geometry)  # -> CenterV, CenterE, CenterA
explode = Explode(Curve=arrrec.Geometry, Recursive=True)  # -> Segments, Vertices
sqgrid_3 = Square(Plane=PlaneXY(0, 0, 0), Size=1, ExtentX=number_slider_6, ExtentY=number_slider_6)  # -> Cells, flatten(Points)
crossref = CrossReference(ListA=series, ListB=series_2, CrossMode=1)  # -> ListA, ListB
ln_2 = Line(StartPoint=Point(0, 0, 0), EndPoint=arrpolar_2.Geometry)
pi_2 = Pi(Factor=Slider(0.148, range=0..1))
maelstrom = Maelstrom(
    Geometry=ln,
    Plane=PlaneXY(0, 0, 0),
    First=Slider(20, range=0..20),
    Second=Slider(20, range=0..20),
    Angle=pi,
    Rigid=False)
sort = SortList(Keys=crv_cp.Distance)  # -> Keys, ValuesA
min = Minimum(A=vlen, B=Slider(0.5, range=0..1))
pt_5 = Point(pcen.CenterV)
number_slider_7 = Slider(41, range=0..100)
bbox = BoundingBox(Content=sqgrid_3.Points, Plane=PlaneXY(0, 0, 0), UnionBox=True)  # -> Box, Box_2
item = ListItem(List=sort.Keys, Index=0, Wrap=True)  # -> flatten(Item)
eval = EvaluateLength(Curve=explode.Segments, Length=Slider(0.5, range=0..1), Normalized=True)  # -> Point, Tangent, Parameter
pt_6 = ConstructPoint(XCoordinate=crossref.ListA, YCoordinate=crossref.ListB, ZCoordinate=0)
image = ImageSampler(
    pt_5,
    FilePath="C:\Users\leoni\Documents\_htwg 1. Semester\the Nature of artifical\IMG_3098 (2).JPG",
    Filter="Value",
    Interpolate=False,
    Umax=40,
    Umin=1,
    Vmax=40,
    Vmin=1,
    Wrap=1)
amp = Amplitude(Vector=evf.Tensor, Amplitude=min)
shift = ShiftList(List=maelstrom, Shift=Slider(1, range=0..1), Wrap=True)
maelstrom_2 = Maelstrom(
    Geometry=ln_2,
    Plane=PlaneXY(0, 0, 0),
    First=Slider(5.98, range=0..20),
    Second=Slider(20, range=0..20),
    Angle=pi_2,
    Rigid=False)
dom = ConstructDomain(DomainStart=Slider(0.5, range=0..1), DomainEnd=Slider(0.1, range=0..0.1))
bnd = Bounds(Numbers=item)
popgeo = PopulateGeometry(Geometry=bbox.Box, Count=Slider(3, range=0..10), Seed=1)
number_slider_8 = Slider(64, range=0..100)
image_2 = ImageSampler(
    pt_6,
    FilePath="C:\Users\leoni\Documents\_htwg 1. Semester\the Nature of artifical\Unbenannt-1.jpg",
    Filter="Value",
    Interpolate=False,
    Umax=100,
    Umin=1,
    Vmax=100,
    Vmin=1,
    Wrap=1)
remap = RemapNumbers(Value=item, Source=bnd, Target=dom)  # -> Mapped, Clipped
divide = DivideCurve(Curve=maelstrom, Count=number_slider_7, Kinks=False)  # -> Points, Tangents, Parameters
divide_2 = DivideCurve(Curve=shift, Count=number_slider_7, Kinks=False)  # -> Points, Tangents, Parameters
move = Move(Geometry=pt_4, Motion=amp)  # -> Geometry, Transform
multiplication = Multiplication(A=image, B=Slider(0.67, range=0..1))
item_2 = ListItem(List=eval.Point, Index=0, Wrap=True)  # -> Item, Item1, Item2, Item3
shift_2 = ShiftList(List=maelstrom_2, Shift=Slider(1, range=0..1), Wrap=True)
Y = UnitY(Factor=1)
cp = ClosestPoint(Point=sqgrid_3.Points, Cloud=popgeo)  # -> ClosestPoint, CPIndex, Distance
multiplication_2 = Multiplication(A=divide.Tangents, B=Slider(12.7, range=0..100))
cir = Circle(Plane=sqgrid_2.Points, Radius=remap.Mapped)
multiplication_3 = Multiplication(A=divide_2.Tangents, B=Slider(69.3, range=0..100))
unflatten = UnflattenTree(Tree=move.Geometry, Guide=sqgrid.Points)
divide_3 = DivideCurve(Curve=maelstrom_2, Count=number_slider_8, Kinks=False)  # -> Points, Tangents, Parameters
divide_4 = DivideCurve(Curve=shift_2, Count=number_slider_8, Kinks=False)  # -> Points, Tangents, Parameters
panel = Panel(image_2)
division = Division(A=cp.Distance, B=Slider(35, range=0..100))
bzspan = BezierSpan(StartPoint=divide.Points, StartTangent=multiplication_2, EndPoint=divide_2.Points, EndTangent=multiplication_3)  # -> Curve, Length, Domain
srf = Surface(cir)
line = LineSDL(Start=pt_6, Direction=Y, Length=panel)
flip = FlipMatrix(Data=unflatten)
Y_2 = UnitY(Factor=multiplication)
X = UnitX(Factor=multiplication)
multiplication_4 = Multiplication(A=divide_3.Tangents, B=Slider(15.2, range=0..100))
multiplication_5 = Multiplication(A=divide_4.Tangents, B=Slider(12.5, range=0..100))
preview = CustomPreview(Geometry=srf, Material=ColourSwatch(SwatchColor=RGB(0, 0, 0)))
nurbs = NurbsCurve(Vertices=flip, Degree=3, Periodic=False)  # -> Curve, Length, Domain
cir_2 = Circle(Plane=sqgrid_3.Points, Radius=division)
nurbs_2 = NurbsCurve(Vertices=unflatten, Degree=3, Periodic=False)  # -> Curve, Length, Domain
partition = PartitionList(List=line, Size=number_slider_5)
bzspan_2 = BezierSpan(StartPoint=item_2.Item, StartTangent=Y_2, EndPoint=item_2.Item3, EndTangent=X)  # -> Curve, Length, Domain
pt_7 = Point(pcen.CenterV)
preview_2 = CustomPreview(Geometry=bzspan.Curve, Material=ColourSwatch(SwatchColor=RGB(0, 0, 0)))
bzspan_3 = BezierSpan(StartPoint=divide_3.Points, StartTangent=multiplication_4, EndPoint=divide_4.Points, EndTangent=multiplication_5)  # -> Curve, Length, Domain
end = EndPoints(Curve=partition)  # -> Start, End
srf_2 = Surface(cir_2)
rot3d = Rotate3D(Geometry=bzspan_2.Curve, Angle=degrees(Slider(180, range=0..1000)), Center=pt_7, Axis=Vector(0, 0, 1))  # -> Geometry, Transform
preview_3 = CustomPreview(Geometry=bzspan_3.Curve, Material=ColourSwatch(SwatchColor=RGB(0, 0, 0)))
preview_4 = CustomPreview(Geometry=srf_2, Material=ColourSwatch(SwatchColor=RGB(0, 0, 0)))
pline = PolyLine(Vertices=end.Start, Closed=False)
pline_2 = PolyLine(Vertices=end.End, Closed=False)
merge = Merge(Data1=rot3d.Geometry, Data2=bzspan_2.Curve)
tstat = TreeStatistics(Tree=merge)  # -> Paths, Length, Count
pt_8 = Point(pt_7)
weave = Weave(Pattern=[0, 1], Stream0=pline, Stream1=pline_2, NullGaps=False)
random = Random(Range="0 to 3", Number=tstat.Count, Seed=2, Integers=True)  # -> graft(Random)
loft = Loft(Curves=weave, Options={Adjust=False, Closed=False, LoftEnds=0, LoftSimp=0, LoftType=0, Rebuild=10, Refit=0.01})
multiplication_6 = Multiplication(A=random, B="90")
preview_5 = CustomPreview(Geometry=loft, Material=ColourSwatch(SwatchColor=RGB(0, 0, 0)))
rot3d_2 = Rotate3D(Geometry=merge, Angle=degrees(multiplication_6), Center=pt_8, Axis=Vector(0, 0, 1))  # -> Geometry, Transform
preview_6 = CustomPreview(Geometry=rot3d_2.Geometry, Material=ColourSwatch(SwatchColor=RGB(0, 0, 0)))
