# Grasshopper definition Leonie_Sollermann-abg-1_Tiger.gh (Grasshopper 1.0.7)

number_slider = Slider(83, range=0..100)
series = Series(Start=0, Step=1, Count=number_slider)
series_2 = Series(Start=0, Step=1, Count=Slider(88, range=0..100))
crossref = CrossReference(ListA=series, ListB=series_2, CrossMode=1)  # -> ListA, ListB
pt = ConstructPoint(XCoordinate=crossref.ListA, YCoordinate=crossref.ListB, ZCoordinate=0)
image = ImageSampler(
    pt,
    FilePath="C:\Users\alina\Documents\HTWG Konstanz\MA1\WP Nature of Artificial\blume.jpg",
    Filter="Value",
    Interpolate=False,
    Umax=83,
    Umin=1,
    Vmax=88,
    Vmin=1,
    Wrap=1)
Y = UnitY(Factor=1)
panel = Panel(image)
line = LineSDL(Start=pt, Direction=Y, Length=panel)
partition = PartitionList(List=line, Size=number_slider)
end = EndPoints(Curve=partition)  # -> Start, End
pline = PolyLine(Vertices=end.End, Closed=False)
pline_2 = PolyLine(Vertices=end.Start, Closed=False)
weave = Weave(Pattern=[0, 1], Stream0=pline_2, Stream1=pline, NullGaps=False)
loft = Loft(Curves=weave, Options={Adjust=False, Closed=False, LoftEnds=0, LoftSimp=0, LoftType=0, Rebuild=10, Refit=0.01})
preview = CustomPreview(Geometry=loft, Material=ColourSwatch(SwatchColor=RGB(105, 105, 105)))
