# Grasshopper definition Leonie_Sollermann-abg-1_fünfecke.gh (Grasshopper 1.0.7)

srf = Surface(<surface referenced from the Rhino model>)
pt = Point([<point referenced from the Rhino model> x3])
pop2d = Populate2D(Region=srf, Count=Slider(441, range=0..1000), Seed=Slider(76, range=0..100))
pull = PullPoint(Point=pop2d, Geometry=pt, ClosestOnly=True)  # -> ClosestPoint, Distance
voronoi = Voronoi(Points=pop2d, Boundary=srf, BruteForceOverride=False)
bnd = Bounds(Numbers=pull.Distance)
dom = ConstructDomain(DomainStart=Slider(0.7, range=0..1), DomainEnd=Slider(0.9, range=0..1))
area = Area(Geometry=voronoi)  # -> Area, Centroid
remap = RemapNumbers(Value=pull.Distance, Source=bnd, Target=dom)  # -> Mapped, Clipped
scale = Scale(Geometry=voronoi, Center=area.Centroid, Factor=remap.Mapped)  # -> Geometry, Transform
bnd_2 = Bounds(Numbers=area.Area)
merge = Merge(Data1=voronoi, Data2=scale.Geometry)
dom_2 = ConstructDomain(DomainStart=Slider(2, range=0..10), DomainEnd=Slider(1, range=0..1))
boundary = BoundarySurfaces(Edges=merge)
remap_2 = RemapNumbers(Value=area.Area, Source=bnd_2, Target=dom_2)  # -> Mapped, Clipped
Z = UnitZ(Factor=remap_2.Mapped)
extr = Extrude(Base=boundary, Direction=Z)
preview = CustomPreview(Geometry=extr, Material=ColourSwatch(SwatchColor=RGB(3, 3, 3)))
