# Grasshopper definition Tatjana_Gunther-abg-1.gh (Grasshopper 1.0.7)

series = Series(Start=1, Step=1, Count=Slider(300, range=0..300))

expression = Expression(x=series, y=Slider(1, range=1..100), Expression="(sin(x/y))²")
unit_z = UnitZ(Factor=expression)

expression_2 = Expression(x=series, y=Slider(100, range=1..100), Expression="(sin(x/y))²")
expression_3 = Expression(x=series, Expression="cos(x)")
multiplication = Multiplication(A=expression_3, B=Slider(148, range=0..1000))

expression_4 = Expression(x=series, y=Slider(11, range=1..100), Expression="x*2*π/y")
expression_5 = Expression(x=expression_4, Expression="cos(x)")
expression_6 = Expression(x=expression_4, Expression="sin(x)")
unit_x = UnitX(Factor=expression_5)
unit_y = UnitY(Factor=expression_6)

number_slider = Slider(1, range=0..1)
addition = Addition(A=unit_x, B=unit_y, C=unit_z)
multiplication_2 = Multiplication(A=addition, B=multiplication)
interpolate_t = InterpolateT(Vertices=multiplication_2, TangentStart=Vector(0, 0, 0), TangentEnd=Vector(0, 0, 0), KnotStyle=Slider(0, range=0..3))  # -> Curve, Length, Domain
