# Grasshopper definition JonasKentner.gh (Grasshopper 1.0.7)

number_slider = Slider(4, range=0..10)
series = Series(Start=0, Step=Slider(40, range=0..100), Count=Slider(2, range=0..100))
series_2 = Series(Start=0, Step=number_slider, Count=Slider(4, range=0..10))
X = UnitX(Factor=series)
Y = UnitY(Factor=series_2)
pt = Point(graft(Y))
pt_2 = Point(X)
addition = Addition(A=pt_2, B=pt)
pline = PolyLine(Vertices=addition, Closed=False)

crv = Curve(pline)

number_slider_2 = Slider(14, range=0..100)
series_3 = Series(Start=0, Step=Slider(3, range=0..10), Count=number_slider_2)
random = Random(Range=number_slider_2, Number=number_slider_2, Seed=Slider(116, range=0..1000))
pt_3 = ConstructPoint(XCoordinate=series_3, YCoordinate=random, ZCoordinate=0)
nurbs = NurbsCurve(Vertices=pt_3, Degree=3, Periodic=False)  # -> Curve, Length, Domain
clx = CurveLine(Curve=nurbs.Curve, Line=crv)  # -> Points, Params, Count
eval = EvaluateCurve(Curve=nurbs.Curve, Parameter=clx.Params)  # -> Point, Tangent, Angle

cluster = Cluster(C=crv, D=Slider(0.2, range=0..1))
crv_2 = Curve(cluster)

cluster_2 = Cluster_2(C=crv)
eval_2 = EvaluateCurve(Curve=crv, Parameter=cluster_2)  # -> Point, Tangent, Angle
cluster_3 = Cluster_3(A=eval_2.Point, G=eval_2.Tangent, A_2=eval_2.Point)
cluster_4 = Cluster(C=cluster_3, D=Slider(0.5, range=0..10))
rdiff = RegionDifference(CurvesA=crv_2, CurvesB=flatten(cluster_4))

X_2 = UnitX(Factor=Slider(1.543, range=0..10))
Y_2 = UnitY(Factor=number_slider)
neg = Negative(Value=Y_2)
move = Move(Geometry=eval.Point, Motion=X_2)  # -> Geometry, Transform
move_2 = Move(Geometry=move.Geometry, Motion=neg)  # -> Geometry, Transform
ln = Line(StartPoint=move.Geometry, EndPoint=move_2.Geometry)
cluster_5 = Cluster(C=ln, D=Slider(0.1, range=0..1))

Y_3 = UnitY(Factor=1)
neg_2 = Negative(Value=Y_3)
move_3 = Move(Geometry=eval.Point, Motion=neg_2)  # -> Geometry, Transform
move_4 = Move(Geometry=eval.Point, Motion=Y_3)  # -> Geometry, Transform
ln_2 = Line(StartPoint=move_4.Geometry, EndPoint=move_3.Geometry)
cluster_6 = Cluster(C=ln_2, D=Slider(0.5, range=0..10))
rdiff_2 = RegionDifference(CurvesA=crv_2, CurvesB=flatten(cluster_6))

sift = SiftPattern(List=ln, SiftPattern=[0, 1])  # -> Output0, Output1
crv_3 = Curve(sift.Output0)
crv_4 = Curve(sift.Output1)
end = EndPoints(Curve=crv_4)  # -> Start, End
rectangle = Rectangle(Plane=end.End, XSize=Domain(-1, 1), YSize=Domain(0.2, 1), Radius=0)  # -> Rectangle, Length

crv_5 = Curve(rdiff_2)
merge = Merge(Data1=flatten(cluster_5), Data2=flatten(crv_5))
runion = RegionUnion(Curves=merge)
rdiff_3 = RegionDifference(CurvesA=runion, CurvesB=flatten(rectangle.Rectangle))

# ==== cluster Cluster
C = ClusterInput()
D = ClusterInput()
neg = Negative(Value=D)
offset = OffsetCurve(Curve=C, Distance=D, Plane=PlaneXY(0, 0, 0), Corners=1)
offset_2 = OffsetCurve(Curve=C, Distance=neg, Plane=PlaneXY(0, 0, 0), Corners=1)
end = EndPoints(Curve=offset)  # -> Start, End
end_2 = EndPoints(Curve=offset_2)  # -> Start, End
ln = Line(StartPoint=end.Start, EndPoint=end_2.Start)
ln_2 = Line(StartPoint=end.End, EndPoint=end_2.End)
merge = Merge(Data1=offset, Data2=ln, Data3=offset_2, Data4=ln_2)
join = JoinCurves(Curves=merge, Preserve=False)
C_2 = ClusterOutput(join)

# ==== cluster Cluster_2
C = ClusterInput()
divide = DivideCurve(Curve=C, Count=Slider(6, range=0..100), Kinks=False)  # -> Points, Tangents, Parameters
num = Number(divide.Parameters)
split = SplitList(List=num, Index=Slider(1, range=0..100))  # -> ListA, ListB
lng = ListLength(List=split.ListB)
subtraction = Subtraction(A=lng, B=Slider(1, range=0..1))
split_2 = SplitList(List=split.ListB, Index=subtraction)  # -> ListA, ListB
A = ClusterOutput(split_2.ListA)

# ==== cluster Cluster_3
number_slider = Slider(0.5, range=0..10)
G = ClusterInput()
rotate = Rotate(Geometry=G, Angle=0, Plane=PlaneXY(0, 0, 0))  # -> Geometry, Transform
neg = Negative(Value=number_slider)
multiplication = Multiplication(A=rotate.Geometry, B=number_slider)
multiplication_2 = Multiplication(A=rotate.Geometry, B=neg)
A = ClusterInput()
A_2 = ClusterInput()
addition = Addition(A=A, B=multiplication)
addition_2 = Addition(A=A_2, B=multiplication_2)
ln = Line(StartPoint=addition, EndPoint=addition_2)
L = ClusterOutput(ln)
