# Grasshopper definition LeonieSollermann.gh (Grasshopper 1.0.7)

pt = ConstructPoint(XCoordinate=0, YCoordinate=Slider(4, range=0..100), ZCoordinate=0)
pt_2 = ConstructPoint(XCoordinate=Slider(17, range=0..100), YCoordinate=Slider(4, range=0..100), ZCoordinate=0)
crv = Curve(<curve referenced from the Rhino model>)
ln = Line(StartPoint=pt, EndPoint=pt_2)
divide = DivideCurve(Curve=crv, Count=Slider(4, range=0..10), Kinks=False)  # -> Points, Tangents, Parameters
pt_3 = ConstructPoint(XCoordinate=Slider(6, range=-20..100), YCoordinate=Slider(25, range=-20..100), ZCoordinate=0)
pt_4 = ConstructPoint(XCoordinate=Slider(-5.4, range=-20..100), YCoordinate=Slider(25, range=-20..100), ZCoordinate=0)
curve_thickness = CurveThickness(crv=crv, D=Slider(0.2, range=0..1))
eval = EvaluateCurve(Curve=crv, Parameter=divide.Parameters)  # -> Point, Tangent, Angle
ln_2 = Line(StartPoint=pt_3, EndPoint=pt_4)
number_slider = Slider(0.2, range=0..1)
number_slider_2 = Slider(0.2, range=0..1)
rotate = Rotate(Geometry=eval.Tangent, Angle=1.570796327, Plane=PlaneXY(0, 0, 0))  # -> Geometry, Transform
number_slider_3 = Slider(0.2, range=0..1)
neg = Negative(Value=Slider(2.5, range=0..10))
neg_2 = Negative(Value=number_slider)
multiplication = Multiplication(A=rotate.Geometry)
neg_3 = Negative(Value=number_slider_2)
crv_2 = Curve(<curve referenced from the Rhino model>)
multiplication_2 = Multiplication(A=rotate.Geometry, B=neg)
number_slider_4 = Slider(0.2, range=0..1)
offset = OffsetCurve(Curve=ln_2, Distance=neg_2, Plane=PlaneXY(0, 0, 0), Corners=1)
offset_2 = OffsetCurve(Curve=ln_2, Distance=number_slider, Plane=PlaneXY(0, 0, 0), Corners=1)
neg_4 = Negative(Value=number_slider_3)
offset_3 = OffsetCurve(Curve=ln, Distance=neg_3, Plane=PlaneXY(0, 0, 0), Corners=1)
offset_4 = OffsetCurve(Curve=ln, Distance=number_slider_2, Plane=PlaneXY(0, 0, 0), Corners=1)
crv_3 = Curve(<curve referenced from the Rhino model>)
addition = Addition(A=eval.Point, B=multiplication)
addition_2 = Addition(A=eval.Point, B=multiplication_2)
end = EndPoints(Curve=offset_2)  # -> Start, End
end_2 = EndPoints(Curve=offset)  # -> Start, End
offset_5 = OffsetCurve(Curve=crv_2, Distance=number_slider_3, Plane=PlaneXY(0, 0, 0), Corners=1)
offset_6 = OffsetCurve(Curve=crv_2, Distance=neg_4, Plane=PlaneXY(0, 0, 0), Corners=1)
end_3 = EndPoints(Curve=offset_4)  # -> Start, End
end_4 = EndPoints(Curve=offset_3)  # -> Start, End
neg_5 = Negative(Value=number_slider_4)
ln_3 = Line(StartPoint=addition, EndPoint=addition_2)
ln_4 = Line(StartPoint=end.End, EndPoint=end_2.End)
ln_5 = Line(StartPoint=end.Start, EndPoint=end_2.Start)
end_5 = EndPoints(Curve=offset_5)  # -> Start, End
end_6 = EndPoints(Curve=offset_6)  # -> Start, End
ln_6 = Line(StartPoint=end_3.End, EndPoint=end_4.End)
ln_7 = Line(StartPoint=end_3.Start, EndPoint=end_4.Start)
offset_7 = OffsetCurve(Curve=crv_3, Distance=number_slider_4, Plane=PlaneXY(0, 0, 0), Corners=1)
offset_8 = OffsetCurve(Curve=crv_3, Distance=neg_5, Plane=PlaneXY(0, 0, 0), Corners=1)
ln_8 = Line(StartPoint=end_5.End, EndPoint=end_6.End)
ln_9 = Line(StartPoint=end_5.Start, EndPoint=end_6.Start)
merge = Merge(Data1=offset_2, Data2=ln_5, Data3=offset, Data4=ln_4)
end_7 = EndPoints(Curve=offset_7)  # -> Start, End
end_8 = EndPoints(Curve=offset_8)  # -> Start, End
curve_thickness_2 = CurveThickness(crv=ln_3, D=Slider(1.5, range=0..10))
merge_2 = Merge(Data1=offset_4, Data2=ln_7, Data3=offset_3, Data4=ln_6)
merge_3 = Merge(Data1=offset_5, Data2=offset_6, Data3=ln_9, Data4=ln_8)
ln_10 = Line(StartPoint=end_7.End, EndPoint=end_8.End)
ln_11 = Line(StartPoint=end_7.Start, EndPoint=end_8.Start)
rdiff = RegionDifference(CurvesA=curve_thickness, CurvesB=flatten(curve_thickness_2))
pt_5 = ConstructPoint(XCoordinate=Slider(5.8, range=-20..100), YCoordinate=Slider(72.1, range=-20..100), ZCoordinate=0)
merge_4 = Merge(Data1=offset_7, Data2=offset_8, Data3=ln_11, Data4=ln_10)
merge_5 = Merge(Data1=merge_2, Data2=merge_4)
scale = Scale(Geometry=merge_3, Center=pt_5, Factor=Slider(0.6, range=0..1))  # -> Geometry, Transform
merge_6 = Merge(Data1=flatten(merge), Data2=flatten(rdiff), Data3=flatten(merge_3))
cluster = Cluster(num=Slider(6, range=0..10), crv=merge_5)
pt_6 = ConstructPoint(XCoordinate=Slider(0, range=0..100), YCoordinate=Slider(32, range=0..100), ZCoordinate=0)
runion = RegionUnion(Curves=merge_6)
runion_2 = RegionUnion(Curves=cluster)
rotate_2 = Rotate(Geometry=cluster, Angle=1.570796327, Plane=pt_6)  # -> Geometry, Transform
pt_7 = ConstructPoint(XCoordinate=Slider(-0.7, range=-20..100), YCoordinate=Slider(-11.5, range=-20..100), ZCoordinate=0)
move = Move(Geometry=rotate_2.Geometry, Motion=pt_7)  # -> Geometry, Transform

# ==== cluster Cluster
num = ClusterInput()
crv = ClusterInput()
num_2 = Number(num)
crv_2 = Curve(crv)
neg = Negative(Value=num_2)
offset = OffsetCurve(Curve=crv_2, Distance=num_2, Plane=PlaneXY(0, 0, 0), Corners=1)
offset_2 = OffsetCurve(Curve=crv_2, Distance=neg, Plane=PlaneXY(0, 0, 0), Corners=1)
end = EndPoints(Curve=offset_2)  # -> Start, End
end_2 = EndPoints(Curve=offset)  # -> Start, End
ln = Line(StartPoint=end_2.Start, EndPoint=end.Start)
ln_2 = Line(StartPoint=end_2.End, EndPoint=end.End)
merge = Merge(Data1=ln, Data2=ln_2, Data3=offset, Data4=offset_2)
join = JoinCurves(Curves=merge, Preserve=False)
C = ClusterOutput(join)

# ==== cluster CurveThickness
crv = ClusterInput()
D = ClusterInput()

# ---- group: giving curve thickness
crv_2 = Curve(crv)
neg = Negative(Value=D)
offset = OffsetCurve(Curve=crv_2, Distance=neg, Plane=PlaneXY(0, 0, 0), Corners=1)
offset_2 = OffsetCurve(Curve=crv_2, Distance=D, Plane=PlaneXY(0, 0, 0), Corners=1)
end = EndPoints(Curve=offset_2)  # -> Start, End
end_2 = EndPoints(Curve=offset)  # -> Start, End
ln = Line(StartPoint=end.Start, EndPoint=end_2.Start)
ln_2 = Line(StartPoint=end.End, EndPoint=end_2.End)
merge = Merge(Data1=offset_2, Data2=ln, Data3=ln_2, Data4=offset)
join = JoinCurves(Curves=merge, Preserve=False)

# ----
C = ClusterOutput(join)
