# Grasshopper definition DominikVukovic.gh (Grasshopper 1.0.7)

y = XCoordinate(1)
y_2 = XCoordinate(1)
pt = ConstructPoint(XCoordinate=0, YCoordinate=Slider(53, range=0..100), ZCoordinate=0)
pt_2 = ConstructPoint(XCoordinate=Slider(66, range=0..100), YCoordinate=y, ZCoordinate=0)
number_slider = Slider(3, range=0..100)
rectangle = Rectangle(Plane=PlaneXY(0, 0, 0), XSize=pt, YSize=pt_2, Radius=0)  # -> Rectangle, Length
offset = OffsetCurve(Curve=rectangle.Rectangle, Distance=number_slider, Plane=PlaneXY(0, 0, 0), Corners=1)
number_slider_2 = Slider(0.284, range=0..1)
merge = Merge(Data1=offset, Data2=rectangle.Rectangle)
random = Random(Range=rectangle.Rectangle, Number=Slider(77.4, range=0..1000), Seed=Slider(414, range=0..1000))
neg = Negative(Value=number_slider_2)
sort = SortList(Keys=random)  # -> Keys, ValuesA
offset_2 = OffsetCurve(Curve=merge, Distance=neg, Plane=PlaneXY(0, 0, 0), Corners=1)
offset_3 = OffsetCurve(Curve=merge, Distance=number_slider_2, Plane=PlaneXY(0, 0, 0), Corners=1)
end = EndPoints(Curve=offset_2)  # -> Start, End
end_2 = EndPoints(Curve=offset_3)  # -> Start, End
eval = EvaluateCurve(Curve=rectangle.Rectangle, Parameter=sort.Keys)  # -> Point, Tangent, Angle
ln = Line(StartPoint=end.Start, EndPoint=end_2.Start)
ln_2 = Line(StartPoint=end_2.End, EndPoint=end.End)
multiplication = Multiplication(A=eval.Tangent, B=number_slider)
rotate = Rotate(Geometry=multiplication, Angle=4.71238898, Plane=PlaneXY(0, 0, 0))  # -> Geometry, Transform
merge_2 = Merge(Data1=offset_3, Data2=ln_2, Data3=ln, Data4=offset_2)
addition = Addition(A=eval.Point, B=rotate.Geometry)
join = JoinCurves(Curves=merge_2, Preserve=False)
ln_3 = Line(StartPoint=eval.Point, EndPoint=addition)
cls = Closed(Curve=join)  # -> Closed, Periodic

number_slider_3 = Slider(0.284, range=0..1)
crv = Curve(ln_3)
neg_2 = Negative(Value=number_slider_3)
offset_4 = OffsetCurve(Curve=crv, Distance=number_slider_3, Plane=PlaneXY(0, 0, 0), Corners=1)
offset_5 = OffsetCurve(Curve=crv, Distance=neg_2, Plane=PlaneXY(0, 0, 0), Corners=1)
end_3 = EndPoints(Curve=offset_5)  # -> Start, End
end_4 = EndPoints(Curve=offset_4)  # -> Start, End
ln_4 = Line(StartPoint=end_3.Start, EndPoint=end_4.Start)
ln_5 = Line(StartPoint=end_4.End, EndPoint=end_3.End)
merge_3 = Merge(Data1=ln_5, Data2=ln_4, Data3=offset_4, Data4=offset_5, Data5=merge_2)

midpt = CurveMiddle(Curve=ln_3)
num = Number(ln_3)
split = SplitList(List=num, Index=Slider(0, range=0..1))  # -> ListA, ListB
len = Length(Curve=ln_3)
lng = ListLength(List=split.ListB)
subtraction = Subtraction(A=lng, B=Slider(1, range=0..1))
division = Division(A=1, B=len)
split_2 = SplitList(List=split.ListB, Index=subtraction)  # -> ListA, ListB
eval_2 = EvaluateCurve(Curve=ln_3, Parameter=division)  # -> Point, Tangent, Angle
number_slider_4 = Slider(0.599, range=0..10)
rotate_2 = Rotate(Geometry=eval_2.Tangent, Angle=4.71238898, Plane=PlaneXY(0, 0, 0))  # -> Geometry, Transform
join_2 = JoinCurves(Curves=merge_3, Preserve=False)
neg_3 = Negative(Value=number_slider_4)
multiplication_2 = Multiplication(A=rotate_2.Geometry, B=number_slider_4)
multiplication_3 = Multiplication(A=rotate_2.Geometry, B=neg_3)
addition_2 = Addition(A=eval_2.Point, B=multiplication_2)
addition_3 = Addition(A=eval_2.Point, B=multiplication_3)
ln_6 = Line(StartPoint=addition_2, EndPoint=addition_3)
number_slider_5 = Slider(0.451, range=0..1)
xy = XYPlane(Origin=Point(0, 0, 0))
neg_4 = Negative(Value=number_slider_5)
offset_6 = OffsetCurve(Curve=ln_6, Distance=neg_4, Plane=PlaneXY(0, 0, 0), Corners=1)
offset_7 = OffsetCurve(Curve=ln_6, Distance=number_slider_5, Plane=PlaneXY(0, 0, 0), Corners=1)
end_5 = EndPoints(Curve=offset_6)  # -> Start, End
end_6 = EndPoints(Curve=offset_7)  # -> Start, End
ln_7 = Line(StartPoint=end_5.Start, EndPoint=end_6.Start)
ln_8 = Line(StartPoint=end_6.End, EndPoint=end_5.End)
merge_4 = Merge(Data1=offset_7, Data2=ln_8, Data3=ln_7, Data4=offset_6)
rdiff = RegionDifference(CurvesA=join_2, CurvesB=merge_4, Plane=xy)
