# Grasshopper definition KentnerJonas.gh (Grasshopper 1.0.7)

number_slider = Slider(5, range=0..10)
series = Series(Start=0, Step=Slider(123, range=0..1000), Count=Slider(2, range=0..10))
series_2 = Series(Start=0, Step=number_slider, Count=Slider(2, range=0..10))  # -> graft(Series)
X = UnitX(Factor=series)
Y = UnitY(Factor=series_2)
pt = Point(X)
pt_2 = Point(graft(Y))
addition = Addition(A=pt, B=pt_2)
pline = PolyLine(Vertices=addition, Closed=False)

number_slider_2 = Slider(5.175, range=0..10)
random = Random(Range=Domain(0, 100), Number=number_slider_2, Seed=number_slider_2)
divlength = DivideLength(Curve=pline, Length=random)  # -> Points, Tangents, flatten(Parameters)
shatter = Shatter(Curve=pline, Parameters=divlength.Parameters)
number_slider_3 = Slider(5, range=0..10)
end = EndPoints(Curve=shatter)  # -> Start, End
split = SplitTree(Data=end.End, Masks=flatten("{0;0;1;0;0}"))  # -> Positive, Negative
split_2 = SplitTree(Data=end.Start, Masks=flatten("{0;0;1;0;0}"))  # -> Positive, Negative
split_3 = SplitList(List=split.Positive, Index=number_slider_3)  # -> ListA, ListB
split_4 = SplitList(List=split.Negative, Index=number_slider_3)  # -> ListA, ListB
ln = Line(StartPoint=split_3.ListB, EndPoint=split_4.ListB)
ln_2 = Line(StartPoint=split_2.Positive, EndPoint=split_2.Negative)
merge = Merge(Data1=ln_2, Data2=ln)

number_slider_4 = Slider(0.2, range=0..1)

crv = Curve(pline)
ext = ExtendCurve(Curve=crv, Type=0, Start=number_slider_4, End=number_slider_4)
crv_2 = Curve(ext)
neg = Negative(Value=number_slider_4)
offset = OffsetCurve(Curve=crv_2, Distance=number_slider_4, Plane=PlaneXY(0, 0, 0), Corners=1)
offset_2 = OffsetCurve(Curve=crv_2, Distance=neg, Plane=PlaneXY(0, 0, 0), Corners=1)
end_2 = EndPoints(Curve=offset)  # -> Start, End
end_3 = EndPoints(Curve=offset_2)  # -> Start, End
ln_3 = Line(StartPoint=end_2.Start, EndPoint=end_3.Start)
ln_4 = Line(StartPoint=end_2.End, EndPoint=end_3.End)
merge_2 = Merge(Data1=offset, Data2=ln_3, Data3=offset_2, Data4=ln_4)
join = JoinCurves(Curves=merge_2, Preserve=False)

Y_2 = UnitY(Factor=number_slider)
pline_2 = PolyLine(Vertices=pt, Closed=False)
multiplication = Multiplication(A=Y_2, B=Slider(0.5, range=0..1))
move = Move(Geometry=pline_2, Motion=multiplication)  # -> Geometry, Transform
clx = CurveLine(Curve=move.Geometry, Line=merge)  # -> Points, Params, Count
rectangle = Rectangle(Plane=clx.Points, XSize=Domain(-0.5, 0.5), YSize=Domain(-1, 1), Radius=0)  # -> Rectangle, Length

neg_2 = Negative(Value=number_slider_4)
offset_3 = OffsetCurve(Curve=merge, Distance=number_slider_4, Plane=PlaneXY(0, 0, 0), Corners=1)
offset_4 = OffsetCurve(Curve=merge, Distance=neg_2, Plane=PlaneXY(0, 0, 0), Corners=1)
end_4 = EndPoints(Curve=offset_3)  # -> Start, End
end_5 = EndPoints(Curve=offset_4)  # -> Start, End
ln_5 = Line(StartPoint=end_4.Start, EndPoint=end_5.Start)
ln_6 = Line(StartPoint=end_4.End, EndPoint=end_5.End)
merge_3 = Merge(Data1=offset_3, Data2=ln_5, Data3=offset_4, Data4=ln_6)
join_2 = JoinCurves(Curves=merge_3, Preserve=False)

rdiff = RegionDifference(CurvesA=join_2, CurvesB=rectangle.Rectangle)
merge_4 = Merge(Data1=flatten(rdiff), Data2=flatten(join))
runion = RegionUnion(Curves=merge_4)
