# Grasshopper definition KonradByron.gh (Grasshopper 1.0.7)

X = UnitX(Factor=Slider(3193, range=0..10000))
X_2 = UnitX(Factor=Slider(0, range=0..100))
ln = Line(StartPoint=X, EndPoint=X_2)
offset = OffsetCurve(Curve=ln, Distance=Slider(19, range=0..30), Plane=PlaneXY(0, 0, 0), Corners=1)
end = EndPoints(Curve=offset)  # -> Start, End
end_2 = EndPoints(Curve=ln)  # -> Start, End
ln_2 = Line(StartPoint=end_2.Start, EndPoint=end.Start)
ln_3 = Line(StartPoint=end_2.End, EndPoint=end.End)
curvepoint = PointOnCurve(ln_2, parameter=0.5)
curvepoint_2 = PointOnCurve(ln_3, parameter=0.5)
dom = ConstructDomain(DomainStart=Slider(0, range=0..10), DomainEnd=Slider(729, range=0..1000))
random = Random(Range=dom, Number=Slider(100, range=0..100), Seed=Slider(4572, range=0..10000))
ln_4 = Line(StartPoint=curvepoint_2, EndPoint=curvepoint)
ma = MassAddition(Input=random)  # -> Result, PartialResults
eval = EvaluateLength(Curve=ln_4, Length=ma.PartialResults, Normalized=Toggle(False))  # -> Point, Tangent, Parameter
join = JoinCurves(Curves=flatten([ln_3, ln_2, offset, ln]), Preserve=False)
panel = Panel("""40
50
70
90
120""")
join_2 = JoinCurves(Curves=join, Preserve=False)
lng = ListLength(List=eval.Point)
lng_2 = ListLength(List=panel)  # -> expr("x-1", Length)
random_2 = Random(Range=lng_2, Number=lng, Seed=2, Integers=True)
item = ListItem(List=panel, Index=random_2, Wrap=True)
cir = Circle(Plane=eval.Point, Radius=item)
runion = RegionUnion(Curves=[join_2, cir])
