# Grasshopper definition SinanYesildal.gh (Grasshopper 1.0.7)

number_slider = Slider(2, range=0..10)
X = UnitX(Factor=Slider(10, range=0..10))
pi = Pi(Factor=Slider(3.79, range=0..10))
division = Division(A=pi, B=number_slider)
series = Series(Start=0, Step=division, Count=number_slider)
rotate = Rotate(Geometry=X, Angle=series, Plane=PlaneXY(0, 0, 0))  # -> Geometry, Transform
random = Random(Range=rotate.Geometry, Number=Slider(50, range=0..1000), Seed=Slider(286, range=0..1000))
round = Round(Number=random)  # -> Nearest, Floor, Ceiling
item = ListItem(List=rotate.Geometry, Index=round.Floor, Wrap=True)
ma = MassAddition(Input=item)  # -> Result, PartialResults
pline = PolyLine(Vertices=ma.PartialResults, Closed=False)
number_slider_2 = Slider(0.6, range=0..1)
crv = Curve(pline)
curve_thickness = CurveThickness(C=crv, D=Slider(8, range=0..10), D_2=number_slider_2)  # -> C_2, C_4, C_3
curve_thickness_2 = CurveThickness(C=crv, D=number_slider_2, D_2=number_slider_2)  # -> C_2, C_4, C_3
korridor = Korridor(curves=[curve_thickness_2.C_2, curve_thickness.C_3], curve=curve_thickness_2.C_2, curve_2=curve_thickness.C_3)  # -> curves_2, end_2, end
divide_by_lenght = DividByLenght(curve=curve_thickness_2.C_2, distance=Slider(50, range=0..100))  # -> points, L, parameters
divid_by_lenght = DividByLenght(curve=curve_thickness.C_3, distance=Slider(20, range=0..1000))  # -> points, L, parameters
divide_by_lenght_2 = DividByLenght(curve=curve_thickness_2.C_2, distance=Slider(5, range=0..100))  # -> points, L, parameters
crv_2 = Curve(curve_thickness_2.C_4)
crv_3 = Curve(curve_thickness.C_4)
delete_last_and_first_element = DeleteLastAndFirstElement(L_2=divide_by_lenght.parameters, L=divide_by_lenght.points)
delete_last_and_first_element_2 = DeleteLastAndFirstElement(L_2=divid_by_lenght.parameters, L=divid_by_lenght.points)
rechteck_ausrichtung = RechteckAusrichtung(O=divide_by_lenght.points, C=curve_thickness_2.C_2, t=delete_last_and_first_element)  # -> pl_3, T
number_slider_3 = Slider(3, range=0..100)
number_slider_4 = Slider(5, range=0..100)
rechteck_ausrichtung_2 = RechteckAusrichtung(O=divid_by_lenght.L, C=curve_thickness.C_2, t=delete_last_and_first_element_2)  # -> pl_3, T
number_slider_5 = Slider(2, range=0..100)
number_slider_6 = Slider(3, range=0..100)
number_slider_7 = Slider(2, range=0..100)
rechteck_ausrichtung_3 = RechteckAusrichtung(O=divide_by_lenght_2.points, C=curve_thickness_2.C_2, t=divide_by_lenght_2.parameters)  # -> pl_3, T
rechteck_maße = RechteckMaße(A=number_slider_5, x=number_slider_5, A_2=number_slider_6, x_2=number_slider_6)  # -> I, I_2
rechteck_maße_2 = RechteckMaße(A=number_slider_4, x=number_slider_4, A_2=number_slider_3, x_2=number_slider_3)  # -> I, I_2
number_slider_8 = Slider(0.3, range=0..1)
rectangle = Rectangle(Plane=rechteck_ausrichtung.pl_3, XSize=rechteck_maße.I, YSize=rechteck_maße.I_2, Radius=0)  # -> Rectangle, Length
rectangle_2 = Rectangle(Plane=rechteck_ausrichtung_2.pl_3, XSize=rechteck_maße_2.I, YSize=rechteck_maße_2.I_2, Radius=0)  # -> Rectangle, Length
number_slider_9 = Slider(10, range=0..10)
doorway = Doorway(curves_a=crv_3, plane=rechteck_ausrichtung_2.pl_3, A=number_slider_7, x=number_slider_7)
room = Room(value=number_slider_8, curves_a=rectangle.Rectangle, curves_b=korridor.curves_2, curves_b_2=crv_2)
room_2 = Room(value=number_slider_8, curves_a=rectangle_2.Rectangle, curves_b=korridor.curves_2, curves_b_2=crv_3)
opening = Doorway(curves_a=crv_2, plane=rechteck_ausrichtung.pl_3, A=number_slider_7, x=number_slider_7)
explode = Explode(Curve=room_2, Recursive=True)  # -> Segments, Vertices
item_2 = ListItem(List=explode.Segments, Index=Slider(7, range=0..10), Wrap=True)
eval = EvaluateCurve(Curve=item_2, Parameter=Slider(3.1936, range=0..100))  # -> Point, Tangent, Angle
pl = PlaneNormal(Origin=eval.Point, ZAxis=Vector(0, 0, 1))
lng = ListLength(List=eval.Point)
openings = Doorway(curves_a=opening, plane=rechteck_ausrichtung_3.pl_3, A=number_slider_7, x=number_slider_7)
ma_2 = MassAddition(Input=flatten(lng))  # -> Result, PartialResults
align = AlignPlane(Plane=pl, Direction=eval.Tangent)  # -> Plane, Angle
pcen = PolygonCenter(Polyline=openings)  # -> CenterV, CenterE, CenterA
dom = ConstructDomain(DomainStart=Slider(4, range=0..10), DomainEnd=Slider(6, range=0..10))
random_2 = Random(Range=dom, Number=flatten(lng), Seed=ma_2.PartialResults)
neg = Negative(Value=random_2)
dom_2 = ConstructDomain(DomainStart=Slider(3, range=0..10), DomainEnd=Slider(30, range=0..100))
ma_3 = MassAddition(Input=flatten(lng))  # -> Result, PartialResults
dom_3 = ConstructDomain(DomainStart=neg, DomainEnd=random_2)
random_3 = Random(Range=dom_2, Number=flatten(lng), Seed=ma_3.PartialResults)
rectangle_3 = Rectangle(Plane=align.Plane, XSize=dom_3, YSize=random_3, Radius=0)  # -> flatten(Rectangle), Length
offset = OffsetCurve(Curve=rectangle_3.Rectangle, Distance=1, Plane=PlaneXY(0, 0, 0), Corners=1)
rdiff = RegionDifference(CurvesA=flatten(room_2), CurvesB=flatten(offset))
rectangle_4 = Rectangle(Plane=align.Plane, XSize=Domain(-1, 1), YSize=Domain(-2, 2), Radius=0)  # -> Rectangle, Length
rdiff_2 = RegionDifference(CurvesA=rectangle_3.Rectangle, CurvesB=rectangle_4.Rectangle)
rdiff_3 = RegionDifference(CurvesA=offset, CurvesB=rectangle_4.Rectangle)
rdiff_4 = RegionDifference(CurvesA=rdiff_3, CurvesB=rdiff_2)
circle = CircleCNR(Center=pcen.CenterV, Normal=Vector(0, 0, 1), Radius=Slider(0.2, range=0..1))
runion = RegionUnion(Curves=[doorway, opening, room, rdiff, rdiff_4])

# ==== cluster DividByLenght
distance = ClusterInput()
curve = ClusterInput()
divide_distance = DivideDistance(Curve=curve, Distance=distance)  # -> Points, Tangents, Parameters
points = ClusterOutput(divide_distance.Points)
parameters = ClusterOutput(divide_distance.Parameters)
lng = ListLength(List=divide_distance.Points)
subtraction = Subtraction(A=lng, B=1)
replace = ReplaceItems(List=divide_distance.Points, Indices=flatten([Slider(0, range=0..100), subtraction]), Wrap=False)
L = ClusterOutput(replace)

# ==== cluster RechteckMaße
x = ClusterInput()
x_2 = ClusterInput()
A = ClusterInput()
A_2 = ClusterInput()
neg = Negative(Value=x)
neg_2 = Negative(Value=x_2)
dom = ConstructDomain(DomainStart=A, DomainEnd=neg)
dom_2 = ConstructDomain(DomainStart=A_2, DomainEnd=neg_2)
I = ClusterOutput(dom)
I_2 = ClusterOutput(dom_2)

# ==== cluster RechteckAusrichtung
C = ClusterInput()
t = ClusterInput()
eval = EvaluateCurve(Curve=C, Parameter=t)  # -> Point, Tangent, Angle
O = ClusterInput()
pl = PlaneNormal(Origin=O, ZAxis=eval.Tangent)
deplane = DeconstructPlane(Plane=pl)  # -> Origin, XAxis, YAxis, ZAxis
T = ClusterOutput(eval.Tangent)
pl_2 = ConstructPlane(Origin=deplane.Origin, XAxis=deplane.XAxis, YAxis=deplane.ZAxis)
pl_3 = ClusterOutput(pl_2)

# ==== cluster DeleteLastAndFirstElement
L = ClusterInput()
lng = ListLength(List=L)
subtraction = Subtraction(A=lng, B=1)
L_2 = ClusterInput()
replace = ReplaceItems(List=L_2, Indices=flatten([Slider(0, range=0..100), subtraction]), Wrap=False)
L_3 = ClusterOutput(replace)

# ==== cluster CurveThickness
C = ClusterInput()
D = ClusterInput()
D_2 = ClusterInput()
offset = OffsetCurve(Curve=C, Distance=D, Plane=PlaneXY(0, 0, 0), Corners=1)
offset_2 = OffsetCurve(Curve=offset, Distance=D_2, Plane=PlaneXY(0, 0, 0), Corners=1)
C_2 = ClusterOutput(offset)
end = EndPoints(Curve=offset)  # -> Start, End
C_3 = ClusterOutput(offset_2)
end_2 = EndPoints(Curve=offset_2)  # -> Start, End
ln = Line(StartPoint=end.End, EndPoint=end_2.End)
ln_2 = Line(StartPoint=end.Start, EndPoint=end_2.Start)
join = JoinCurves(Curves=flatten([ln, ln_2, offset, offset_2]), Preserve=False)
C_4 = ClusterOutput(join)

# ==== cluster Room
curves_a = ClusterInput()
curves_b = ClusterInput()
value = ClusterInput()
region_difference = RegionDifference(CurvesA=curves_a, CurvesB=curves_b)
negative = Negative(Value=value)
offset_curve = OffsetCurve(Curve=region_difference, Distance=negative, Plane=PlaneXY(0, 0, 0), Corners=1)
curves_b_2 = ClusterInput()
region_difference_2 = RegionDifference(CurvesA=offset_curve, CurvesB=flatten([region_difference, curves_b_2]))  # -> flatten(Result)
sift = SiftPattern(List=region_difference_2, SiftPattern=[0, 1])  # -> Output0, Output1
crv = Curve(sift.Output0)
crv_2 = ClusterOutput(crv)

# ==== cluster Korridor
curve = ClusterInput()
curve_2 = ClusterInput()
end_points = EndPoints(Curve=curve)  # -> Start, End
end_points_2 = EndPoints(Curve=curve_2)  # -> Start, End
line = Line(StartPoint=end_points.End, EndPoint=end_points_2.End)
line_2 = Line(StartPoint=end_points.Start, EndPoint=end_points_2.Start)
curves = ClusterInput()
join_curves = JoinCurves(Curves=flatten([line_2, line, curves]), Preserve=False)
end = ClusterOutput(end_points_2.End)
end_2 = ClusterOutput(end_points.End)
curves_2 = ClusterOutput(join_curves)

# ==== cluster Doorway
A = ClusterInput()
x = ClusterInput()
plane = ClusterInput()
curves_a = ClusterInput()

# ---- group: Doorway
rechteck_maße = RechteckMaße(A="1", x="1", A_2=A, x_2=x)  # -> I, I_2
rectangle = Rectangle(Plane=plane, XSize=rechteck_maße.I, YSize=rechteck_maße.I_2, Radius=0)  # -> Rectangle, Length
region_difference = RegionDifference(CurvesA=curves_a, CurvesB=flatten(rectangle.Rectangle))

# ----
result = ClusterOutput(region_difference)
