# Grasshopper definition TatjanaGünther.gh (Grasshopper 1.0.7)

# ---- group: Enfilade gerade
pt = ConstructPoint(XCoordinate=Slider(100, range=0..100), YCoordinate=Slider(0, range=0..100), ZCoordinate=0)
pt_2 = ConstructPoint(XCoordinate=Slider(0, range=0..100), YCoordinate=Slider(0, range=0..100), ZCoordinate=0)
pt_3 = ConstructPoint(XCoordinate=Slider(30, range=0..100), YCoordinate=Slider(0, range=0..100), ZCoordinate=0)
pt_4 = ConstructPoint(XCoordinate=Slider(63, range=0..100), YCoordinate=Slider(0, range=0..100), ZCoordinate=0)
pt_5 = ConstructPoint(XCoordinate=Slider(16, range=0..100), YCoordinate=Slider(0, range=0..100), ZCoordinate=0)
pt_6 = ConstructPoint(XCoordinate=Slider(51, range=0..100), YCoordinate=Slider(0, range=0..100), ZCoordinate=0)
pt_7 = ConstructPoint(XCoordinate=Slider(82, range=0..100), YCoordinate=Slider(0, range=0..100), ZCoordinate=0)
vec = VectorXYZ(XComponent=0, YComponent=Slider(20, range=0..20), ZComponent=0)  # -> Vector, Length
vec_2 = VectorXYZ(XComponent=0, YComponent=Slider(20, range=0..20), ZComponent=0)  # -> Vector, Length
vec_3 = VectorXYZ(XComponent=0, YComponent=Slider(20, range=0..20), ZComponent=0)  # -> Vector, Length
vec_4 = VectorXYZ(XComponent=0, YComponent=Slider(20, range=0..20), ZComponent=0)  # -> Vector, Length
vec_5 = VectorXYZ(XComponent=0, YComponent=Slider(20, range=0..20), ZComponent=0)  # -> Vector, Length
vec_6 = VectorXYZ(XComponent=0, YComponent=Slider(20, range=0..20), ZComponent=0)  # -> Vector, Length
vec_7 = VectorXYZ(XComponent=0, YComponent=Slider(20, range=0..20), ZComponent=0)  # -> Vector, Length
move = Move(Geometry=pt_2, Motion=vec.Vector)  # -> Geometry, Transform
move_2 = Move(Geometry=pt_5, Motion=vec_2.Vector)  # -> Geometry, Transform
move_3 = Move(Geometry=pt_3, Motion=vec_3.Vector)  # -> Geometry, Transform
move_4 = Move(Geometry=pt_6, Motion=vec_4.Vector)  # -> Geometry, Transform
move_5 = Move(Geometry=pt_7, Motion=vec_5.Vector)  # -> Geometry, Transform
move_6 = Move(Geometry=pt, Motion=vec_6.Vector)  # -> Geometry, Transform
move_7 = Move(Geometry=pt_4, Motion=vec_7.Vector)  # -> Geometry, Transform
number_slider = Slider(0.7, range=0..1)
pline = PolyLine(Vertices=[pt_2, pt_5, pt_3, pt_6, pt_4, pt_7, pt], Closed=False)
pline_2 = PolyLine(
    Vertices=[move.Geometry, move_2.Geometry, move_3.Geometry, move_4.Geometry, move_7.Geometry, move_5.Geometry, move_6.Geometry],
    Closed=False)
breite_wand = Slider(0.3, range=0..1)
breite_wand_2 = Slider(0.3, range=0..1)
breite_wand_3 = Slider(0.3, range=0..1)
breite_wand_4 = Slider(0.3, range=0..1)
breite_wand_5 = Slider(0.3, range=0..1)
innenwand_5 = Innenwand1(D=breite_wand, A=pt_7, G=move_5.Geometry, x=number_slider, x_2=breite_wand)  # -> pt_2, C
innenwand_4 = Innenwand1(D=breite_wand_4, A=pt_4, G=move_7.Geometry, x=number_slider, x_2=breite_wand_4)  # -> pt_2, C
innenwand_1 = Innenwand1(D=breite_wand_2, A=pt_5, G=move_2.Geometry, x=number_slider, x_2=breite_wand_2)  # -> pt_2, C
innenwand_3 = Innenwand1(D=breite_wand_3, A=pt_6, G=move_4.Geometry, x=number_slider, x_2=breite_wand_3)  # -> pt_2, C
innenwand_2 = Innenwand1(D=breite_wand_5, A=pt_3, G=move_3.Geometry, x=number_slider, x_2=breite_wand_5)  # -> pt_2, C
außenwand_süd = AußenwandSüd(C_2=pline, D=number_slider, C=pline, x=number_slider)  # -> S, E, C_3
außenwand_nord = AußenwandNord(C_2=pline_2, D=number_slider, C=pline_2, x=number_slider)  # -> C_3, S, E
expression = Expression(x=number_slider, Expression="x*2")
außenwand_ost = AußenwandOst(x=expression, A=außenwand_süd.E, B=außenwand_nord.E)  # -> C, G
außenwand_west = AußenwandWest(A=außenwand_süd.S, D=expression, B=außenwand_nord.S)  # -> C, pt_2
number_slider_2 = Slider(1, range=0..10)
ln = Line(StartPoint=außenwand_west.pt_2, EndPoint=außenwand_ost.G)
neg = Negative(Value=number_slider_2)
merge = Merge(
    Data1=außenwand_süd.C_3,
    Data2=außenwand_west.C,
    Data3=außenwand_ost.C,
    Data4=außenwand_nord.C_3,
    Data5=innenwand_1.C,
    Data6=innenwand_2.C,
    Data7=innenwand_3.C,
    Data8=innenwand_4.C,
    Data9=innenwand_5.C)  # -> flatten(Result)
offset = OffsetCurve(Curve=ln, Distance=number_slider_2, Plane=PlaneXY(0, 0, 0), Corners=1)
offset_2 = OffsetCurve(Curve=ln, Distance=neg, Plane=PlaneXY(0, 0, 0), Corners=1)
join = JoinCurves(Curves=merge, Preserve=False)
end = EndPoints(Curve=offset)  # -> Start, End
end_2 = EndPoints(Curve=offset_2)  # -> Start, End
runion = RegionUnion(Curves=join)
ln_2 = Line(StartPoint=end.Start, EndPoint=end_2.Start)
ln_3 = Line(StartPoint=end.End, EndPoint=end_2.End)
pt_8 = ConstructPoint(XCoordinate=Slider(0, range=0..100), YCoordinate=Slider(0, range=0..100), ZCoordinate=Slider(0, range=0..100))
pt_9 = ConstructPoint(XCoordinate=Slider(0, range=0..100), YCoordinate=Slider(0, range=0..100), ZCoordinate=Slider(9, range=0..100))
sunion = SolidUnion(Breps=runion)
merge_2 = Merge(Data1=ln_2, Data2=offset, Data3=offset_2, Data4=ln_3)  # -> flatten(Result)
ln_4 = Line(StartPoint=pt_9, EndPoint=pt_8)
extrude = ExtrudeLinear(Profile=sunion, OrientationP=PlaneXY(0, 0, 0), Axis=ln_4)
join_2 = JoinCurves(Curves=merge_2, Preserve=False)
brep = Brep(join_2)
pt_10 = ConstructPoint(XCoordinate=Slider(0, range=0..100), YCoordinate=Slider(0, range=0..100), ZCoordinate=Slider(0, range=0..100))
pt_11 = ConstructPoint(XCoordinate=Slider(0, range=0..100), YCoordinate=Slider(0, range=0..100), ZCoordinate=Slider(7, range=0..100))
ln_5 = Line(StartPoint=pt_11, EndPoint=pt_10)
vec_8 = VectorXYZ(XComponent=0, YComponent=Slider(52, range=0..200), ZComponent=0)  # -> Vector, Length
extrude_2 = ExtrudeLinear(Profile=brep, OrientationP=PlaneXY(0, 0, 0), Axis=ln_5)
trim = TrimSolid(Shape=extrude, Cutters=extrude_2)
move_8 = Move(Geometry=trim, Motion=vec_8.Vector)  # -> Geometry, Transform

# ---- group: Enfilade geschwungen
pt_12 = ConstructPoint(XCoordinate=Slider(100, range=0..100), YCoordinate=Slider(17, range=0..100), ZCoordinate=0)
pt_13 = ConstructPoint(XCoordinate=Slider(0, range=0..100), YCoordinate=Slider(6, range=0..100), ZCoordinate=0)
pt_14 = ConstructPoint(XCoordinate=Slider(30, range=0..100), YCoordinate=Slider(9, range=0..100), ZCoordinate=0)
pt_15 = ConstructPoint(XCoordinate=Slider(63, range=0..100), YCoordinate=Slider(4, range=0..100), ZCoordinate=0)
pt_16 = ConstructPoint(XCoordinate=Slider(18, range=0..100), YCoordinate=Slider(0, range=0..100), ZCoordinate=0)
pt_17 = ConstructPoint(XCoordinate=Slider(51, range=0..100), YCoordinate=Slider(11, range=0..100), ZCoordinate=0)
pt_18 = ConstructPoint(XCoordinate=Slider(82, range=0..100), YCoordinate=Slider(13, range=0..100), ZCoordinate=0)
vec_9 = VectorXYZ(XComponent=0, YComponent=Slider(20, range=0..20), ZComponent=0)  # -> Vector, Length
vec_10 = VectorXYZ(XComponent=0, YComponent=Slider(20, range=0..20), ZComponent=0)  # -> Vector, Length
vec_11 = VectorXYZ(XComponent=0, YComponent=Slider(20, range=0..20), ZComponent=0)  # -> Vector, Length
vec_12 = VectorXYZ(XComponent=0, YComponent=Slider(20, range=0..20), ZComponent=0)  # -> Vector, Length
vec_13 = VectorXYZ(XComponent=0, YComponent=Slider(20, range=0..20), ZComponent=0)  # -> Vector, Length
vec_14 = VectorXYZ(XComponent=0, YComponent=Slider(20, range=0..20), ZComponent=0)  # -> Vector, Length
vec_15 = VectorXYZ(XComponent=0, YComponent=Slider(20, range=0..20), ZComponent=0)  # -> Vector, Length
move_9 = Move(Geometry=pt_13, Motion=vec_9.Vector)  # -> Geometry, Transform
move_10 = Move(Geometry=pt_16, Motion=vec_10.Vector)  # -> Geometry, Transform
move_11 = Move(Geometry=pt_14, Motion=vec_11.Vector)  # -> Geometry, Transform
move_12 = Move(Geometry=pt_17, Motion=vec_12.Vector)  # -> Geometry, Transform
move_13 = Move(Geometry=pt_18, Motion=vec_13.Vector)  # -> Geometry, Transform
move_14 = Move(Geometry=pt_12, Motion=vec_14.Vector)  # -> Geometry, Transform
move_15 = Move(Geometry=pt_15, Motion=vec_15.Vector)  # -> Geometry, Transform
number_slider_3 = Slider(0.7, range=0..1)
intcrv = Interpolate(Vertices=[pt_13, pt_16, pt_14, pt_17, pt_15, pt_18, pt_12], Degree=3, Periodic=False, KnotStyle=1)  # -> Curve, Length, Domain
intcrv_2 = Interpolate(
    Vertices=[move_9.Geometry, move_10.Geometry, move_11.Geometry, move_12.Geometry, move_15.Geometry, move_13.Geometry, move_14.Geometry],
    Degree=3,
    Periodic=False,
    KnotStyle=1)  # -> Curve, Length, Domain
breite_wand_6 = Slider(0.3, range=0..1)
breite_wand_7 = Slider(0.3, range=0..1)
breite_wand_8 = Slider(0.3, range=0..1)
breite_wand_9 = Slider(0.3, range=0..1)
breite_wand_10 = Slider(0.3, range=0..1)
innenwand_5_2 = Innenwand1(D=breite_wand_6, A=pt_18, G=move_13.Geometry, x=number_slider_3, x_2=breite_wand_6)  # -> pt_2, C
innenwand_4_2 = Innenwand1(D=breite_wand_9, A=pt_15, G=move_15.Geometry, x=number_slider_3, x_2=breite_wand_9)  # -> pt_2, C
innenwand_1_2 = Innenwand1(D=breite_wand_7, A=pt_16, G=move_10.Geometry, x=number_slider_3, x_2=breite_wand_7)  # -> pt_2, C
innenwand_3_2 = Innenwand1(D=breite_wand_8, A=pt_17, G=move_12.Geometry, x=number_slider_3, x_2=breite_wand_8)  # -> pt_2, C
innenwand_2_2 = Innenwand1(D=breite_wand_10, A=pt_14, G=move_11.Geometry, x=number_slider_3, x_2=breite_wand_10)  # -> pt_2, C
außenwand_süd_2 = AußenwandSüd(C_2=intcrv.Curve, D=number_slider_3, C=intcrv.Curve, x=number_slider_3)  # -> S, E, C_3
außenwand_nord_2 = AußenwandNord(C_2=intcrv_2.Curve, D=number_slider_3, C=intcrv_2.Curve, x=number_slider_3)  # -> C_3, S, E
expression_2 = Expression(x=number_slider_3, Expression="x*2")
außenwand_ost_2 = AußenwandOst(x=expression_2, A=außenwand_süd_2.E, B=außenwand_nord_2.E)  # -> C, G
außenwand_west_2 = AußenwandWest(A=außenwand_süd_2.S, D=expression_2, B=außenwand_nord_2.S)  # -> C, pt_2
intcrv_3 = Interpolate(
    Vertices=[innenwand_1_2.pt_2, innenwand_2_2.pt_2, innenwand_3_2.pt_2, innenwand_4_2.pt_2, innenwand_5_2.pt_2],
    Degree=3,
    Periodic=False,
    KnotStyle=1)  # -> Curve, Length, Domain
number_slider_4 = Slider(1, range=0..10)
ext = ExtendCurve(Curve=intcrv_3.Curve, Type=0, Start=Slider(2, range=0..10), End=Slider(2, range=0..10))
neg_2 = Negative(Value=number_slider_4)
merge_3 = Merge(
    Data1=außenwand_süd_2.C_3,
    Data2=außenwand_west_2.C,
    Data3=außenwand_ost_2.C,
    Data4=außenwand_nord_2.C_3,
    Data5=innenwand_1_2.C,
    Data6=innenwand_2_2.C,
    Data7=innenwand_3_2.C,
    Data8=innenwand_4_2.C,
    Data9=innenwand_5_2.C)  # -> flatten(Result)
offset_3 = OffsetCurve(Curve=ext, Distance=number_slider_4, Plane=PlaneXY(0, 0, 0), Corners=1)
offset_4 = OffsetCurve(Curve=ext, Distance=neg_2, Plane=PlaneXY(0, 0, 0), Corners=1)
join_3 = JoinCurves(Curves=merge_3, Preserve=False)
end_3 = EndPoints(Curve=offset_3)  # -> Start, End
end_4 = EndPoints(Curve=offset_4)  # -> Start, End
runion_2 = RegionUnion(Curves=join_3)
ln_6 = Line(StartPoint=end_3.Start, EndPoint=end_4.Start)
ln_7 = Line(StartPoint=end_3.End, EndPoint=end_4.End)
pt_19 = ConstructPoint(XCoordinate=Slider(0, range=0..100), YCoordinate=Slider(0, range=0..100), ZCoordinate=Slider(0, range=0..100))
pt_20 = ConstructPoint(XCoordinate=Slider(0, range=0..100), YCoordinate=Slider(0, range=0..100), ZCoordinate=Slider(9, range=0..100))
sunion_2 = SolidUnion(Breps=runion_2)
merge_4 = Merge(Data1=ln_6, Data2=offset_3, Data3=offset_4, Data4=ln_7)  # -> flatten(Result)
ln_8 = Line(StartPoint=pt_20, EndPoint=pt_19)
extrude_3 = ExtrudeLinear(Profile=sunion_2, OrientationP=PlaneXY(0, 0, 0), Axis=ln_8)
join_4 = JoinCurves(Curves=merge_4, Preserve=False)
brep_2 = Brep(join_4)
pt_21 = ConstructPoint(XCoordinate=Slider(0, range=0..100), YCoordinate=Slider(0, range=0..100), ZCoordinate=Slider(0, range=0..100))
pt_22 = ConstructPoint(XCoordinate=Slider(0, range=0..100), YCoordinate=Slider(0, range=0..100), ZCoordinate=Slider(7, range=0..100))
ln_9 = Line(StartPoint=pt_22, EndPoint=pt_21)
extrude_4 = ExtrudeLinear(Profile=brep_2, OrientationP=PlaneXY(0, 0, 0), Axis=ln_9)
trim_2 = TrimSolid(Shape=extrude_3, Cutters=extrude_4)

# ==== cluster Innenwand1
x = ClusterInput()
neg = Negative(Value=x)
vec = VectorXYZ(XComponent=0, YComponent=neg, ZComponent=0)  # -> Vector, Length
G = ClusterInput()
move = Move(Geometry=G, Motion=vec.Vector)  # -> Geometry, Transform
A = ClusterInput()
x_2 = ClusterInput()
ln = Line(StartPoint=A, EndPoint=move.Geometry)
D = ClusterInput()
neg_2 = Negative(Value=x_2)
midpt = CurveMiddle(Curve=ln)
offset = OffsetCurve(Curve=ln, Distance=neg_2, Plane=PlaneXY(0, 0, 0), Corners=1)
offset_2 = OffsetCurve(Curve=ln, Distance=D, Plane=PlaneXY(0, 0, 0), Corners=1)
pt = Point(midpt)
end = EndPoints(Curve=offset_2)  # -> Start, End
end_2 = EndPoints(Curve=offset)  # -> Start, End
pt_2 = ClusterOutput(pt)
ln_2 = Line(StartPoint=end.Start, EndPoint=end_2.Start)
ln_3 = Line(StartPoint=end.End, EndPoint=end_2.End)
merge = Merge(Data1=offset_2, Data2=ln_2, Data3=ln_3, Data4=offset)  # -> flatten(Result)
join = JoinCurves(Curves=merge, Preserve=False)
C = ClusterOutput(join)

# ==== cluster AußenwandSüd
x = ClusterInput()
C = ClusterInput()
C_2 = ClusterInput()
D = ClusterInput()
neg = Negative(Value=x)
offset = OffsetCurve(Curve=C, Distance=neg, Plane=PlaneXY(0, 0, 0), Corners=1)
offset_2 = OffsetCurve(Curve=C_2, Distance=D, Plane=PlaneXY(0, 0, 0), Corners=1)
end = EndPoints(Curve=offset_2)  # -> Start, End
end_2 = EndPoints(Curve=offset)  # -> Start, End
S = ClusterOutput(end.Start)
E = ClusterOutput(end.End)
ln = Line(StartPoint=end.Start, EndPoint=end_2.Start)
ln_2 = Line(StartPoint=end.End, EndPoint=end_2.End)
merge = Merge(Data1=offset_2, Data2=offset, Data3=ln, Data4=ln_2)  # -> flatten(Result)
join = JoinCurves(Curves=merge, Preserve=False)
C_3 = ClusterOutput(join)

# ==== cluster AußenwandOst
A = ClusterInput()
B = ClusterInput()
ln = Line(StartPoint=A, EndPoint=B)
x = ClusterInput()
end = EndPoints(Curve=ln)  # -> Start, End
neg = Negative(Value=x)
offset = OffsetCurve(Curve=ln, Distance=neg, Plane=PlaneXY(0, 0, 0), Corners=1)
end_2 = EndPoints(Curve=offset)  # -> Start, End
ln_2 = Line(StartPoint=end.End, EndPoint=end_2.End)
ln_3 = Line(StartPoint=end.Start, EndPoint=end_2.Start)
midpt = CurveMiddle(Curve=offset)
vec = VectorXYZ(XComponent=Slider(-1, range=-10..0), YComponent=0, ZComponent=0)  # -> Vector, Length
merge = Merge(Data1=ln_2, Data2=ln_3, Data3=offset, Data4=ln)  # -> flatten(Result)
move = Move(Geometry=midpt, Motion=vec.Vector)  # -> Geometry, Transform
join = JoinCurves(Curves=merge, Preserve=False)
G = ClusterOutput(move.Geometry)
C = ClusterOutput(join)

# ==== cluster AußenwandWest
A = ClusterInput()
B = ClusterInput()
ln = Line(StartPoint=A, EndPoint=B)
end = EndPoints(Curve=ln)  # -> Start, End
D = ClusterInput()
offset = OffsetCurve(Curve=ln, Distance=D, Plane=PlaneXY(0, 0, 0), Corners=1)
end_2 = EndPoints(Curve=offset)  # -> Start, End
vec = VectorXYZ(XComponent=Slider(2, range=0..10), YComponent=0, ZComponent=0)  # -> Vector, Length
midpt = CurveMiddle(Curve=offset)
move = Move(Geometry=midpt, Motion=vec.Vector)  # -> Geometry, Transform
ln_2 = Line(StartPoint=end.Start, EndPoint=end_2.Start)
ln_3 = Line(StartPoint=end.End, EndPoint=end_2.End)
pt = Point(move.Geometry)
pt_2 = ClusterOutput(pt)
merge = Merge(Data1=ln_2, Data2=ln_3, Data3=ln, Data4=offset)  # -> flatten(Result)
join = JoinCurves(Curves=merge, Preserve=False)
C = ClusterOutput(join)

# ==== cluster AußenwandNord
x = ClusterInput()
C = ClusterInput()
C_2 = ClusterInput()
D = ClusterInput()
neg = Negative(Value=x)
offset = OffsetCurve(Curve=C, Distance=neg, Plane=PlaneXY(0, 0, 0), Corners=1)
offset_2 = OffsetCurve(Curve=C_2, Distance=D, Plane=PlaneXY(0, 0, 0), Corners=1)
end = EndPoints(Curve=offset)  # -> Start, End
end_2 = EndPoints(Curve=offset_2)  # -> Start, End
S = ClusterOutput(end.Start)
E = ClusterOutput(end.End)
ln = Line(StartPoint=end_2.Start, EndPoint=end.Start)
ln_2 = Line(StartPoint=end_2.End, EndPoint=end.End)
merge = Merge(Data1=ln, Data2=offset_2, Data3=ln_2, Data4=offset)  # -> flatten(Result)
join = JoinCurves(Curves=merge, Preserve=False)
C_3 = ClusterOutput(join)
