# Grasshopper definition DominikVukovic.gh (Grasshopper 1.0.7)

# ---- group: Oberfläche generiert / Z=100 Kurve
number_slider = Slider(4, range=0..25)
dom = ConstructDomain(DomainStart=Slider(0.161, range=0..100), DomainEnd=Slider(89.185, range=0..100))
random = Random(Range=dom, Number=number_slider, Seed=Slider(100, range=0..100))
random_2 = Random(Range=dom, Number=number_slider, Seed=Slider(71, range=0..100))
number_slider_2 = Slider(100, range=0..1000)
sort = SortList(Keys=random)  # -> Keys, ValuesA
sort_2 = SortList(Keys=random_2)  # -> Keys, ValuesA
pt = ConstructPoint(XCoordinate=sort.Keys, YCoordinate=sort_2.Keys, ZCoordinate=number_slider_2)
multiplication = Multiplication(A=pt, B=Slider(8, range=0..10))
rotate = Rotate(Geometry=pt, Angle=multiplication, Plane=PlaneXY(0, 0, 0))  # -> Geometry, Transform
Z = UnitZ(Factor=number_slider_2)
nurbs = NurbsCurve(Vertices=rotate.Geometry, Degree=3, Periodic=False)  # -> Curve, Length, Domain
xy = XYPlane(Origin=Z)
pline = PolyLine(Vertices=rotate.Geometry, Closed=False)
crvsrf = CurveOnSurface(Surface=xy, UVCoordinates=rotate.Geometry, Closed=nurbs.Curve)  # -> Curve, Length, Domain

# ---- group: Oberfläche generiert / Z=200 Kurve
number_slider_3 = Slider(4, range=0..25)
dom_2 = ConstructDomain(DomainStart=Slider(0.161, range=0..100), DomainEnd=Slider(100, range=0..100))
random_3 = Random(Range=dom_2, Number=number_slider_3, Seed=Slider(100, range=0..100))
random_4 = Random(Range=dom_2, Number=number_slider_3, Seed=Slider(66, range=0..100))
number_slider_4 = Slider(200, range=0..1000)
sort_3 = SortList(Keys=random_3)  # -> Keys, ValuesA
sort_4 = SortList(Keys=random_4)  # -> Keys, ValuesA
pt_2 = ConstructPoint(XCoordinate=sort_3.Keys, YCoordinate=sort_4.Keys, ZCoordinate=number_slider_4)
multiplication_2 = Multiplication(A=pt_2, B=Slider(1, range=0..10))
Z_2 = UnitZ(Factor=number_slider_4)
rotate_2 = Rotate(Geometry=pt_2, Angle=multiplication_2, Plane=PlaneXY(0, 0, 0))  # -> Geometry, Transform
nurbs_2 = NurbsCurve(Vertices=rotate_2.Geometry, Degree=3, Periodic=False)  # -> Curve, Length, Domain
xy_2 = XYPlane(Origin=Z_2)
pline_2 = PolyLine(Vertices=rotate_2.Geometry, Closed=False)
crvsrf_2 = CurveOnSurface(Surface=xy_2, UVCoordinates=rotate_2.Geometry, Closed=nurbs_2.Curve)  # -> Curve, Length, Domain

# ---- group: Oberfläche generiert / Z=0 Kurve
number_slider_5 = Slider(4, range=0..25)
dom_3 = ConstructDomain(DomainStart=Slider(0.161, range=0..100), DomainEnd=Slider(95, range=0..100))
random_5 = Random(Range=dom_3, Number=number_slider_5, Seed=Slider(100, range=0..100))
random_6 = Random(Range=dom_3, Number=number_slider_5, Seed=Slider(55, range=0..100))
sort_5 = SortList(Keys=random_5)  # -> Keys, ValuesA
sort_6 = SortList(Keys=random_6)  # -> Keys, ValuesA
pt_3 = ConstructPoint(XCoordinate=sort_5.Keys, YCoordinate=sort_6.Keys, ZCoordinate=0)
multiplication_3 = Multiplication(A=pt_3, B=Slider(7, range=0..10))
rotate_3 = Rotate(Geometry=pt_3, Angle=multiplication_3, Plane=PlaneXY(0, 0, 0))  # -> Geometry, Transform
nurbs_3 = NurbsCurve(Vertices=rotate_3.Geometry, Degree=3, Periodic=False)  # -> Curve, Length, Domain
xy_3 = XYPlane(Origin=Point(0, 0, 0))
pline_3 = PolyLine(Vertices=rotate_3.Geometry, Closed=False)
crvsrf_3 = CurveOnSurface(Surface=xy_3, UVCoordinates=rotate_3.Geometry, Closed=nurbs_3.Curve)  # -> Curve, Length, Domain

# ----
merge = Merge(Data1=crvsrf_3.Curve, Data2=crvsrf.Curve, Data3=crvsrf_2.Curve)
loft = Loft(Curves=merge, Options={Adjust=False, Closed=False, LoftEnds=0, LoftSimp=0, LoftType=1, Rebuild=10, Refit=0.01})
srf = Surface(loft)
num = Number(15)
domain² = Domain²(srf)
series = Series(Start=Slider(0, range=0..100), Step=num, Count=Slider(25, range=0..25))
dedom2 = DeconstructDomain²(Domain=domain²)  # -> UComponent, VComponent
series_2 = Series(Start=Slider(0, range=0..100), Step=Slider(61, range=0..100), Count=Slider(8, range=0..25))
num_2 = Number(series)
num_3 = Number(series_2)
bnd = Bounds(Numbers=num_2)
bnd_2 = Bounds(Numbers=num_3)
remap = RemapNumbers(Value=num_2, Source=bnd, Target=dedom2.VComponent)  # -> Mapped, Clipped
remap_2 = RemapNumbers(Value=num_3, Source=bnd_2, Target=dedom2.UComponent)  # -> Mapped, Clipped
num_4 = Number(remap_2.Mapped)
num_5 = Number(remap.Mapped)
numbers_to_domains = NumbersToDomains(num=num_4)  # -> I, R
numbers_to_domains_2 = NumbersToDomains(num=num_5)  # -> I, R
num_6 = Number(numbers_to_domains.R)
domain = Domain(numbers_to_domains.I)
num_7 = Number(numbers_to_domains_2.R)
dom² = ConstructDomain²(DomainU=graft(domain), DomainV=numbers_to_domains_2.I)
pt_4 = ConstructPoint(XCoordinate=graft(num_6), YCoordinate=num_7, ZCoordinate=0)  # -> graft(Point)
domain²_2 = Domain²(dom²)
subsrf = Isotrim(Surface=srf, Domain=domain²_2)  # -> graft(Surface)

# ---- group: um die curven random zu drehen
number_slider_6 = Slider(0, range=0..100)
number_slider_7 = Slider(7.5, range=0..10)
random_7 = Random(Range=Domain(0, 6.283185307), Number=Slider(9, range=0..100), Seed=Slider(55, range=0..100))
crv = Curve([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])
pt_5 = ConstructPoint(XCoordinate=number_slider_7, YCoordinate=number_slider_7, ZCoordinate=0)
round = Round(Number=random_7)  # -> Nearest, Floor, Ceiling
multiplication_4 = Multiplication(A=round.Nearest, B=0.5)
pi = Pi(Factor=multiplication_4)
rotate_4 = Rotate(Geometry=crv, Angle=pi, Plane=pt_5)  # -> Geometry, Transform

# ----
srf_2 = Surface(subsrf)
evalsrf = EvaluateSurface(Surface=srf_2, Point=pt_4)  # -> Point, Normal, UDirection, VDirection, Frame
pln = Plane(evalsrf.Frame)

# ---- group: Box um meine Curven
number_slider_8 = Slider(15, range=0..100)
division = Division(A=number_slider_8, B=2)
division_2 = Division(A=number_slider_8, B=2)
neg = Negative(Value=division)
dom_4 = ConstructDomain(DomainStart=division_2, DomainEnd=neg)
box = DomainBox(Base=PlaneXY(0, 0, 0), X=number_slider_8, Y=number_slider_8, Z=dom_4)

# ----
bbox = BoundingBox(Content=srf_2, Plane=pln)  # -> Box, Box_2

# ---- group: Nur etwas ausprobiert
crv_2 = Curve([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])
Z_3 = UnitZ(Factor=Slider(10, range=0..100))
extr = Extrude(Base=crv_2, Direction=Z_3)
xz = XZPlane(Origin=Point(0, 0, 0))
morph = BoxMorph(Geometry=crv_2, Reference=extr, Target=bbox.Box)
xy_4 = XYPlane(Origin=Point(0, 0, 0))
bbox_2 = BoundingBox(Content=extr, Plane=xz)  # -> Box, Box_2

# ----
lng = ListLength(List=flatten(bbox.Box))
lng_2 = ListLength(List=flatten(rotate_4.Geometry))
random_8 = Random(Range=lng_2, Number=lng, Seed=lng)
round_2 = Round(Number=random_8)  # -> Nearest, Floor, Ceiling
item = ListItem(List=rotate_4.Geometry, Index=round_2.Floor, Wrap=True)  # -> graft(Item)
boxmap = BoxMapping(Geometry=item, Source=box, Target=bbox.Box)  # -> Geometry, Transform
panel = Panel(item)
project = Project(Curve=boxmap.Geometry, Brep=srf_2, Direction=evalsrf.Normal)

# ==== cluster NumbersToDomains
num = ClusterInput()
num_2 = Number(num)
lng = ListLength(List=num_2)
subtraction = Subtraction(A=lng, B=1)
int = Integer(1)
split = SplitList(List=num_2, Index=int)  # -> ListA, ListB
split_2 = SplitList(List=num_2, Index=subtraction)  # -> ListA, ListB
dom = ConstructDomain(DomainStart=split_2.ListA, DomainEnd=split.ListB)

# ---- group: mit point of the domains
addition = Addition(A=split_2.ListA, B=split.ListB)
multiplication = Multiplication(A=addition, B=0.5)

# ----
I = ClusterOutput(dom)
R = ClusterOutput(multiplication)
