# Grasshopper definition KonradByron.gh (Grasshopper 1.0.7)

crv = Curve([<curve referenced from the Rhino model> x2])
loft = Loft(Curves=crv, Options={Adjust=False, Closed=False, LoftEnds=0, LoftSimp=0, LoftType=0, Rebuild=10, Refit=0.01})
sdivide = DivideSurface(Surface=loft, UCount=10, VCount=Slider(100, range=0..100))  # -> Points, Normals, Parameters
amp = Amplitude(Vector=sdivide.Normals, Amplitude=Slider(65, range=0..100))
crv_2 = Curve(<curve referenced from the Rhino model>)
intcrv = Interpolate(Vertices=sdivide.Points, Degree=3, Periodic=False, KnotStyle=1)  # -> Curve, Length, Domain
move = Move(Geometry=sdivide.Points, Motion=amp)  # -> Geometry, Transform
crv_cp = CurveClosestPoint(Point=sdivide.Points, Curve=crv_2)  # -> Point, Parameter, Distance
bnd = Bounds(Numbers=crv_cp.Distance)
remap = RemapNumbers(Value=crv_cp.Distance, Source=bnd, Target=Domain(0, 1))  # -> Mapped, Clipped
graph = GraphMapper(
    remap.Mapped,
    x0=0,
    x1=1,
    y0=0,
    y1=1,
    container_name="Sinc",
    Equation_X0=0.3207494617,
    Equation_X1=0.5127174258,
    Equation_Y0=0.8301205635,
    Equation_Y1=0.798707366)
scale = Scale(Geometry=move.Geometry, Center=sdivide.Points, Factor=graph)  # -> Geometry, Transform
intcrv_2 = Interpolate(Vertices=scale.Geometry, Degree=3, Periodic=False, KnotStyle=1)  # -> Curve, Length, Domain
Z = UnitZ(Factor=Slider(51, range=0..100))
rulesrf = RuledSurface(CurveA=intcrv.Curve, CurveB=intcrv_2.Curve)
extr = Extrude(Base=rulesrf, Direction=Z)
