# Grasshopper definition SinanYesildal.gh (Grasshopper 1.0.7)

number_slider = Slider(20, range=0..25)
series = Series(Start=Slider(0, range=0..10), Step=Slider(9.298, range=-10..10.001), Count=number_slider)
dom = ConstructDomain(DomainStart=Slider(8.731, range=0..100), DomainEnd=Slider(24.43, range=0..100))
random = Random(Range=dom, Number=number_slider, Seed=Slider(100, range=0..100))
pt = ConstructPoint(XCoordinate=series, YCoordinate=random, ZCoordinate=0)
nurbs = NurbsCurve(Vertices=pt, Degree=3, Periodic=False)  # -> Curve, Length, Domain
crv = Curve(nurbs.Curve)
series_2 = Series(Start=Slider(0, range=0..10), Step=Slider(9.164, range=-10..10.001), Count=Slider(22, range=0..25))
Z = UnitZ(Factor=Slider(100, range=0..100))
num = Number(series_2)
extr = Extrude(Base=crv, Direction=Z)
bnd = Bounds(Numbers=num)
dom_2 = ConstructDomain(DomainStart=Slider(19.665, range=0..100), DomainEnd=Slider(45.689, range=0..100))
srf = Surface(extr)
domain² = Domain²(srf)
dedom2 = DeconstructDomain²(Domain=domain²)  # -> UComponent, VComponent
random_2 = Random(Range=dom_2, Number=Slider(19, range=0..25), Seed=Slider(100, range=0..100))
remap = RemapNumbers(Value=num, Source=bnd, Target=dedom2.UComponent)  # -> Mapped, Clipped
ma = MassAddition(Input=random_2)  # -> Result, PartialResults
num_2 = Number(remap.Mapped)
num_3 = Number(ma.PartialResults)
numbers_to_domains = NumbersToDomains(num=num_2)  # -> I, R
bnd_2 = Bounds(Numbers=num_3)
num_4 = Number(numbers_to_domains.R)
domain = Domain(numbers_to_domains.I)
remap_2 = RemapNumbers(Value=num_3, Source=bnd_2, Target=dedom2.VComponent)  # -> Mapped, Clipped
num_5 = Number(remap_2.Mapped)
numbers_to_domains_2 = NumbersToDomains(num=num_5)  # -> I, R
domain_2 = Domain(numbers_to_domains_2.I)
num_6 = Number(numbers_to_domains_2.R)
pt_2 = Point(Point(2, 2, 2))
random_3 = Random(Range=Slider(21, range=0..100), Number=Slider(500, range=0..1000), Seed=Slider(705, range=0..10000))
dom² = ConstructDomain²(DomainU=graft(domain), DomainV=domain_2)
pdecon = Deconstruct(Point=pt_2)  # -> XComponent, YComponent, ZComponent
addition = Addition(A=pdecon.ZComponent, B=random_3)
pt_3 = ConstructPoint(XCoordinate=graft(num_4), YCoordinate=num_6, ZCoordinate=0)  # -> graft(Point)
pt_4 = ConstructPoint(XCoordinate=pdecon.XComponent, YCoordinate=pdecon.YComponent, ZCoordinate=addition)
domain²_2 = Domain²(dom²)
pt_5 = Point(Point(0, 0, 0))
pt_6 = Point(Point(0, 0, 0))
subsrf = Isotrim(Surface=srf, Domain=domain²_2)  # -> graft(Surface)
box = Box2Pt(PointA=pt_5, PointB=pt_4, Plane=PlaneXY(0, 0, 0))  # -> graft(Box)
box_2 = Box2Pt(PointA=pt_6, PointB=pt_2, Plane=PlaneXY(0, 0, 0))
srf_2 = Surface(subsrf)
evalsrf = EvaluateSurface(Surface=srf_2, Point=pt_3)  # -> Point, Normal, UDirection, VDirection, Frame
amp = Amplitude(Vector=evalsrf.Frame, Amplitude=Slider(6, range=0..10))
extr_2 = Extrude(Base=srf_2, Direction=amp)
pln = Plane(evalsrf.Frame)
bbox = BoundingBox(Content=extr_2, Plane=pln)  # -> Box, Box_2
box_3 = Box(bbox.Box)
morph = BoxMorph(Geometry=box_2, Reference=box, Target=box_3)
reduce = RandomReduce(List=flatten(morph), Reduction=Slider(28, range=0..100), Seed=Slider(18, range=0..100))
preview = CustomPreview(
    Geometry=reduce,
    Material={diffuse=RGB(221, 160, 221), emission=RGB(66, 48, 66), shine=0.5, specular=RGB(255, 255, 255), transparency=0})

# ==== cluster NumbersToDomains
num = ClusterInput()
num_2 = Number(num)
lng = ListLength(List=num_2)
subtraction = Subtraction(A=lng, B=1)
int = Integer(1)
split = SplitList(List=num_2, Index=int)  # -> ListA, ListB
split_2 = SplitList(List=num_2, Index=subtraction)  # -> ListA, ListB
dom = ConstructDomain(DomainStart=split_2.ListA, DomainEnd=split.ListB)

# ---- group: mit point of the domains
addition = Addition(A=split_2.ListA, B=split.ListB)
multiplication = Multiplication(A=addition, B=0.5)

# ----
I = ClusterOutput(dom)
R = ClusterOutput(multiplication)
