# Grasshopper definition kentner-jonas_abg-4.gh (Grasshopper 1.0.7)
# plug-ins: Pufferfish

number_slider = Slider(18, range=0..100)
dom = ConstructDomain(DomainStart=Slider(0, range=0..100), DomainEnd=Slider(17, range=0..100))
series = Series(Start=0, Step=Slider(4, range=0..100), Count=number_slider)
random = Random(Range=dom, Number=number_slider, Seed=Slider(59, range=0..100))
pt = ConstructPoint(XCoordinate=series, YCoordinate=random, ZCoordinate=0)
nurbs = NurbsCurve(Vertices=pt, Degree=3, Periodic=False)  # -> Curve, Length, Domain
Z = UnitZ(Factor=Slider(12, range=0..100))
extr = Extrude(Base=nurbs.Curve, Direction=Z)
srf = Surface(extr)

brec = BoundingRectangle(Plane=PlaneXY(0, 0, 0), Axis=0, Slide=0, Union=True)  # -> Bounding, DimensionX, DimensionY
dom_2 = ConstructDomain(DomainStart=Slider(0, range=0..100), DomainEnd=Slider(6, range=0..100))
random_2 = Random(Range=dom_2, Number=Slider(61, range=0..100), Seed=Slider(37, range=0..100))
ma = MassAddition(Input=random_2)  # -> Result, PartialResults
series_2 = Series(Start=0, Step=Slider(4, range=0..100), Count=Slider(4, range=0..100))
series_3 = Series(Start=0, Step=Slider(10, range=0..100), Count=Slider(53, range=0..100))
num = Number(series_2)
num_2 = Number(series_3)
bnd = Bounds(Numbers=num)
bnd_2 = Bounds(Numbers=num_2)
domain² = Domain²(srf)
dedom2 = DeconstructDomain²(Domain=domain²)  # -> UComponent, VComponent
remap = RemapNumbers(Value=num, Source=bnd, Target=dedom2.UComponent)  # -> Mapped, Clipped
remap_2 = RemapNumbers(Value=num_2, Source=bnd_2, Target=dedom2.VComponent)  # -> Mapped, Clipped
num_3 = Number(remap.Mapped)
num_4 = Number(remap_2.Mapped)
cluster = NumbersToDomains(num=num_4)  # -> I, R
numbers_to_domains = NumbersToDomains(num=num_3)  # -> I, R
domain = Domain(numbers_to_domains.I)
num_5 = Number(numbers_to_domains.R)
domain_2 = Domain(cluster.I)
num_6 = Number(cluster.R)
dom² = ConstructDomain²(DomainU=graft(domain), DomainV=domain_2)
domain²_2 = Domain²(dom²)
subsrf = Isotrim(Surface=srf, Domain=domain²_2)  # -> graft(Surface)
pt_2 = ConstructPoint(XCoordinate=graft(num_5), YCoordinate=num_6, ZCoordinate=0)  # -> graft(Point)
srf_2 = Surface(subsrf)
evalsrf = EvaluateSurface(Surface=srf_2, Point=pt_2)  # -> Point, Normal, UDirection, VDirection, Frame
pln = Plane(evalsrf.Frame)
bbox = BoundingBox(Content=subsrf, Plane=pln)  # -> Box, Box_2

box_corners = BoxCorners(Box=bbox.Box)  # -> CornerA, CornerB, CornerC, CornerD, CornerE, CornerF, CornerG, CornerH
pt_3 = Point(box_corners.CornerB)
pt_4 = Point(box_corners.CornerC)
vec = VectorXYZ(XComponent=pt_3, YComponent=pt_4, ZComponent=0)  # -> Vector, Length
Z_2 = UnitZ(Factor=vec.Vector)
arc = ArcSED(Start=pt_3, End=pt_4, Direction=Z_2)  # -> Arc, Plane, Radius
Z_3 = UnitZ(Factor=arc.Radius)
neg = Negative(Value=Z_3)
move = Move(Geometry=arc.Arc, Motion=neg)  # -> Geometry, Transform

vec_2 = Vector(evalsrf.Normal)
project = Project(Curve=move.Geometry, Brep=srf_2, Direction=vec_2)

# ==== cluster NumbersToDomains
num = ClusterInput()
num_2 = Number(num)
lng = ListLength(List=num_2)
subtraction = Subtraction(A=lng, B=1)
int = Integer(1)
split = SplitList(List=num_2, Index=int)  # -> ListA, ListB
split_2 = SplitList(List=num_2, Index=subtraction)  # -> ListA, ListB
dom = ConstructDomain(DomainStart=split_2.ListA, DomainEnd=split.ListB)

# ---- group: mit point of the domains
addition = Addition(A=split_2.ListA, B=split.ListB)
multiplication = Multiplication(A=addition, B=0.5)

# ----
I = ClusterOutput(dom)
R = ClusterOutput(multiplication)
