# Grasshopper definition 2021.03.22 - VorlesungDatei.gh (Grasshopper 1.0.7)

# ---- group: Creating a Polyline
pt = Point([Point(-511.9812881, 510.7092403, 0), Point(-459.3969108, 821.6429492, 0), Point(-157.6083109, 931.3842583, 0), Point(77.87824808, 865.0822174, 0), Point(208.1960526, 506.1366857, 0), Point(114.4586844, 179.1990358, 0), Point(-242.20057, -51.71496863, 0), Point(-516.5538426, 142.6185995, 0)])
pline = PolyLine(Vertices=pt, Closed=Toggle(False))

# ---- group: Create a Nurbs Curve
pt_2 = Point([Point(-511.9812881, 510.7092403, 0), Point(-459.3969108, 821.6429492, 0), Point(-157.6083109, 931.3842583, 0), Point(77.87824808, 865.0822174, 0), Point(208.1960526, 506.1366857, 0), Point(114.4586844, 179.1990358, 0), Point(-242.20057, -51.71496863, 0), Point(-516.5538426, 142.6185995, 0)])
nurbs = NurbsCurve(Vertices=pt_2, Degree=Slider(3, range=0..10), Periodic=Toggle(False))  # -> Curve, Length, Domain

# ---- group: Adding Curves, Dividing them, creating interconnections
number_slider = Slider(10, range=0..100)
crv = Curve(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)
crv_2 = Curve(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)
divide = DivideCurve(Curve=crv_2, Count=number_slider, Kinks=False)  # -> Points, Tangents, Parameters
divide_2 = DivideCurve(Curve=crv, Count=number_slider, Kinks=False)  # -> graft(Points), Tangents, Parameters
ln = Line(StartPoint=divide.Points, EndPoint=divide_2.Points)

# ---- group: Create a Interpolating Curve (goes through the input vertices)
pt_3 = Point([Point(-511.9812881, 510.7092403, 0), Point(-459.3969108, 821.6429492, 0), Point(-157.6083109, 931.3842583, 0), Point(77.87824808, 865.0822174, 0), Point(208.1960526, 506.1366857, 0), Point(114.4586844, 179.1990358, 0), Point(-242.20057, -51.71496863, 0), Point(-516.5538426, 142.6185995, 0)])
intcrv = Interpolate(Vertices=pt_3, Degree=Slider(3, range=0..10), Periodic=Toggle(False), KnotStyle=1)  # -> Curve, Length, Domain

# ---- group: Creating a rectangular grid of polylines (series & adding points)
series = Series(Start=Slider(0.25, range=0..1), Step=Slider(1, range=0..1), Count=Slider(100, range=0..100))
series_2 = Series(Start=Slider(0, range=0..1), Step=Slider(5, range=0..10), Count=Slider(5, range=0..100))
X = UnitX(Factor=series)
Y = UnitY(Factor=series_2)
pt_4 = Point(graft(X))
pt_5 = Point(graft(Y))
pt_6 = Point(X)
pt_7 = Point(Y)
addition = Addition(A=pt_4, B=pt_7)
addition_2 = Addition(A=pt_6, B=pt_5)
pline_2 = PolyLine(Vertices=addition_2, Closed=False)
pline_3 = PolyLine(Vertices=addition, Closed=False)

# ---- group: Rotating Points, Creating a spiral
number_slider_2 = Slider(10, range=0..10)
number_slider_3 = Slider(1000, range=0..1000)
series_3 = Series(Start=Slider(0, range=0..1), Step=Slider(0.404, range=0..1), Count=number_slider_3)
pt_8 = ConstructPoint(XCoordinate=number_slider_2, YCoordinate=number_slider_2, ZCoordinate=0)
series_4 = Series(Start=Slider(0, range=0..1), Step=Slider(0.055, range=0..1), Count=number_slider_3)
X_2 = UnitX(Factor=series_3)
xy = XYPlane(Origin=pt_8)
pt_9 = Point(X_2)
rotate = Rotate(Geometry=pt_9, Angle=series_4, Plane=xy)  # -> Geometry, Transform

# ---- group: Interconnecting two spirals
number_slider_4 = Slider(6.674, range=0..10)
number_slider_5 = Slider(-10, range=-10..10)
number_slider_6 = Slider(416, range=0..1000)
number_slider_7 = Slider(0.031, range=0..1)
series_5 = Series(Start=Slider(0, range=0..1), Step=Slider(0.167, range=0..1), Count=number_slider_6)
pt_10 = ConstructPoint(XCoordinate=number_slider_4, YCoordinate=number_slider_4, ZCoordinate=0)
series_6 = Series(Start=Slider(1, range=0..1), Step=number_slider_7, Count=number_slider_6)
series_7 = Series(Start=Slider(0.7, range=0..1), Step=number_slider_7, Count=number_slider_6)
pt_11 = ConstructPoint(XCoordinate=number_slider_5, YCoordinate=number_slider_5, ZCoordinate=0)
X_3 = UnitX(Factor=series_5)
addition_3 = Addition(A=X_3, B=pt_10)
xy_2 = XYPlane(Origin=pt_10)
xy_3 = XYPlane(Origin=pt_11)
pt_12 = Point(X_3)
rotate_2 = Rotate(Geometry=pt_12, Angle=series_6, Plane=xy_2)  # -> Geometry, Transform
rotate_3 = Rotate(Geometry=pt_12, Angle=series_7, Plane=xy_3)  # -> Geometry, Transform
ln_2 = Line(StartPoint=rotate_2.Geometry, EndPoint=rotate_3.Geometry)

# ---- group: Warping a spiral using it’s tangent and normal
number_slider_8 = Slider(10, range=0..10)
number_slider_9 = Slider(1000, range=0..1000)
series_8 = Series(Start=Slider(0, range=0..1), Step=Slider(0.245, range=0..1), Count=number_slider_9)
pt_13 = ConstructPoint(XCoordinate=number_slider_8, YCoordinate=number_slider_8, ZCoordinate=0)
series_9 = Series(Start=Slider(0, range=0..1), Step=Slider(0.055, range=0..1), Count=number_slider_9)
X_4 = UnitX(Factor=series_8)
xy_4 = XYPlane(Origin=pt_13)
pt_14 = Point(X_4)
rotate_4 = Rotate(Geometry=pt_14, Angle=series_9, Plane=xy_4)  # -> Geometry, Transform
number_slider_10 = Slider(10, range=0..10)
intcrv_2 = Interpolate(Vertices=rotate_4.Geometry, Degree=Slider(3, range=0..10), Periodic=False, KnotStyle=1)  # -> Curve, Length, Domain
relay = Relay()
divide_3 = DivideCurve(Curve=intcrv_2.Curve, Count=number_slider_9, Kinks=False)  # -> Points, Tangents, Parameters
multiplication = Multiplication(A=series_8, B=Slider(1.843, range=0..10))
sin = Sine(Value=multiplication)
pt_15 = Point(divide_3.Tangents)
rotate_5 = Rotate(Geometry=divide_3.Tangents, Angle=1.570796327, Plane=PlaneXY(0, 0, 0))  # -> Geometry, Transform
multiplication_2 = Multiplication(A=sin, B=Slider(11.295, range=0..100))
multiplication_3 = Multiplication(A=rotate_5.Geometry, B=multiplication_2)
addition_4 = Addition(A=divide_3.Points, B=multiplication_3)
pline_4 = PolyLine(Vertices=divide_3.Points, Closed=False)
pline_5 = PolyLine(Vertices=addition_4, Closed=False)
ln_3 = Line(StartPoint=divide_3.Points, EndPoint=addition_4)

# ---- group: Adding Points, connect them all together
pt_16 = Point([Point(-511.9812881, 510.7092403, 0), Point(-459.3969108, 821.6429492, 0), Point(-157.6083109, 931.3842583, 0), Point(77.87824808, 865.0822174, 0), Point(208.1960526, 506.1366857, 0), Point(114.4586844, 179.1990358, 0), Point(-242.20057, -51.71496863, 0), Point(-516.5538426, 142.6185995, 0)])
pt_17 = Point(graft(pt_16))
ln_4 = Line(StartPoint=pt_16, EndPoint=pt_17)

# ---- group: Distance warp but constrained using domains
pt_18 = Point(Point(89.82204791, 91.55570422, 0))
item = ListItem(List=pt_18, Index=Slider(11, range=0..20), Wrap=True)
series_10 = Series(Start=0, Step=Slider(1.5, range=0..10), Count=Slider(100, range=0..100))  # -> graft(Series)
series_11 = Series(Start=0, Step=Slider(1.5, range=0..10), Count=Slider(100, range=0..100))
pt_19 = ConstructPoint(XCoordinate=series_11, YCoordinate=series_10, ZCoordinate=0)
dist = Distance(PointA=item, PointB=pt_19)
division = Division(A=1, B=dist)
bnd = Bounds(Numbers=flatten(division))
dedomain = DeconstructDomain(Domain=bnd)  # -> Start, End
dom = ConstructDomain(DomainStart=dedomain.Start, DomainEnd=Slider(0.367, range=0..10))
remap = RemapNumbers(Value=division, Source=dom, Target=Domain(0, 1))  # -> Mapped, Clipped
panel = Panel(bnd)
multiplication_4 = Multiplication(A=remap.Clipped, B=Slider(14.862, range=0..100))
Y_2 = UnitY(Factor=multiplication_4)
addition_5 = Addition(A=pt_19, B=Y_2)
pline_6 = PolyLine(Vertices=addition_5, Closed=False)

# ---- group: Warping point grids by rotating them arounda given point
series_12 = Series(Start=0, Step=1, Count=Slider(100, range=0..100))
series_13 = Series(Start=0, Step=1, Count=Slider(100, range=0..100))
pt_20 = Point(Point(63.00631378, 52.73515232, 0))
sift = SiftPattern(List=series_13, SiftPattern=[0, 1])  # -> Output0, Output1
sift_2 = SiftPattern(List=series_12, SiftPattern=[0, 1])  # -> Output0, Output1
clean = CleanTree(RemoveNulls=True, RemoveInvalid=True, RemoveEmpty=False, Tree=sift.Output1)  # -> graft(Tree)
clean_2 = CleanTree(RemoveNulls=True, RemoveInvalid=True, RemoveEmpty=False, Tree=sift.Output0)  # -> graft(Tree)
clean_3 = CleanTree(RemoveNulls=True, RemoveInvalid=True, RemoveEmpty=False, Tree=sift_2.Output1)
clean_4 = CleanTree(RemoveNulls=True, RemoveInvalid=True, RemoveEmpty=False, Tree=sift_2.Output0)
pt_21 = ConstructPoint(XCoordinate=clean_3, YCoordinate=clean, ZCoordinate=0)
dist_2 = Distance(PointA=pt_21, PointB=pt_20)
pt_22 = ConstructPoint(XCoordinate=clean_4, YCoordinate=clean_2, ZCoordinate=0)
division_2 = Division(A=1, B=dist_2)
multiplication_5 = Multiplication(A=Slider(6.936, range=0..10), B=division_2)
addition_6 = Addition(A=multiplication_5, B=Slider(0.059, range=0..1))
ln_5 = Line(StartPoint=pt_22, EndPoint=pt_21)
panel_2 = Panel(division_2)
rotate_6 = Rotate(Geometry=pt_21, Angle=addition_6, Plane=pt_20)  # -> Geometry, Transform
ln_6 = Line(StartPoint=pt_22, EndPoint=rotate_6.Geometry)
rotate_7 = Rotate(Geometry=ln_5, Angle=addition_6, Plane=pt_20)  # -> Geometry, Transform
line = Line(rotate_7.Geometry)

# ---- group: Pyline grid from point grid, warped by distance to point
pt_23 = Point(Point(89.82204791, 91.55570422, 0))
item_2 = ListItem(List=pt_23, Index=Slider(11, range=0..20), Wrap=True)
series_14 = Series(Start=0, Step=Slider(1.5, range=0..10), Count=Slider(100, range=0..100))  # -> graft(Series)
series_15 = Series(Start=0, Step=Slider(1.5, range=0..10), Count=Slider(100, range=0..100))
pt_24 = ConstructPoint(XCoordinate=series_15, YCoordinate=series_14, ZCoordinate=0)
dist_3 = Distance(PointA=item_2, PointB=pt_24)
division_3 = Division(A=1, B=dist_3)
multiplication_6 = Multiplication(A=division_3, B=Slider(14.862, range=0..100))
Y_3 = UnitY(Factor=multiplication_6)
addition_7 = Addition(A=pt_24, B=Y_3)
pline_7 = PolyLine(Vertices=addition_7, Closed=False)

# ---- group: Warping Using Functions
number_slider_11 = Slider(0.071, range=0..1)
number_slider_12 = Slider(2.978, range=0..10)
number_slider_13 = Slider(25.834, range=0..100)
series_16 = Series(Start=0, Step=Slider(1.5, range=0..10), Count=Slider(100, range=0..100))
series_17 = Series(Start=0, Step=Slider(1.5, range=0..10), Count=Slider(100, range=0..100))  # -> graft(Series)
pt_25 = ConstructPoint(XCoordinate=series_16, YCoordinate=series_17, ZCoordinate=0)
pdecon = Deconstruct(Point=pt_25)  # -> XComponent, YComponent, ZComponent
expression = Expression(
    x=pdecon.XComponent,
    y=pdecon.YComponent,
    z=number_slider_12,
    x_s=number_slider_13,
    y_s=number_slider_13,
    Expression="sin(x/x_s)")
multiplication_7 = Multiplication(A=expression, B=Slider(50, range=0..100))
addition_8 = Addition(A=multiplication_7, B=0.001)
num = Number(addition_8)
expression_2 = Expression(x=pdecon.XComponent, y=pdecon.YComponent, z=number_slider_12, x_s=num, y_s=num, Expression="tan(y/y_s)")
panel_3 = Panel(addition_8)
multiplication_8 = Multiplication(A=expression_2, B=Slider(0.1, range=0..100))
Y_4 = UnitY(Factor=multiplication_8)
addition_9 = Addition(A=pt_25, B=Y_4)
pt_26 = Point(Y_4)
pline_8 = PolyLine(Vertices=addition_9, Closed=False)

# ---- group: Creating two grids of points out of one series using list sifting
series_18 = Series(Start=0, Step=1, Count=Slider(100, range=0..100))
series_19 = Series(Start=0, Step=1, Count=Slider(100, range=0..100))
sift_3 = SiftPattern(List=series_19, SiftPattern=[0, 1])  # -> Output0, Output1
sift_4 = SiftPattern(List=series_18, SiftPattern=[0, 1])  # -> Output0, Output1
clean_5 = CleanTree(RemoveNulls=True, RemoveInvalid=True, RemoveEmpty=False, Tree=sift_3.Output1)  # -> graft(Tree)
clean_6 = CleanTree(RemoveNulls=True, RemoveInvalid=True, RemoveEmpty=False, Tree=sift_3.Output0)  # -> graft(Tree)
clean_7 = CleanTree(RemoveNulls=True, RemoveInvalid=True, RemoveEmpty=False, Tree=sift_4.Output1)
clean_8 = CleanTree(RemoveNulls=True, RemoveInvalid=True, RemoveEmpty=False, Tree=sift_4.Output0)
pt_27 = ConstructPoint(XCoordinate=clean_7, YCoordinate=clean_5, ZCoordinate=0)
pt_28 = ConstructPoint(XCoordinate=clean_8, YCoordinate=clean_6, ZCoordinate=0)
ln_7 = Line(StartPoint=pt_28, EndPoint=pt_27)

# ---- group: Distance warp using curve
crv_3 = Curve(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)
series_20 = Series(Start=0, Step=Slider(1.5, range=0..10), Count=Slider(100, range=0..100))
series_21 = Series(Start=0, Step=Slider(1.5, range=0..10), Count=Slider(100, range=0..100))  # -> graft(Series)
pt_29 = ConstructPoint(XCoordinate=series_20, YCoordinate=series_21, ZCoordinate=0)
crv_cp = CurveClosestPoint(Point=pt_29, Curve=crv_3)  # -> Point, Parameter, Distance
division_4 = Division(A=1, B=crv_cp.Distance)
bnd_2 = Bounds(Numbers=flatten(division_4))
dedomain_2 = DeconstructDomain(Domain=bnd_2)  # -> Start, End
dom_2 = ConstructDomain(DomainStart=dedomain_2.Start, DomainEnd=Slider(0.367, range=0..10))
remap_2 = RemapNumbers(Value=division_4, Source=dom_2, Target=Domain(0, 1))  # -> Mapped, Clipped
panel_4 = Panel(bnd_2)
multiplication_9 = Multiplication(A=remap_2.Clipped, B=Slider(14.862, range=0..100))
Y_5 = UnitY(Factor=multiplication_9)
addition_10 = Addition(A=pt_29, B=Y_5)
pline_9 = PolyLine(Vertices=addition_10, Closed=False)

# ---- group: Warping in 3D using Gyroid Function
number_slider_14 = Slider(16.928, range=0..100)
series_22 = Series(Start=0, Step=Slider(1.5, range=0..10), Count=Slider(100, range=0..100))
series_23 = Series(Start=0, Step=Slider(1.5, range=0..10), Count=Slider(100, range=0..100))  # -> graft(Series)
pt_30 = ConstructPoint(XCoordinate=series_22, YCoordinate=series_23, ZCoordinate=0)
pdecon_2 = Deconstruct(Point=pt_30)  # -> XComponent, YComponent, ZComponent
expression_3 = Expression(
    x=pdecon_2.XComponent,
    y=pdecon_2.YComponent,
    z=Slider(2.978, range=0..10),
    x_s=number_slider_14,
    y_s=number_slider_14,
    Expression="sin(x/x_s)*cos(y/y_s)+sin(y/y_s)*cos(z)+sin(z)*cos(x/x_s)")
multiplication_10 = Multiplication(A=expression_3, B=Slider(44.488, range=0..100))
pt_31 = ConstructPoint(XCoordinate=0, YCoordinate=multiplication_10, ZCoordinate=multiplication_10)
addition_11 = Addition(A=pt_30, B=pt_31)
pline_10 = PolyLine(Vertices=addition_11, Closed=False)

# ---- group: Creating a Pointgrid
pt_32 = Point(Point(89.82204791, 91.55570422, 0))
item_3 = ListItem(List=pt_32, Index=Slider(11, range=0..20), Wrap=True)
series_24 = Series(Start=0, Step=Slider(1.5, range=0..10), Count=Slider(100, range=0..100))  # -> graft(Series)
series_25 = Series(Start=0, Step=Slider(1.5, range=0..10), Count=Slider(100, range=0..100))
pt_33 = ConstructPoint(XCoordinate=series_25, YCoordinate=series_24, ZCoordinate=0)

# ---- group: Warping Using Gyroid Function
number_slider_15 = Slider(16.928, range=0..100)
series_26 = Series(Start=0, Step=Slider(1.5, range=0..10), Count=Slider(100, range=0..100))
series_27 = Series(Start=0, Step=Slider(1.5, range=0..10), Count=Slider(100, range=0..100))  # -> graft(Series)
pt_34 = ConstructPoint(XCoordinate=series_26, YCoordinate=series_27, ZCoordinate=0)
pdecon_3 = Deconstruct(Point=pt_34)  # -> XComponent, YComponent, ZComponent
warping_using_gyroid_function = Expression(
    x=pdecon_3.XComponent,
    y=pdecon_3.YComponent,
    z=Slider(2.978, range=0..10),
    x_s=number_slider_15,
    y_s=number_slider_15,
    Expression="sin(x/x_s)*cos(y/y_s)+sin(y/y_s)*cos(z)+sin(z)*cos(x/x_s)")
multiplication_11 = Multiplication(A=warping_using_gyroid_function, B=Slider(44.488, range=0..100))
Y_6 = UnitY(Factor=multiplication_11)
addition_12 = Addition(A=pt_34, B=Y_6)
pt_35 = Point(Y_6)
pline_11 = PolyLine(Vertices=addition_12, Closed=False)

number_slider_16 = Slider(8.713, range=0..100)
series_28 = Series(Start=0, Step=Slider(1.5, range=0..10), Count=Slider(100, range=0..100))
series_29 = Series(Start=0, Step=Slider(1.5, range=0..10), Count=Slider(80, range=0..100))  # -> graft(Series)
pt_36 = ConstructPoint(XCoordinate=series_28, YCoordinate=series_29, ZCoordinate=0)
pdecon_4 = Deconstruct(Point=pt_36)  # -> XComponent, YComponent, ZComponent
warping_using_gyroid_function_2 = Expression(
    x=pdecon_4.XComponent,
    y=pdecon_4.YComponent,
    z=Slider(1.996, range=0..10),
    x_s=number_slider_16,
    y_s=number_slider_16,
    Expression="sin(x/x_s)*cos(y/y_s)+sin(y/y_s)*cos(z)+sin(z)*cos(x/x_s)+3")

# ----
bnd_3 = Bounds(Numbers=flatten(warping_using_gyroid_function_2))
remap_3 = RemapNumbers(Value=warping_using_gyroid_function_2, Source=bnd_3, Target=Domain(0, 1))  # -> Mapped, Clipped
graft = GraftTree(Tree=remap_3.Mapped, IncludeEmptyLists=True, IncludeNullItems=True)
path_mapper = PathMapper(graft, source="{A;B;C;D}", target="{D}")
num_2 = Number(path_mapper)
panel_5 = Panel(warping_using_gyroid_function_2)
ma = MassAddition(Input=num_2)  # -> Result, PartialResults
bnd_4 = Bounds(Numbers=ma.PartialResults)
domain = Domain(ma.Result)
remap_4 = RemapNumbers(Value=ma.PartialResults, Source=bnd_4, Target=Slider(50, range=0..100))  # -> graft(Mapped), Clipped
path_mapper_2 = PathMapper(remap_4.Mapped, source="{C;D}", target="{D}")
num_3 = Number(path_mapper_2)

# ---- group: Warping Using Gyroid Function (continued)
Y_7 = UnitY(Factor=num_3)
addition_13 = Addition(A=pt_36, B=Y_7)
pt_37 = Point(Y_7)
pline_12 = PolyLine(Vertices=addition_13, Closed=False)

# ----
panel_6 = Panel(path_mapper_2)
