# Grasshopper definition 2021.03.29 - curves.gh (Grasshopper 1.0.7)

number_slider = Slider(10, range=0..10)

# ---- group: constructing random curve
number_slider_2 = Slider(10, range=0..10)
random = Random(Range=number_slider_2, Number=number_slider_2, Seed=Slider(167, range=0..1000))
series = Series(Start=0, Step=Slider(6, range=0..10), Count=number_slider_2)
pt = ConstructPoint(XCoordinate=series, YCoordinate=random, ZCoordinate=0)
nurbs = NurbsCurve(Vertices=pt, Degree=3, Periodic=False)  # -> Curve, Length, Domain

# ---- group: constructing random points
number_slider_3 = Slider(6, range=0..10)
random_2 = Random(Range=number_slider_3, Number=number_slider_3, Seed=Slider(489, range=0..1000))
series_2 = Series(Start=0, Step=Slider(8, range=0..10), Count=number_slider_3)
pt_2 = ConstructPoint(XCoordinate=series_2, YCoordinate=random_2, ZCoordinate=0)

# ----
number_slider_4 = Slider(151, range=0..1000)
pi = Pi(Factor=1)
number_slider_5 = Slider(1, range=0..1)
pi_2 = Pi(Factor=1)

# ---- group: creating a building example using boolean operations / constructing random points
number_slider_6 = Slider(7, range=0..10)
random_3 = Random(Range=number_slider_6, Number=number_slider_6, Seed=Slider(14, range=0..1000))
series_3 = Series(Start=0, Step=Slider(10, range=0..10), Count=number_slider_6)
pt_3 = ConstructPoint(XCoordinate=series_3, YCoordinate=random_3, ZCoordinate=0)

# ----
division = Division(A=pi, B=Slider(180, range=0..1000))
division_2 = Division(A=Slider(180, range=0..1000), B=pi_2)

# ---- group: sample line
pt_4 = ConstructPoint(XCoordinate=0, YCoordinate=0, ZCoordinate=0)
X = UnitX(Factor=Slider(10, range=0..10))
ln = Line(StartPoint=pt_4, EndPoint=X)
eval = EvaluateCurve(Curve=ln, Parameter=Slider(1, range=-1..3))  # -> Point, Tangent, Angle

# ---- group: sampling curve and curve domain remap
random_4 = Random(Range=number_slider, Number=number_slider, Seed=Slider(693, range=0..1000))
series_4 = Series(Start=0, Step=Slider(4, range=0..10), Count=number_slider)
number_slider_7 = Slider(0.308, range=-1..3)
pt_5 = ConstructPoint(XCoordinate=series_4, YCoordinate=random_4, ZCoordinate=0)
domain = Domain(Slider(1, range=0..1))
nurbs_2 = NurbsCurve(Vertices=pt_5, Degree=3, Periodic=False)  # -> Curve, Length, Domain
crvdom = CurveDomain(Curve=nurbs_2.Curve, Domain=domain)  # -> Curve, Domain
eval_2 = EvaluateCurve(Curve=nurbs_2.Curve, Parameter=number_slider_7)  # -> Point, Tangent, Angle
eval_3 = EvaluateCurve(Curve=crvdom.Curve, Parameter=number_slider_7)  # -> Point, Tangent, Angle

# ---- group: sampling multiple curves to create spiral wave
series_5 = Series(Start=0, Step=1, Count=Slider(3922, range=0..10000))
expression = Expression(
    x=series_5,
    period=Slider(2.314, range=0..10),
    amplitude=Slider(0.493, range=0..10),
    phase=Slider(0, range=0..10),
    Expression="sin((x+phase)/period)*amplitude")
rad = Radians(Degrees=Slider(5, range=0..10))
X_2 = UnitX(Factor=Slider(60.562, range=0..100))
X_3 = UnitX(Factor=series_5)
addition = Addition(A=X_3, B=X_2)
pt_6 = Point(X_3)
multiplication = Multiplication(A=series_5, B=rad)
ln_2 = Line(StartPoint=pt_6, EndPoint=addition)
pt_7 = Point(Point(-5.641710558, 4.908876288, 0))
addition_2 = Addition(A=expression, B=0.5)
rotate = Rotate(Geometry=ln_2, Angle=multiplication, Plane=pt_7)  # -> Geometry, Transform
eval_4 = EvaluateCurve(Curve=rotate.Geometry, Parameter=addition_2)  # -> Point, Tangent, Angle
pline = PolyLine(Vertices=eval_4.Point, Closed=False)

# ---- group: degrees to radians
multiplication_2 = Multiplication(A=number_slider_4, B=division)
rad_2 = Radians(Degrees=number_slider_4)
panel = Panel(rad_2)
panel_2 = Panel(multiplication_2)

# ---- group: geometric representation of radians
arc = Arc(Plane=PlaneXY(0, 0, 0), Radius=Slider(1, range=0..10), Angle=multiplication_2)  # -> Arc, Length
len = Length(Curve=arc.Arc)
panel_3 = Panel(len)

# ---- group: radians to degrees
deg = Degrees(Radians=number_slider_5)
multiplication_3 = Multiplication(A=number_slider_5, B=division_2)
panel_4 = Panel(deg)
panel_5 = Panel(multiplication_3)

# ----
series_6 = Series(Start=0, Step=1, Count=Slider(20, range=0..10000))
domain_2 = Domain(Domain(0, 1))
nurbs_3 = NurbsCurve(Vertices=pt_2, Degree=3, Periodic=False)  # -> Curve, Length, Domain

# ---- group: vs remapping t-parameters to curve domain
bnd = Bounds(Numbers=series_6)
crvdom_2 = CurveDomain(Curve=nurbs.Curve)  # -> Curve, Domain
remap = RemapNumbers(Value=series_6, Source=bnd, Target=crvdom_2.Domain)  # -> Mapped, Clipped
eval_5 = EvaluateCurve(Curve=crvdom_2.Curve, Parameter=remap.Mapped)  # -> Point, Tangent, Angle

# ----
pline_2 = PolyLine(Vertices=pt_2, Closed=False)

# ---- group: changing curve domain
crvdom_3 = CurveDomain(Curve=nurbs.Curve, Domain=bnd)  # -> Curve, Domain
eval_6 = EvaluateCurve(Curve=crvdom_3.Curve, Parameter=series_6)  # -> Point, Tangent, Angle

# ---- group: opposite offset value
number_slider_8 = Slider(2, range=-10..10)
crv = Curve(pline_2)
neg = Negative(Value=number_slider_8)
offset = OffsetCurve(Curve=crv, Distance=number_slider_8, Plane=PlaneXY(0, 0, 0), Corners=1)
offset_2 = OffsetCurve(Curve=crv, Distance=neg, Plane=PlaneXY(0, 0, 0), Corners=1)

# ---- group: giving curve thickness
number_slider_9 = Slider(0.5, range=-10..10)
crv_2 = Curve(nurbs_3.Curve)
neg_2 = Negative(Value=number_slider_9)
offset_3 = OffsetCurve(Curve=crv_2, Distance=neg_2, Plane=PlaneXY(0, 0, 0), Corners=1)
offset_4 = OffsetCurve(Curve=crv_2, Distance=number_slider_9, Plane=PlaneXY(0, 0, 0), Corners=1)
end = EndPoints(Curve=offset_4)  # -> Start, End
end_2 = EndPoints(Curve=offset_3)  # -> Start, End
ln_3 = Line(StartPoint=end.Start, EndPoint=end_2.Start)
ln_4 = Line(StartPoint=end.End, EndPoint=end_2.End)
merge = Merge(Data1=offset_4, Data2=ln_3, Data3=ln_4, Data4=offset_3)
join = JoinCurves(Curves=merge, Preserve=False)

# ---- group: giving polyline thickness
number_slider_10 = Slider(0.5, range=-10..10)
crv_3 = Curve(pline_2)
neg_3 = Negative(Value=number_slider_10)
offset_5 = OffsetCurve(Curve=crv_3, Distance=neg_3, Plane=PlaneXY(0, 0, 0), Corners=1)
offset_6 = OffsetCurve(Curve=crv_3, Distance=number_slider_10, Plane=PlaneXY(0, 0, 0), Corners=1)
end_3 = EndPoints(Curve=offset_6)  # -> Start, End
end_4 = EndPoints(Curve=offset_5)  # -> Start, End
ln_5 = Line(StartPoint=end_3.Start, EndPoint=end_4.Start)
ln_6 = Line(StartPoint=end_3.End, EndPoint=end_4.End)
merge_2 = Merge(Data1=offset_6, Data2=ln_5, Data3=ln_6, Data4=offset_5)
join_2 = JoinCurves(Curves=merge_2, Preserve=False)

# ---- group: topology vs geometry (illustrating by flipping curve)
number_slider_11 = Slider(3.084, range=0..100)
number_slider_12 = Slider(2, range=-10..10)
flip = FlipCurve(Curve=pline_2)  # -> Curve, Flag
eval_7 = EvaluateCurve(Curve=flip.Curve, Parameter=number_slider_11)  # -> Point, Tangent, Angle
eval_8 = EvaluateCurve(Curve=pline_2, Parameter=number_slider_11)  # -> Point, Tangent, Angle
offset_7 = OffsetCurve(Curve=flip.Curve, Distance=number_slider_12, Plane=PlaneXY(0, 0, 0), Corners=1)
offset_8 = OffsetCurve(Curve=pline_2, Distance=number_slider_12, Plane=PlaneXY(0, 0, 0), Corners=1)

# ---- group: finding t parameter on curve for given point
pt_8 = ConstructPoint(XCoordinate=0, YCoordinate=0, ZCoordinate=0)
X_4 = UnitX(Factor=Slider(54, range=0..100))
crv_4 = Curve(crvdom_2.Curve)
ln_7 = Line(StartPoint=pt_8, EndPoint=X_4)
divide = DivideCurve(Curve=ln_7, Count=Slider(5, range=0..10), Kinks=False)  # -> Points, Tangents, Parameters
crv_cp = CurveClosestPoint(Point=divide.Points, Curve=crv_4)  # -> Point, Parameter, Distance

# ----
crv_5 = Curve(crvdom_2.Curve)
crv_6 = Curve(crvdom_2.Curve)
panel_6 = Panel(series_6)

# ---- group: turning components into cluster (double click to access)
cluster = Cluster(crv=nurbs_3.Curve, D=Slider(0.5, range=-10..10))

# ---- group: EqualDistance between points
divdist = DivideDistance(Curve=crv_6, Distance=Slider(7.5, range=0..10))  # -> Points, Tangents, Parameters
lng = ListLength(List=divdist.Points)
subtraction = Subtraction(A=lng, B=Slider(1, range=0..1))
split = SplitList(List=divdist.Points, Index=Slider(1, range=0..1))  # -> ListA, ListB
split_2 = SplitList(List=divdist.Points, Index=subtraction)  # -> ListA, ListB
ln_8 = Line(StartPoint=split.ListB, EndPoint=split_2.ListA)
len_2 = Length(Curve=ln_8)

# ---- group: Split Curve in given Lenth Segments
divlength = DivideLength(Curve=crv_6, Length=Slider(8, range=0..10))  # -> Points, Tangents, Parameters
shatter = Shatter(Curve=crv_6, Parameters=divlength.Parameters)
len_3 = Length(Curve=shatter)

# ---- group: shatter curve at t-values
shatter_2 = Shatter(Curve=crv_5, Parameters=remap.Mapped)
item = ListItem(List=shatter_2, Index=Slider(0, range=0..18), Wrap=True)

# ---- group: Split Curve in N equal length Segments
divide_2 = DivideCurve(Curve=crv_6, Count=Slider(6, range=0..100), Kinks=False)  # -> Points, Tangents, Parameters
shatter_3 = Shatter(Curve=crv_6, Parameters=divide_2.Parameters)
len_4 = Length(Curve=shatter_3)

# ----
panel_7 = Panel(remap.Mapped)

# ---- group: normal on curve in point
eval_9 = EvaluateCurve(Curve=crv_4, Parameter=crv_cp.Parameter)  # -> Point, Tangent, Angle
multiplication_4 = Multiplication(A=eval_9.Tangent, B=Slider(2.5, range=0..10))
rotate_2 = Rotate(Geometry=multiplication_4, Angle=1.570796327, Plane=PlaneXY(0, 0, 0))  # -> Geometry, Transform
addition_3 = Addition(A=eval_9.Point, B=rotate_2.Geometry)
ln_9 = Line(StartPoint=eval_9.Point, EndPoint=addition_3)

# ---- group: tangent in point on curve
eval_10 = EvaluateCurve(Curve=crv_4, Parameter=crv_cp.Parameter)  # -> Point, Tangent, Angle
multiplication_5 = Multiplication(A=eval_10.Tangent, B=Slider(2.5, range=0..10))
addition_4 = Addition(A=eval_10.Point, B=multiplication_5)
ln_10 = Line(StartPoint=eval_10.Point, EndPoint=addition_4)

# ----
crv_7 = Curve(cluster)
panel_8 = Panel(len_4)
panel_9 = Panel(len_3)
panel_10 = Panel(len_2)

# ---- group: creating a building example using boolean operations
nurbs_4 = NurbsCurve(Vertices=pt_3, Degree=3, Periodic=False)  # -> Curve, Length, Domain
crv_8 = Curve(nurbs_4.Curve)
divide_3 = DivideCurve(Curve=crv_8, Count=Slider(7, range=0..10), Kinks=False)  # -> Points, Tangents, Parameters
crv_9 = Curve(crv_8)
number_slider_13 = Slider(5, range=0..10)
number_slider_14 = Slider(20, range=0..100)
number_slider_15 = Slider(46, range=0..1000)

# ---- group: creating a building example using boolean operations / getting t-values in between
num = Number(divide_3.Parameters)
lng_2 = ListLength(List=num)
subtraction_2 = Subtraction(A=lng_2, B=Slider(1, range=0..1))
split_3 = SplitList(List=num, Index=Slider(1, range=0..1))  # -> ListA, ListB
split_4 = SplitList(List=num, Index=subtraction_2)  # -> ListA, ListB
addition_5 = Addition(A=split_3.ListB, B=split_4.ListA)
multiplication_6 = Multiplication(A=addition_5, B=0.5)

# ---- group: creating a building example using boolean operations / getting rid of first and last item in list
num_2 = Number(divide_3.Parameters)
split_5 = SplitList(List=num_2, Index=Slider(1, range=0..1))  # -> ListA, ListB
lng_3 = ListLength(List=split_5.ListB)
subtraction_3 = Subtraction(A=lng_3, B=Slider(1, range=0..1))
split_6 = SplitList(List=split_5.ListB, Index=subtraction_3)  # -> ListA, ListB

# ---- group: creating a building example using boolean operations / create wall
curvethickness = Cluster(crv=crv_8, D=Slider(0.5, range=-10..10))

# ---- group: creating a building example using boolean operations / constructing normal lines in point on curve
number_slider_16 = Slider(2.5, range=0..10)
eval_11 = EvaluateCurve(Curve=crv_8, Parameter=split_6.ListA)  # -> Point, Tangent, Angle
rotate_3 = Rotate(Geometry=eval_11.Tangent, Angle=1.570796327, Plane=PlaneXY(0, 0, 0))  # -> Geometry, Transform
neg_4 = Negative(Value=number_slider_16)
multiplication_7 = Multiplication(A=rotate_3.Geometry, B=number_slider_16)
multiplication_8 = Multiplication(A=rotate_3.Geometry, B=neg_4)
addition_6 = Addition(A=eval_11.Point, B=multiplication_8)
addition_7 = Addition(A=eval_11.Point, B=multiplication_7)
ln_11 = Line(StartPoint=addition_7, EndPoint=addition_6)

# ---- group: creating a building example using boolean operations / create windows_holes
curve_thickness = Cluster(crv=ln_11, D=Slider(2, range=-10..10))

# ---- group: creating a building example using boolean operations / wall with holes (region boolean difference)
rdiff = RegionDifference(CurvesA=curvethickness, CurvesB=flatten(curve_thickness))

# ---- group: creating a building example using boolean operations / window holes using boolean (region) interesection
rint = RegionIntersection(CurvesA=flatten(curve_thickness), CurvesB=curvethickness)

# ---- group: creating a building example using boolean operations (continued)
eval_12 = EvaluateCurve(Curve=crv_9, Parameter=multiplication_6)  # -> Point, Tangent, Angle

# ---- group: creating a building example using boolean operations / constructing secund curve
dom = ConstructDomain(DomainStart=number_slider_13, DomainEnd=number_slider_14)
lng_4 = ListLength(List=eval_12.Tangent)
random_5 = Random(Range=dom, Number=lng_4, Seed=number_slider_15)
merge_3 = Merge(Data1=split_3.ListA, Data2=split_4.ListB)
item_2 = ListItem(List=random_5, Index=0, Wrap=True)  # -> Item1, Item
eval_13 = EvaluateCurve(Curve=crv_9, Parameter=merge_3)  # -> Point, Tangent, Angle
merge_4 = Merge(Data1=item_2.Item, Data2=item_2.Item1)
rotate_4 = Rotate(Geometry=eval_13.Tangent, Angle=1.570796327, Plane=PlaneXY(0, 0, 0))  # -> Geometry, Transform
multiplication_9 = Multiplication(A=rotate_4.Geometry, B=merge_4)
addition_8 = Addition(A=eval_13.Point, B=multiplication_9)
item_3 = ListItem(List=addition_8, Index=0, Wrap=True)  # -> Item1, Item

# ---- group: creating a building example using boolean operations / constructing perpundicular walls
rotate_5 = Rotate(Geometry=eval_12.Tangent, Angle=1.570796327, Plane=PlaneXY(0, 0, 0))  # -> Geometry, Transform
multiplication_10 = Multiplication(A=rotate_5.Geometry, B=random_5)
addition_9 = Addition(A=eval_12.Point, B=multiplication_10)
ln_12 = Line(StartPoint=addition_9, EndPoint=eval_12.Point)
curvethickness_2 = Cluster(crv=ln_12, D=Slider(0.2, range=-10..10))

# ---- group: creating a building example using boolean operations / constructing secund curve (continued)
merge_5 = Merge(Data1=item_3.Item, Data2=addition_9, Data3=item_3.Item1)
intcrv = Interpolate(Vertices=merge_5, Degree=3, Periodic=False, KnotStyle=1)  # -> Curve, Length, Domain

# ---- group: creating a building example using boolean operations / create wall
curvethickness_3 = Cluster(crv=intcrv.Curve, D=Slider(0.5, range=-10..10))

# ---- group: creating a building example using boolean operations / constructing normal lines in point on curve
number_slider_17 = Slider(2.5, range=0..10)
neg_5 = Negative(Value=number_slider_17)

# ---- group: creating a building example using boolean operations (continued)
merge_6 = Merge(Data1=flatten(rdiff), Data2=flatten(curvethickness_2))
pt_9 = Point(merge_5)
crv_10 = Curve(intcrv.Curve)
crv_11 = Curve(crv_10)
runion = RegionUnion(Curves=merge_6)
crv_cp_2 = CurveClosestPoint(Point=pt_9, Curve=crv_10)  # -> Point, Parameter, Distance

# ---- group: creating a building example using boolean operations / getting rid of first and last value in list
num_3 = Number(crv_cp_2.Parameter)
split_7 = SplitList(List=num_3, Index=Slider(1, range=0..1))  # -> ListA, ListB
lng_5 = ListLength(List=split_7.ListB)
subtraction_4 = Subtraction(A=lng_5, B=Slider(1, range=0..1))
split_8 = SplitList(List=split_7.ListB, Index=subtraction_4)  # -> ListA, ListB

# ---- group: creating a building example using boolean operations / getting t-values in between
num_4 = Number(split_8.ListA)
lng_6 = ListLength(List=num_4)
subtraction_5 = Subtraction(A=lng_6, B=Slider(1, range=0..1))
split_9 = SplitList(List=num_4, Index=Slider(1, range=0..1))  # -> ListA, ListB
split_10 = SplitList(List=num_4, Index=subtraction_5)  # -> ListA, ListB
addition_10 = Addition(A=split_9.ListB, B=split_10.ListA)
multiplication_11 = Multiplication(A=addition_10, B=0.5)

# ---- group: creating a building example using boolean operations / constructing normal lines in point on curve (continued)
eval_14 = EvaluateCurve(Curve=crv_11, Parameter=multiplication_11)  # -> Point, Tangent, Angle
rotate_6 = Rotate(Geometry=eval_14.Tangent, Angle=1.570796327, Plane=PlaneXY(0, 0, 0))  # -> Geometry, Transform
multiplication_12 = Multiplication(A=rotate_6.Geometry, B=number_slider_17)
multiplication_13 = Multiplication(A=rotate_6.Geometry, B=neg_5)
addition_11 = Addition(A=eval_14.Point, B=multiplication_13)
addition_12 = Addition(A=eval_14.Point, B=multiplication_12)
ln_13 = Line(StartPoint=addition_12, EndPoint=addition_11)

# ---- group: creating a building example using boolean operations / create windows_holes
curvethickness_4 = Cluster(crv=ln_13, D=Slider(2, range=-10..10))

# ---- group: creating a building example using boolean operations (continued)
rdiff_2 = RegionDifference(CurvesA=curvethickness_3, CurvesB=flatten(curvethickness_4))
merge_7 = Merge(Data1=flatten(runion), Data2=flatten(rdiff_2))
runion_2 = RegionUnion(Curves=merge_7)

# ---- group: creating a building example using boolean operations / window holes using boolean (region) interesection
rint_2 = RegionIntersection(CurvesA=flatten(curvethickness_4), CurvesB=curvethickness_3)

# ==== cluster Cluster
crv = ClusterInput()
D = ClusterInput()

# ---- group: giving curve thickness
crv_2 = Curve(crv)
neg = Negative(Value=D)
offset = OffsetCurve(Curve=crv_2, Distance=neg, Plane=PlaneXY(0, 0, 0), Corners=1)
offset_2 = OffsetCurve(Curve=crv_2, Distance=D, Plane=PlaneXY(0, 0, 0), Corners=1)
end = EndPoints(Curve=offset_2)  # -> Start, End
end_2 = EndPoints(Curve=offset)  # -> Start, End
ln = Line(StartPoint=end.Start, EndPoint=end_2.Start)
ln_2 = Line(StartPoint=end.End, EndPoint=end_2.End)
merge = Merge(Data1=offset_2, Data2=ln, Data3=ln_2, Data4=offset)
join = JoinCurves(Curves=merge, Preserve=False)

# ----
C = ClusterOutput(join)
