# Grasshopper definition 2021.03.29 - iteration.gh (Grasshopper 1.0.7)

number_slider = Slider(3, range=0..10)

# ---- group: rectangular grid
number_slider_2 = Slider(5, range=0..10)
neg = Negative(Value=number_slider_2)
merge = Merge(Data1=number_slider_2, Data2=Slider(0, range=0..100), Data3=neg)
graft = GraftTree(Tree=merge, IncludeEmptyLists=True, IncludeNullItems=True)
pt = ConstructPoint(XCoordinate=merge, YCoordinate=graft, ZCoordinate=0)  # -> flatten(Point)

# ---- group: given points
pt_2 = Point([Point(-10.76925761, 10.13921555, 0), Point(11.35924479, 8.734231271, 0), Point(11.18362176, -11.28679471, 0), Point(-9.715519396, -9.530564359, 0)])
lng = ListLength(List=pt_2)

# ---- group: generating bunch of numbers between 0 & 3
random = Random(Range=number_slider, Number=Slider(1000, range=0..1000), Seed=Slider(286, range=0..1000))
round = Round(Number=random)  # -> Nearest, Floor, Ceiling

# ---- group: generating n directions to walk
pi = Pi(Factor=Slider(2, range=0..10))
X = UnitX(Factor=Slider(10, range=0..10))
division = Division(A=pi, B=number_slider)
series = Series(Start=0, Step=division, Count=number_slider)
rotate = Rotate(Geometry=X, Angle=series, Plane=PlaneXY(0, 0, 0))  # -> Geometry, Transform

# ---- group: generating bunch of numbers between 0 & 3
random_2 = Random(Range=lng, Number=Slider(1000, range=0..1000), Seed=Slider(286, range=0..1000))
round_2 = Round(Number=random_2)  # -> Nearest, Floor, Ceiling

# ---- group: given points
pt_3 = Point(pt)
lng_2 = ListLength(List=pt_3)

# ---- group: selecting the directions to walk for each step based on the random numbers generated
item = ListItem(List=pt_2, Index=round_2.Floor, Wrap=True)

# ---- group: generating bunch of numbers between 0 & 3
random_3 = Random(Range=lng_2, Number=Slider(1000, range=0..1000), Seed=Slider(286, range=0..1000))
round_3 = Round(Number=random_3)  # -> Nearest, Floor, Ceiling

# ---- group: need 3 values, got 4, unequally distributed
cset = CreateSet(List=round.Nearest)  # -> Set, Map
sort = SortList(Keys=cset.Set)  # -> graft(Keys), ValuesA
equals = Equality(FirstNumber=sort.Keys, SecondNumber=round.Nearest)  # -> Equality, Inequality
ma = MassAddition(Input=equals.Equality)  # -> Result, PartialResults
panel = Panel(sort.Keys)
panel_2 = Panel(ma.Result)

# ---- group: 3 values, equally distributed, starting at index 0 (what we need)
cset_2 = CreateSet(List=round.Floor)  # -> Set, Map
sort_2 = SortList(Keys=cset_2.Set)  # -> graft(Keys), ValuesA
equals_2 = Equality(FirstNumber=sort_2.Keys, SecondNumber=round.Floor)  # -> Equality, Inequality
ma_2 = MassAddition(Input=equals_2.Equality)  # -> Result, PartialResults
panel_3 = Panel(sort_2.Keys)
panel_4 = Panel(ma_2.Result)

# ---- group: need 3 values, that start at index 0
cset_3 = CreateSet(List=round.Ceiling)  # -> Set, Map
sort_3 = SortList(Keys=cset_3.Set)  # -> graft(Keys), ValuesA
equals_3 = Equality(FirstNumber=sort_3.Keys, SecondNumber=round.Ceiling)  # -> Equality, Inequality
ma_3 = MassAddition(Input=equals_3.Equality)  # -> Result, PartialResults
panel_5 = Panel(sort_3.Keys)
panel_6 = Panel(ma_3.Result)

# ---- group: “iterating” by using the partial sum of the mass addition
ma_4 = MassAddition(Input=item)  # -> Result, PartialResults

# ---- group: selecting the directions to walk for each step based on the random numbers generated
item_2 = ListItem(List=rotate.Geometry, Index=round.Floor, Wrap=True)

# ----
pline = PolyLine(Vertices=ma_4.PartialResults, Closed=False)

# ---- group: selecting the directions to walk for each step based on the random numbers generated
item_3 = ListItem(List=pt_3, Index=round_3.Floor, Wrap=True)

# ---- group: “iterating” by using the partial sum of the mass addition
ma_5 = MassAddition(Input=item_2)  # -> Result, PartialResults

ma_6 = MassAddition(Input=item_3)  # -> Result, PartialResults

# ----
pline_2 = PolyLine(Vertices=ma_5.PartialResults, Closed=False)
pline_3 = PolyLine(Vertices=ma_6.PartialResults, Closed=False)

# ---- group: Warping Using Gyroid Function
number_slider_3 = Slider(8.713, range=0..100)
series_2 = Series(Start=0, Step=Slider(1.5, range=0..10), Count=Slider(100, range=0..100))
series_3 = Series(Start=0, Step=Slider(1.5, range=0..10), Count=Slider(80, range=0..100))  # -> graft(Series)
pt_4 = ConstructPoint(XCoordinate=series_2, YCoordinate=series_3, ZCoordinate=0)
pdecon = Deconstruct(Point=pt_4)  # -> XComponent, YComponent, ZComponent
warping_using_gyroid_function = Expression(
    x=pdecon.XComponent,
    y=pdecon.YComponent,
    z=Slider(1.996, range=0..10),
    x_s=number_slider_3,
    y_s=number_slider_3,
    Expression="sin(x/x_s)*cos(y/y_s)+sin(y/y_s)*cos(z)+sin(z)*cos(x/x_s)+3")

# ---- group: iterating values with tree index remapping
bnd = Bounds(Numbers=flatten(warping_using_gyroid_function))
remap = RemapNumbers(Value=warping_using_gyroid_function, Source=bnd, Target=Domain(0, 1))  # -> Mapped, Clipped
graft_2 = GraftTree(Tree=remap.Mapped, IncludeEmptyLists=True, IncludeNullItems=True)
path_mapper = PathMapper(graft_2, source="{A;B;C;D}", target="{D}")
num = Number(path_mapper)
panel_7 = Panel(warping_using_gyroid_function)
ma_7 = MassAddition(Input=num)  # -> Result, PartialResults
bnd_2 = Bounds(Numbers=ma_7.PartialResults)
remap_2 = RemapNumbers(Value=ma_7.PartialResults, Source=bnd_2, Target=Slider(50, range=0..100))  # -> graft(Mapped), Clipped
path_mapper_2 = PathMapper(remap_2.Mapped, source="{C;D}", target="{D}")
num_2 = Number(path_mapper_2)

# ---- group: Warping Using Gyroid Function (continued)
Y = UnitY(Factor=num_2)
addition = Addition(A=pt_4, B=Y)
pt_5 = Point(Y)
pline_4 = PolyLine(Vertices=addition, Closed=False)
