# Grasshopper definition 2021.03.29 - random rectangles and houses.gh (Grasshopper 1.0.7)

# ---- group: side by side rectangles
multiplication = Multiplication(A=Slider(20, range=0..100), B=2)
random = Random(Range=Domain(0, 1), Number=multiplication, Seed=Slider(388, range=0..1000))
sort = SortList(Keys=random)  # -> Keys, ValuesA
merge = Merge(Data1="0", Data2=flatten(sort.Keys), Data3="1")
lng = ListLength(List=merge)
split = SplitList(List=merge, Index="1")  # -> ListA, ListB
subtraction = Subtraction(A=lng, B="1")
split_2 = SplitList(List=merge, Index=subtraction)  # -> ListA, ListB
dom = ConstructDomain(DomainStart=split.ListB, DomainEnd=split_2.ListA)

# ---- group: random rec
number_slider = Slider(100, range=0..100)
number_slider_2 = Slider(100, range=0..100)
random_2 = Random(Range=number_slider, Number=number_slider_2, Seed=Slider(2, range=0..10))
random_3 = Random(Range=number_slider, Number=number_slider_2, Seed=Slider(3, range=0..10))
rectangle = Rectangle(Plane=PlaneXY(0, 0, 0), XSize=random_2, YSize=random_3, Radius=0)  # -> Rectangle, Length

# ---- group: non-overlapping random recs
multiplication_2 = Multiplication(A=Slider(20, range=0..100), B=2)
random_4 = Random(Range=Domain(0, 1), Number=multiplication_2, Seed=Slider(388, range=0..1000))
sort_2 = SortList(Keys=random_4)  # -> Keys, ValuesA
sift = SiftPattern(List=sort_2.Keys, SiftPattern=[0, 1])  # -> Output0, Output1
clean = CleanTree(RemoveNulls=True, RemoveInvalid=True, RemoveEmpty=False, Tree=sift.Output0)
clean_2 = CleanTree(RemoveNulls=True, RemoveInvalid=True, RemoveEmpty=False, Tree=sift.Output1)
dom_2 = ConstructDomain(DomainStart=clean, DomainEnd=clean_2)

# ---- group: open plan defined by two curves
crv = Curve([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])
crvdom = CurveDomain(Curve=crv, Domain=Slider(1, range=0..1))  # -> Curve, Domain
item = ListItem(List=crvdom.Curve, Index=0, Wrap=True)  # -> Item, Item1
random_5 = Random(Range=Domain(0, 1), Number=Slider(6, range=0..10), Seed=Slider(8, range=0..10))
crv_2 = Curve(item.Item)
crv_3 = Curve(item.Item1)
sort_3 = SortList(Keys=random_5)  # -> Keys, ValuesA
end = EndPoints(Curve=crv_2)  # -> Start, End
end_2 = EndPoints(Curve=crv_3)  # -> Start, End
eval = EvaluateCurve(Curve=crv_2, Parameter=sort_3.Keys)  # -> Point, Tangent, Angle
eval_2 = EvaluateCurve(Curve=crv_3, Parameter=sort_3.Keys)  # -> Point, Tangent, Angle
merge_2 = Merge(Data1=end.Start, Data2=flatten(eval.Point), Data3=end.End)  # -> graft(Result)
merge_3 = Merge(Data1=end_2.Start, Data2=flatten(eval_2.Point), Data3=end_2.End)  # -> graft(Result)
random_6 = Random(Range=Domain(0, 1), Number=Slider(4, range=0..10), Seed=Slider(3, range=0..10))
sort_4 = SortList(Keys=random_6)  # -> Keys, ValuesA
ln = Line(StartPoint=merge_2, EndPoint=merge_3)
merge_4 = Merge(Data1=0, Data2=flatten(sort_4.Keys), Data3=1)
line = Line(flatten(ln))
lng_2 = ListLength(List=line)
num = Number(merge_4)
lng_3 = ListLength(List=num)
subtraction_2 = Subtraction(A=lng_3, B=1)
subtraction_3 = Subtraction(A=lng_2, B=1)
split_3 = SplitList(List=num, Index=1)  # -> ListA, graft(ListB)
split_4 = SplitList(List=num, Index=subtraction_2)  # -> graft(ListA), ListB
split_5 = SplitList(List=line, Index=1)  # -> ListA, ListB
split_6 = SplitList(List=line, Index=subtraction_3)  # -> ListA, ListB
eval_3 = EvaluateCurve(Curve=split_5.ListB, Parameter=split_3.ListB)  # -> graft(Point), Tangent, Angle
eval_4 = EvaluateCurve(Curve=split_6.ListA, Parameter=split_3.ListB)  # -> graft(Point), Tangent, Angle
eval_5 = EvaluateCurve(Curve=split_5.ListB, Parameter=split_4.ListA)  # -> graft(Point), Tangent, Angle
eval_6 = EvaluateCurve(Curve=split_6.ListA, Parameter=split_4.ListA)  # -> graft(Point), Tangent, Angle
merge_5 = Merge(Data1=eval_3.Point, Data2=eval_5.Point, Data3=eval_6.Point, Data4=eval_4.Point)
rev = ReverseList(List=merge_5)
pline = PolyLine(Vertices=rev, Closed=True)
number_slider_3 = Slider(0.138, range=0..1)
runion = RegionUnion(Curves=flatten(pline))
neg = Negative(Value=number_slider_3)
offset = OffsetCurve(Curve=pline, Distance=number_slider_3, Plane=PlaneXY(0, 0, 0), Corners=1)
offset_2 = OffsetCurve(Curve=runion, Distance=neg, Plane=PlaneXY(0, 0, 0), Corners=1)
explode = Explode(Curve=pline, Recursive=True)  # -> graft(Segments), Vertices
merge_6 = Merge(Data1=Slider(0.3, range=0..1), Data2=Slider(0.7, range=0..1))
crvdom_2 = CurveDomain(Curve=explode.Segments, Domain=Slider(1, range=0..1))  # -> Curve, Domain
shatter = Shatter(Curve=crvdom_2.Curve, Parameters=merge_6)
panel = Panel(crvdom_2.Domain)
item_2 = ListItem(List=shatter, Index=1, Wrap=True)
cluster = Cluster_2(num=Slider(0.33, range=0..1), crv=item_2)
merge_7 = Merge(Data1=cluster, Data2=offset)  # -> flatten(Result)
runion_2 = RegionUnion(Curves=merge_7)
rint = RegionIntersection(CurvesA=runion_2, CurvesB=offset_2)
crv_4 = Curve(offset_2)

# ---- group: building by random lines
number_slider_4 = Slider(18, range=0..100)
number_slider_5 = Slider(33, range=0..100)
number_slider_6 = Slider(10, range=0..10)
dom_3 = ConstructDomain(DomainStart=Slider(2, range=0..10), DomainEnd=Slider(32, range=0..100))
dom_4 = ConstructDomain(DomainStart=Slider(0, range=0..10), DomainEnd=Slider(14, range=0..100))
number_slider_7 = Slider(63, range=0..100)
dom_5 = ConstructDomain(DomainStart=Slider(6, range=0..10), DomainEnd=Slider(19, range=0..100))
dom_6 = ConstructDomain(DomainStart=Slider(0, range=0..10), DomainEnd=Slider(23, range=0..100))
series = Series(Start=5, Step=1, Count=10)  # -> graft(Series)
series_2 = Series(Start=0, Step=1, Count=10)  # -> graft(Series)
series_3 = Series(Start=5, Step=1, Count=Slider(20, range=0..100))  # -> graft(Series)
random_7 = Random(Range=dom_3, Number=number_slider_4, Seed=2)
random_8 = Random(Range=dom_4, Number=number_slider_4, Seed=Slider(8, range=0..100))
series_4 = Series(Start=0, Step=1, Count=10)  # -> graft(Series)
random_9 = Random(Range=dom_5, Number=number_slider_5, Seed=2)
random_10 = Random(Range=dom_6, Number=number_slider_5, Seed=Slider(8, range=0..100))
round = Round(Number=random_7)  # -> graft(Nearest), Floor, Ceiling
sort_5 = SortList(Keys=random_8)  # -> graft(Keys), ValuesA
round_2 = Round(Number=random_9)  # -> graft(Nearest), Floor, Ceiling
sort_6 = SortList(Keys=random_10)  # -> graft(Keys), ValuesA
cluster_2 = Cluster(R=Slider(0.851, range=0..1), num=Slider(25, range=0..100), num_2=round.Nearest, int=Slider(15, range=0..100))  # -> R_2, R_3
cluster_3 = Cluster(R=Slider(0.886, range=0..1), num=Slider(14, range=0..100), num_2=round_2.Nearest, int=Slider(5, range=0..10))  # -> R_2, R_3
pt = ConstructPoint(XCoordinate=cluster_2.R_3, YCoordinate=sort_5.Keys, ZCoordinate=0)
pt_2 = ConstructPoint(XCoordinate=cluster_2.R_2, YCoordinate=sort_5.Keys, ZCoordinate=0)
pt_3 = ConstructPoint(XCoordinate=sort_6.Keys, YCoordinate=cluster_3.R_3, ZCoordinate=0)
pt_4 = ConstructPoint(XCoordinate=sort_6.Keys, YCoordinate=cluster_3.R_2, ZCoordinate=0)
number_slider_8 = Slider(0.04, range=0..1)
ln_2 = Line(StartPoint=pt_2, EndPoint=pt)
ln_3 = Line(StartPoint=pt_4, EndPoint=pt_3)
cluster_4 = Cluster_2(num=number_slider_8, crv=ln_3)
cluster_5 = Cluster_2(num=number_slider_8, crv=ln_2)
merge_8 = Merge(Data1=cluster_5, Data2=cluster_4)  # -> flatten(Result)
number_slider_9 = Slider(0.12, range=0..1)
runion_3 = RegionUnion(Curves=merge_8)
crv_5 = Curve(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)
neg_2 = Negative(Value=number_slider_9)
cluster_6 = Cluster_2(num=number_slider_8, crv=crv_5)
offset_3 = OffsetCurve(Curve=crv_5, Distance=neg_2, Plane=PlaneXY(0, 0, 0), Corners=1)
offset_4 = OffsetCurve(Curve=crv_5, Distance=number_slider_9, Plane=PlaneXY(0, 0, 0), Corners=1)
crv_6 = Curve(cluster_6)
merge_9 = Merge(Data1=offset_4, Data2=offset_3)
rdiff = RegionDifference(CurvesA=runion_3, CurvesB=offset_4)
rint_2 = RegionIntersection(CurvesA=runion_3, CurvesB=offset_3)
merge_10 = Merge(Data1=rdiff, Data2=rint_2)

# ----
rec_domain_sidebyside = RecDomainSidebySide_2(A=Slider(5, range=0..100), S=Slider(252, range=0..1000))
rec_domain_sidebyside_2 = RecDomainSidebySide(A=Slider(6, range=0..100), S=Slider(256, range=0..1000))
rectangle_2 = Rectangle(Plane=PlaneXY(0, 0, 0), XSize=graft(rec_domain_sidebyside_2), YSize=rec_domain_sidebyside, Radius=0)  # -> Rectangle, Length
neg_3 = Negative(Value=Slider(0.0049, range=0..0.01))

# ---- group: non grafted (line)
rectangle_3 = Rectangle(Plane=PlaneXY(0, 0, 0), XSize=dom_2, YSize=dom_2, Radius=0)  # -> Rectangle, Length

# ---- group: grafted (grid)
rectangle_4 = Rectangle(Plane=PlaneXY(0, 0, 0), XSize=graft(dom_2), YSize=dom_2, Radius=0)  # -> Rectangle, Length

# ----
offset_5 = OffsetCurve(Curve=rectangle_2.Rectangle, Distance=neg_3, Plane=PlaneXY(0, 0, 0), Corners=1)

# ---- group: grafted (grid)
rectangle_5 = Rectangle(Plane=PlaneXY(0, 0, 0), XSize=graft(dom), YSize=dom, Radius=0)  # -> Rectangle, Length

# ---- group: non grafted (line)
rectangle_6 = Rectangle(Plane=PlaneXY(0, 0, 0), XSize=dom, YSize=dom, Radius=0)  # -> Rectangle, Length

# ==== cluster Cluster
num = ClusterInput()
num_2 = ClusterInput()
int = ClusterInput()
R = ClusterInput()
num_3 = Number(num)
num_4 = Number(num_2)
int_2 = Integer(int)
subtraction = Subtraction(A=1, B=R)
addition = Addition(A=num_4, B=1)
addition_2 = Addition(A=int_2, B=1)
subtraction_2 = Subtraction(A=int_2, B=1)
division = Division(A=R, B=subtraction_2)
random = Random(Range=subtraction, Number=subtraction_2, Seed=addition)
random_2 = Random(Range=R, Number=addition_2, Seed=num_4)
sort = SortList(Keys=random)  # -> Keys, ValuesA
ma = MassAddition(Input=random)  # -> Result, PartialResults
sort_2 = SortList(Keys=random_2)  # -> Keys, ValuesA
multiplication = Multiplication(A=0, B=ma.Result)
merge = Merge(Data1=multiplication, Data2=sort.Keys)
split = SplitList(List=sort_2.Keys, Index=1)  # -> ListA, ListB
split_2 = SplitList(List=sort_2.Keys, Index=int_2)  # -> ListA, ListB
num_5 = Number(1)
addition_3 = Addition(A=split.ListB, B=merge)
addition_4 = Addition(A=split_2.ListA, B=merge)
remap = RemapNumbers(Value=addition_3, Source=num_5, Target=num_3)  # -> Mapped, Clipped
remap_2 = RemapNumbers(Value=addition_4, Source=num_5, Target=num_3)  # -> Mapped, Clipped
R_2 = ClusterOutput(remap.Mapped)
R_3 = ClusterOutput(remap_2.Mapped)

# ==== cluster Cluster_2
num = ClusterInput()
crv = ClusterInput()
num_2 = Number(num)
crv_2 = Curve(crv)
neg = Negative(Value=num_2)
offset = OffsetCurve(Curve=crv_2, Distance=num_2, Plane=PlaneXY(0, 0, 0), Corners=1)
offset_2 = OffsetCurve(Curve=crv_2, Distance=neg, Plane=PlaneXY(0, 0, 0), Corners=1)
end = EndPoints(Curve=offset_2)  # -> Start, End
end_2 = EndPoints(Curve=offset)  # -> Start, End
ln = Line(StartPoint=end_2.Start, EndPoint=end.Start)
ln_2 = Line(StartPoint=end_2.End, EndPoint=end.End)
merge = Merge(Data1=ln, Data2=ln_2, Data3=offset, Data4=offset_2)
join = JoinCurves(Curves=merge, Preserve=False)
C = ClusterOutput(join)

# ==== cluster RecDomainSidebySide
S = ClusterInput()
A = ClusterInput()
multiplication = Multiplication(A=A, B=2)
random = Random(Range=Domain(0, 1), Number=multiplication, Seed=S)
sort = SortList(Keys=random)  # -> Keys, ValuesA
merge = Merge(Data1="0", Data2=flatten(sort.Keys), Data3="1")
lng = ListLength(List=merge)
split = SplitList(List=merge, Index="1")  # -> ListA, ListB
subtraction = Subtraction(A=lng, B="1")
split_2 = SplitList(List=merge, Index=subtraction)  # -> ListA, ListB
dom = ConstructDomain(DomainStart=split.ListB, DomainEnd=split_2.ListA)
I = ClusterOutput(dom)

# ==== cluster RecDomainSidebySide_2
A = ClusterInput()
S = ClusterInput()
multiplication = Multiplication(A=A, B=2)
random = Random(Range=Domain(0, 1), Number=multiplication, Seed=S)
sort = SortList(Keys=random)  # -> Keys, ValuesA
merge = Merge(Data1="0", Data2=flatten(sort.Keys), Data3="1")
lng = ListLength(List=merge)
split = SplitList(List=merge, Index="1")  # -> ListA, ListB
subtraction = Subtraction(A=lng, B="1")
split_2 = SplitList(List=merge, Index=subtraction)  # -> ListA, ListB
dom = ConstructDomain(DomainStart=split.ListB, DomainEnd=split_2.ListA)
I = ClusterOutput(dom)
