# Grasshopper definition 2021.03.29 - sin_functions.gh (Grasshopper 1.0.7)

# ---- group: cycloid
number_slider = Slider(2, range=0..100)
pi = Pi(Factor=Slider(1.013, range=0..10))
series = Series(Start=0, Step=Slider(0.163, range=0..1), Count=Slider(537, range=0..10000))
expression = Expression(t=series, period=number_slider, amplitude=pi, Expression="(t/period-sin(t/period))*amplitude")
expression_2 = Expression(t=series, period=number_slider, amplitude=pi, Expression="(1-cos(t/period))*amplitude")
pt = ConstructPoint(XCoordinate=expression, YCoordinate=expression_2, ZCoordinate=0)
pline = PolyLine(Vertices=pt, Closed=False)

# ---- group: spirograph
number_slider_2 = Slider(20.8, range=0..100)
number_slider_3 = Slider(3.6, range=0..100)
number_slider_4 = Slider(2, range=0..100)
series_2 = Series(Start=0, Step=Slider(0.029, range=0..1), Count=Slider(449, range=0..10000))
expression_3 = Expression(
    t=series_2,
    r_a=number_slider_2,
    r_b=number_slider_3,
    r_c=number_slider_4,
    Expression="(r_a-r_b)*cos(t)+r_c*cos((r_a-r_b)*t/r_b)")
expression_4 = Expression(
    t=series_2,
    r_a=number_slider_2,
    r_b=number_slider_3,
    r_c=number_slider_4,
    Expression="(r_a-r_b)*sin(t)-r_c*sin((r_a-r_b)*t/r_b)")
pt_2 = ConstructPoint(XCoordinate=expression_3, YCoordinate=expression_4, ZCoordinate=0)
pline_2 = PolyLine(Vertices=pt_2, Closed=False)

# ---- group: superformula
number_slider_5 = Slider(1, range=0..1)
number_slider_6 = Slider(1000, range=0..1000)
pi_2 = Pi(Factor=Slider(2, range=0..10))
division = Division(A=pi_2, B=number_slider_6)
series_3 = Series(Start=0, Step=division, Count=number_slider_6)
expression_5 = Expression(
    t=series_3,
    a=number_slider_5,
    b=number_slider_5,
    n1=Slider(0.377, range=0..10),
    n2=Slider(0.5, range=0..10),
    n3=Slider(1.5, range=0..10),
    m=Slider(3, range=0..10),
    Expression="1/(abs(cos(t*m/4)/a)^n2+abs(sin(t*m/4)/b)^n3)^(1/n1)")
cos = Cosine(Value=series_3)
sin = Sine(Value=series_3)
multiplication = Multiplication(A=expression_5, B=Slider(10, range=0..10))
multiplication_2 = Multiplication(A=sin, B=multiplication)
multiplication_3 = Multiplication(A=cos, B=multiplication)
pt_3 = ConstructPoint(XCoordinate=multiplication_2, YCoordinate=multiplication_3, ZCoordinate=0)
pline_3 = PolyLine(Vertices=pt_3, Closed=True)

# ---- group: Lissajous
number_slider_7 = Slider(10, range=0..10)
series_4 = Series(Start=0, Step=Slider(0.01, range=0..1), Count=Slider(1191, range=0..10000))
pi_3 = Pi(Factor=Slider(1.013, range=0..10))
expression_6 = Expression(t=series_4, a=Slider(2, range=0..100), phase=pi_3, amplitude=number_slider_7, Expression="sin(a*t+phase)*amplitude")
expression_7 = Expression(t=series_4, b=Slider(3, range=0..100), amplitude=number_slider_7, Expression="sin(b*t)*amplitude")
pt_4 = ConstructPoint(XCoordinate=expression_6, YCoordinate=expression_7, ZCoordinate=0)
pline_4 = PolyLine(Vertices=pt_4, Closed=False)

# ---- group: spirograph / visualization
item = ListItem(List=series_2, Index=0, Wrap=True)  # -> Item1, Item
expression_8 = Expression(t=item.Item1, r_a=number_slider_2, r_b=number_slider_3, Expression="(r_a-r_b)*sin(t)")
expression_9 = Expression(t=item.Item1, r_a=number_slider_2, r_b=number_slider_3, Expression="(r_a-r_b)*cos(t)")
pt_5 = ConstructPoint(XCoordinate=expression_9, YCoordinate=expression_8, ZCoordinate=0)
item_2 = ListItem(List=pt_2, Index=0, Wrap=True)  # -> Item1, Item
ln = Line(StartPoint=item_2.Item1, EndPoint=pt_5)
division_2 = Division(A=number_slider_3, B=10)

# ---- group: spirograph / visualization / outer circle
cir = Circle(Plane=PlaneXY(0, 0, 0), Radius=number_slider_2)

# ---- group: spirograph / visualization / inner circle
cir_2 = Circle(Plane=pt_5, Radius=number_slider_3)

# ---- group: spirograph / visualization / pen-point
cir_3 = Circle(Plane=item_2.Item1, Radius=division_2)
