# Grasshopper definition 2d_images.gh (Grasshopper 1.0.7)

number_slider = Slider(50, range=0..100)
number_slider_2 = Slider(100, range=0..100)
number_slider_3 = Slider(5, range=0..10)
number_slider_4 = Slider(0.8, range=0..1)
num = Number("1688")
num_2 = Number("1440")
addition = Addition(A=number_slider_2, B=1)
subtraction = Subtraction(A=1, B=number_slider_4)
division = Division(A=num, B=number_slider)
multiplication = Multiplication(A=division, B=number_slider_4)
division_2 = Division(A=num_2, B=addition)
division_3 = Division(A=division, B=2)
multiplication_2 = Multiplication(A=multiplication, B=0.5)
series = Series(Start=division_3, Step=division, Count=number_slider)
series_2 = Series(Start=0, Step=division_2, Count=number_slider_2)
pt = ConstructPoint(XCoordinate=series_2, YCoordinate=graft(series), ZCoordinate=0)
image = ImageSampler(
    pt,
    FilePath="/Users/jonas/Documents/reps/the_nature_of_the_artificial/dimension_1/Girl with a Pearl Earring.png",
    Filter="Colour",
    Interpolate=False,
    Umax=1440,
    Umin=1,
    Vmax=1688,
    Vmin=1,
    Wrap=1)
dom = ConstructDomain(DomainStart=subtraction, DomainEnd=1)
argb = SplitARGB(Colour=image, IntegerChannels=True)  # -> Alpha, Red, Green, Blue
panel = Panel(pt)
remap = RemapNumbers(Value=argb.Red, Source=Domain(0, 255), Target=dom)  # -> Mapped, Clipped
multiplication_3 = Multiplication(A=multiplication_2, B=remap.Mapped)
panel_2 = Panel(argb.Alpha)
neg = Negative(Value=multiplication_3)
pdecon = Deconstruct(Point=pt)  # -> XComponent, YComponent, ZComponent
Y = UnitY(Factor=multiplication_3)
Y_2 = UnitY(Factor=neg)
addition_2 = Addition(A=pt, B=Y)
expression = Expression(x=pdecon.XComponent, y=Slider(48, range=0..100), Expression="sin(x/y)")
panel_3 = Panel(expression)
addition_3 = Addition(A=pt, B=Y_2)
multiplication_4 = Multiplication(A=Slider(20, range=0..100), B=expression)
Y_3 = UnitY(Factor=multiplication_4)
addition_4 = Addition(A=Y_3, B=addition_3)
addition_5 = Addition(A=Y_3, B=addition_2)
pline = PolyLine(Vertices=addition_5, Closed=False)
pline_2 = PolyLine(Vertices=addition_4, Closed=False)
end = EndPoints(Curve=pline)  # -> Start, End
end_2 = EndPoints(Curve=pline_2)  # -> Start, End
ln = Line(StartPoint=end.Start, EndPoint=end_2.Start)
ln_2 = Line(StartPoint=end.End, EndPoint=end_2.End)
merge = Merge(Data1=ln, Data2=ln_2, Data3=pline, Data4=pline_2)
join = JoinCurves(Curves=merge, Preserve=False)  # -> flatten(Curves)
srf = Surface(join)
col = Colour(RGB(255, 255, 255))
preview = CustomPreview(Geometry=srf, Material=col)
