# Grasshopper definition construction_detail.gh (Grasshopper 1.0.7)

number_slider = Slider(10, range=0..10)
number_slider_2 = Slider(58.459, range=0..100)
number_slider_3 = Slider(150, range=0..1000)
series = Series(Start=0, Step=1, Count=number_slider)  # -> graft(Series)
division = Division(A=number_slider_3, B=Slider(1, range=0..1))
multiplication = Multiplication(A=number_slider_2, B=0.5)
round = Round(Number=division)  # -> Nearest, Floor, Ceiling
addition = Addition(A=series, B=Slider(10, range=0..10))
rectangle = Rectangle(Plane=PlaneXY(0, 0, 0), XSize=number_slider_2, YSize=number_slider_3, Radius=0)  # -> Rectangle, Length
multiplication_2 = Multiplication(A=addition, B=Slider(0.1, range=0..1))
division_2 = Division(A=number_slider_3, B=round.Nearest)
addition_2 = Addition(A=1, B=round.Nearest)
multiplication_3 = Multiplication(A=series, B=Slider(0.697, range=0..10))
multiplication_4 = Multiplication(A=multiplication_2, B=Slider(4, range=0..10))
series_2 = Series(Start=0, Step=division_2, Count=addition_2)
X = UnitX(Factor=multiplication)
expression = Expression(
    x=series_2,
    amplitude=multiplication_3,
    period=multiplication_4,
    phase=Slider(684.148, range=0..1000),
    Expression="sin((x+phase)/period)*amplitude")
pt = ConstructPoint(XCoordinate=multiplication, YCoordinate=series_2, ZCoordinate=0)
multiplication_5 = Multiplication(A=number_slider, B=2)
addition_3 = Addition(A=multiplication, B=expression)
series_3 = Series(Start=0, Step=Slider(5, range=0..10), Count=multiplication_5)
pt_2 = ConstructPoint(XCoordinate=addition_3, YCoordinate=series_2, ZCoordinate=0)
pline = PolyLine(Vertices=pt_2, Closed=False)
yz = YZPlane(Origin=Point(0, 0, 0))
Y = UnitY(Factor=series_3)
yz_2 = YZPlane(Origin=X)
rotate = Rotate(Geometry=pline, Angle=1.570796327, Plane=yz)  # -> Geometry, Transform
crv = Curve(flatten(rotate.Geometry))
rev = ReverseList(List=crv)
mirror = Mirror(Geometry=rev, Plane=yz_2)  # -> flatten(Geometry), Transform
merge = Merge(Data1=mirror.Geometry, Data2=crv)  # -> graft(Result)
pt_3 = Point(Point(0, 0, 0))
Z = UnitZ(Factor=number_slider_3)
end = EndPoints(Curve=merge)  # -> Start, End
ln = Line(StartPoint=pt_3, EndPoint=end.Start)
ln_2 = Line(StartPoint=Z, EndPoint=end.End)
merge_2 = Merge(Data1=ln, Data2=merge, Data3=ln_2)
join = JoinCurves(Curves=merge_2, Preserve=False)
end_2 = EndPoints(Curve=join)  # -> Start, End
ln_3 = Line(StartPoint=end_2.Start, EndPoint=end_2.End)
merge_3 = Merge(Data1=join, Data2=ln_3)
join_2 = JoinCurves(Curves=merge_3, Preserve=False)  # -> flatten(Curves)
move = Move(Geometry=join_2, Motion=Y)  # -> Geometry, Transform
srf = Surface(move.Geometry)
srf_2 = Surface(move.Geometry)
preview = CustomPreview(
    Geometry=srf,
    Material={diffuse=RGB(221, 160, 221), emission=RGB(66, 48, 66), shine=0.5, specular=RGB(255, 255, 255), transparency=0})
