# Grasshopper definition dimension_1-random_rectangles.gh (Grasshopper 1.0.7)

number_slider = Slider(100, range=0..100)
number_slider_2 = Slider(100, range=0..100)
number_slider_3 = Slider(6, range=0..10)
panel = Panel("1")
number_slider_4 = Slider(3, range=0..10)
num = Number(6.283185307)
series = Series(Start=0, Step=1, Count=Slider(100, range=0..100))
merge = Merge(Data1="0", Data2=Slider(1, range=0..10))
X = UnitX(Factor=Slider(1, range=0..10))
dom = ConstructDomain(DomainStart=Slider(3.984, range=0..10), DomainEnd=Slider(7.038, range=0..10))
dom_2 = ConstructDomain(DomainStart=Slider(10, range=0..10), DomainEnd=Slider(6.166, range=0..10))
division = Division(A=num, B=number_slider_3)
series_2 = Series(Start=0, Step=1, Count=10)
random = Random(Range=number_slider, Number=number_slider, Seed=Slider(6, range=0..10))
random_2 = Random(Range=number_slider_2, Number=number_slider_2, Seed=Slider(6, range=0..10))
domain = Domain(series)
pt = Point(X)
sort = SortList(Keys=random_2)  # -> Keys, ValuesA
ma = MassAddition(Input=series_2)  # -> Result, PartialResults
series_3 = Series(Start=0, Step=division, Count=number_slider_3)
sort_2 = SortList(Keys=random)  # -> Keys, ValuesA
sift = SiftPattern(List=sort_2.Keys, SiftPattern=merge)  # -> Output0, Output1, Output2
pt_2 = Point(Point(0, 0, 0))
clean = CleanTree(RemoveNulls=True, RemoveInvalid=True, RemoveEmpty=False, Tree=sift.Output0)
rotate = Rotate(Geometry=pt, Angle=series_3, Plane=PlaneXY(0, 0, 0))  # -> Geometry, Transform
clean_2 = CleanTree(RemoveNulls=True, RemoveInvalid=True, RemoveEmpty=False, Tree=sift.Output1)
sift_2 = SiftPattern(List=sort.Keys, SiftPattern=merge)  # -> Output0, Output1, Output2
pt_3 = Point([Point(1.372737259, -0.7218596653, 0), Point(1.916840889, 0.8404959695, 0), Point(-1.758914919, 2.07200112, 0), Point(2.805766182, -1.026600187, 0), Point(-3.028721471, -0.897134049, 0)])
xy = XYPlane(Origin=Point(0, 0, 0))
dom_3 = ConstructDomain(DomainStart=clean, DomainEnd=clean_2)
lng = ListLength(List=pt_3)
random_3 = Random(Range=lng, Number=Slider(500, range=0..10000), Seed=2)
round = Round(Number=random_3)  # -> Nearest, Floor, Ceiling
clean_3 = CleanTree(RemoveNulls=True, RemoveInvalid=True, RemoveEmpty=False, Tree=sift_2.Output0)
clean_4 = CleanTree(RemoveNulls=True, RemoveInvalid=True, RemoveEmpty=False, Tree=sift_2.Output1)
panel_2 = Panel(round.Floor)
item = ListItem(List=pt_3, Index=round.Floor, Wrap=True)
dom_4 = ConstructDomain(DomainStart=clean_3, DomainEnd=clean_4)
rectangle = Rectangle(Plane=xy, XSize=dom_3, YSize=graft(dom_4), Radius=0)  # -> Rectangle, Length
ma_2 = MassAddition(Input=item)  # -> Result, PartialResults
item_2 = ListItem(List=rectangle.Rectangle, Index=0, Wrap=True)
panel_3 = Panel(random_2)
panel_4 = Panel(random)
merge_2 = Merge(Data1=pt_2, Data2=ma_2.PartialResults)  # -> flatten(Result)
pline = PolyLine(Vertices=merge_2, Closed=False)
addition = Addition(A=1, B=number_slider_3)
series_4 = Series(Start=0, Step=1, Count=addition)
graft = GraftTree(Tree=series_4, IncludeEmptyLists=True, IncludeNullItems=True)
panel_5 = Panel(dom_3)
equals = Equality(FirstNumber=graft, SecondNumber=round.Floor)  # -> Equality, Inequality
ma_3 = MassAddition(Input=equals.Equality)  # -> Result, PartialResults
Y = UnitY(Factor=1)
flatten = FlattenTree(Tree=ma_3.Result, Path="{0}")
pt_4 = ConstructPoint(XCoordinate=series_4, YCoordinate=flatten, ZCoordinate=0)
panel_6 = Panel(pt_4)
