# Grasshopper definition grasshopper.gh (Grasshopper 1.0.7)

number_slider = Slider(360, range=0..1000)
number_slider_2 = Slider(20, range=0..10000)
crv = Curve([<curve referenced from the Rhino model> x4])
crv_2 = Curve([<curve referenced from the Rhino model> x5])
number_slider_3 = Slider(10, range=0..10)
X = UnitX(Factor=1)
X_2 = UnitX(Factor=Slider(10, range=0..10))
domain = Domain(Domain(0, 1))
number_slider_4 = Slider(-1, range=-1..1)
crv_3 = Curve(<curve referenced from the Rhino model>)
crv_4 = Curve(<curve referenced from the Rhino model>)
deg = Degrees(Radians=Slider(1, range=0..1))
crv_5 = Curve(crv_3)
crv_6 = Curve(<curve referenced from the Rhino model>)
multiplication = Multiplication(A=number_slider, B=0.01745329252)
rad = Radians(Degrees=number_slider)
series = Series(Start=0, Step=1, Count=Slider(3922, range=0..10000))
expression = Expression(
    x=series,
    period=Slider(6.442, range=0..10),
    amplitude=Slider(0.155, range=0..10),
    phase=Slider(7.494, range=0..10),
    Expression="sin((x+phase)/period)*amplitude")
series_2 = Series(Start=0, Step=1, Count=number_slider_2)
eval = EvaluateCurve(Curve=crv_2, Parameter=Slider(10, range=0..10))  # -> Point, Tangent, Angle
ln = Line(StartPoint=X, EndPoint=X_2)
merge = Merge(Data1=crv_6, Data2=crv_5, Data3=crv_4)
crvdom = CurveDomain(Curve=crv_3, Domain=domain)  # -> Curve, Domain
panel = Panel(deg)
panel_2 = Panel(multiplication)
number_slider_5 = Slider(1, range=0..1)
bnd = Bounds(Numbers=series_2)
Y = UnitY(Factor=series)
neg = Negative(Value=number_slider_4)
X_3 = UnitX(Factor=Slider(20, range=0..100))
sin = Sine(Value=series)
neg_2 = Negative(Value=number_slider_3)
divide = DivideCurve(Curve=crv_4, Count=Slider(10, range=0..10), Kinks=False)  # -> Points, Tangents, Parameters
rad_2 = Radians(Degrees=Slider(1, range=0..10))
remap = RemapNumbers(Value=series_2, Source=bnd, Target=Domain(0, 1))  # -> Mapped, Clipped
remap_2 = RemapNumbers(Value=series_2, Source=bnd, Target=crvdom.Domain)  # -> Mapped, Clipped
pt = Point(Y)
addition = Addition(A=Y, B=X_3)
offset = OffsetCurve(Curve=crv_6, Distance=number_slider_4, Plane=PlaneXY(0, 0, 0), Corners=1)
split = SplitList(List=divide.Points, Index=1)  # -> ListA, ListB
offset_2 = OffsetCurve(Curve=crv_2, Distance=number_slider_3, Plane=PlaneXY(0, 0, 0), Corners=1)
split_2 = SplitList(List=divide.Tangents, Index=1)  # -> ListA, ListB
offset_3 = OffsetCurve(Curve=crv_2, Distance=neg_2, Plane=PlaneXY(0, 0, 0), Corners=1)
multiplication_2 = Multiplication(A=series, B=rad_2)
addition_2 = Addition(A=expression, B=0.5)
pt_2 = Point(Point(-5.641710558, 4.908876288, 0))
ln_2 = Line(StartPoint=pt, EndPoint=addition)
eval_2 = EvaluateCurve(Curve=crv_3, Parameter=remap_2.Mapped)  # -> Point, Tangent, Angle
lng = ListLength(List=split.ListB)
lng_2 = ListLength(List=split_2.ListB)
end = EndPoints(Curve=offset_2)  # -> Start, End
end_2 = EndPoints(Curve=offset_3)  # -> Start, End
shatter = Shatter(Curve=crv_3, Parameters=remap_2.Mapped)
cluster = Cluster(C=merge, D=number_slider_4)
divide_2 = DivideCurve(Curve=crv_3, Count=number_slider_2, Kinks=False)  # -> Points, Tangents, Parameters
subtraction = Subtraction(A=lng, B=1)
subtraction_2 = Subtraction(A=lng_2, B=1)
divdist = DivideDistance(Curve=crv_3, Distance=Slider(10, range=0..10))  # -> Points, Tangents, Parameters
ln_3 = Line(StartPoint=end.Start, EndPoint=end_2.Start)
ln_4 = Line(StartPoint=end.End, EndPoint=end_2.End)
split_3 = SplitList(List=split.ListB, Index=subtraction)  # -> ListA, ListB
split_4 = SplitList(List=split_2.ListB, Index=subtraction_2)  # -> ListA, ListB
rotate = Rotate(Geometry=ln_2, Angle=multiplication_2, Plane=pt_2)  # -> Geometry, Transform
shatter_2 = Shatter(Curve=crv_3, Parameters=divdist.Parameters)
shift = ShiftList(List=divdist.Points, Shift=1, Wrap=True)
pt_3 = Point(split_3.ListA)
merge_2 = Merge(Data1=offset_2, Data2=offset_3, Data3=ln_3, Data4=ln_4)
item = ListItem(List=shatter, Index=Slider(3, range=0..100), Wrap=True)
crv_cp = CurveClosestPoint(Point=pt_3, Curve=crv_4)  # -> Point, Parameter, Distance
ln_5 = Line(StartPoint=divdist.Points, EndPoint=shift)
len = Length(Curve=ln_5)
join = JoinCurves(Curves=merge_2, Preserve=False)
runion = RegionUnion(Curves=flatten(cluster))
eval_3 = EvaluateCurve(Curve=crv_4, Parameter=crv_cp.Parameter)  # -> Point, Tangent, Angle
eval_4 = EvaluateCurve(Curve=rotate.Geometry, Parameter=addition_2)  # -> Point, Tangent, Angle
number_slider_6 = Slider(10, range=0..10)
panel_3 = Panel(len)
rotate_2 = Rotate(Geometry=eval_3.Tangent, Angle=1.570796327, Plane=PlaneXY(0, 0, 0))  # -> Geometry, Transform
pline = PolyLine(Vertices=eval_4.Point, Closed=False)
panel_4 = Panel(join)
neg_3 = Negative(Value=number_slider_6)
multiplication_3 = Multiplication(A=number_slider_6, B=rotate_2.Geometry)
multiplication_4 = Multiplication(A=neg_3, B=rotate_2.Geometry)
addition_3 = Addition(A=multiplication_4, B=pt_3)
addition_4 = Addition(A=multiplication_3, B=pt_3)
ln_6 = Line(StartPoint=addition_4, EndPoint=addition_3)
cluster_2 = Cluster(C=ln_6, D=number_slider_4)
rdiff = RegionDifference(CurvesA=runion, CurvesB=flatten(cluster_2))
panel_5 = Panel(split_4.ListA)
merge_3 = Merge(Data1=runion, Data2=cluster_2)  # -> flatten(Result)
rint = RegionIntersection(CurvesA=runion, CurvesB=cluster_2)
panel_6 = Panel(merge_3)
runion_2 = RegionUnion(Curves=merge_3)

# ==== cluster Cluster
D = ClusterInput()
neg = Negative(Value=D)
C = ClusterInput()
offset = OffsetCurve(Curve=C, Distance=D, Plane=PlaneXY(0, 0, 0), Corners=1)
offset_2 = OffsetCurve(Curve=C, Distance=neg, Plane=PlaneXY(0, 0, 0), Corners=1)
end = EndPoints(Curve=offset)  # -> Start, End
end_2 = EndPoints(Curve=offset_2)  # -> Start, End
ln = Line(StartPoint=end.Start, EndPoint=end_2.Start)
ln_2 = Line(StartPoint=end.End, EndPoint=end_2.End)
merge = Merge(Data1=offset, Data2=offset_2, Data3=ln, Data4=ln_2)
join = JoinCurves(Curves=merge, Preserve=False)
C_2 = ClusterOutput(join)
