# Grasshopper definition point_experiments.gh (Grasshopper 1.0.7)

number_slider = Slider(100, range=0..100)
number_slider_2 = Slider(100, range=0..100)
crv = Curve(<curve referenced from the Rhino model>)
divide = DivideCurve(Curve=crv, Count=1, Kinks=True)  # -> Points, Tangents, Parameters
number_slider_3 = Slider(3, range=0..10)
series = Series(Start=0, Step=1, Count=Slider(34, range=0..100))
series_2 = Series(Start=0, Step=1, Count=Slider(32, range=0..100))
series_3 = Series(Start=0, Step=1, Count=Slider(12, range=0..100))
series_4 = Series(Start=0, Step=1, Count=Slider(34, range=0..100))
pt = Point()
series_5 = Series(Start=0, Step=1, Count=Slider(32, range=0..100))
series_6 = Series(Start=0, Step=1, Count=number_slider_2)
pi = Pi(Factor=2)
multiplication = Multiplication(A=Slider(4.322, range=0..10), B=series)
series_7 = Series(Start=0, Step=1, Count=10)
series_8 = Series(Start=0, Step=1, Count=10)
series_9 = Series(Start=0, Step=1, Count=10)
multiplication_2 = Multiplication(A=series_3, B=Slider(2.807, range=0..10))
pt_2 = Point(Point(32.52251971, -18.57844495, 0))
pt_3 = Point(Point(75.36257957, -74.80693068, 0))
multiplication_3 = Multiplication(A=Slider(4.256, range=0..10), B=series_2)
pi_2 = Pi(Factor=2)
X = UnitX(Factor=Slider(1, range=0..1))
series_10 = Series(Start=0, Step=2.4, Count=Slider(1000, range=0..1000))
multiplication_4 = Multiplication(A=series_3, B=Slider(10, range=0..10))
series_11 = Series(Start=0, Step=1, Count=number_slider)
series_12 = Series(Start=0, Step=1, Count=Slider(1000, range=0..1000))
multiplication_5 = Multiplication(A=Slider(4.322, range=0..10), B=series_4)
pi_3 = Pi(Factor=2)
series_13 = Series(Start=0, Step=1, Count=number_slider)
multiplication_6 = Multiplication(A=Slider(4.256, range=0..10), B=series_5)
int = Integer(4)
division = Division(A=pi, B=number_slider_2)
crv_2 = Curve(<curve referenced from the Rhino model>)
pt_4 = Point(Point(32.52251971, -18.57844495, 0))
pt_5 = Point(Point(32.52251971, -18.57844495, 0))
X_2 = UnitX(Factor=series_7)
pt_6 = Point(Point(32.52251971, -18.57844495, 0))
X_3 = UnitX(Factor=series_8)
X_4 = UnitX(Factor=series_9)
division_2 = Division(A=pi_2, B=number_slider_2)
X_5 = UnitX(Factor=multiplication_4)
pt_7 = Point(Point(32.52251971, -18.57844495, 0))
X_6 = UnitX(Factor=multiplication_2)
pt_8 = Point(Point(40.61873793, -74.80693068, 0))
ln = Line(StartPoint=pt_2, EndPoint=pt_3)
pt_9 = Point(Point(40.61873793, -74.80693068, 0))
Y = UnitY(Factor=multiplication)
X_7 = UnitX(Factor=multiplication_3)
pt_10 = Point(Point(32.52251971, -18.57844495, 0))
X_8 = UnitX(Factor=series_6)
division_3 = Division(A=pi_3, B=number_slider)
multiplication_7 = Multiplication(A=division, B=series_6)
crv_3 = Curve(<curve referenced from the Rhino model>)
sqrt = SquareRoot(Value=series_12)
divide_2 = DivideCurve(Curve=crv_2, Count=1, Kinks=True)  # -> Points, Tangents, Parameters
Y_2 = UnitY(Factor=multiplication_5)
X_9 = UnitX(Factor=multiplication_6)
X_10 = UnitX(Factor=series_11)
multiplication_8 = Multiplication(A=division_2, B=series_11)
series_14 = Series(Start=Slider(9, range=0..10), Step=1, Count=int)
rotate = Rotate(Geometry=X, Angle=series_10, Plane=PlaneXY(0, 0, 0))  # -> Geometry, Transform
X_11 = UnitX(Factor=series_13)
end = EndPoints(Curve=crv_3)  # -> Start, End
series_15 = Series(Start=0, Step=1, Count=Slider(100, range=0..100))
pt_11 = Point(Point(40.61873793, -74.80693068, 0))
addition = Addition(A=series_14, B=3)
multiplication_9 = Multiplication(A=division_3, B=series_13)
series_16 = Series(Start=0, Step=1, Count=Slider(100, range=0..100))
move = Move(Geometry=pt_5, Motion=X_2)  # -> Geometry, Transform
number_slider_4 = Slider(1, range=0..1)
move_2 = Move(Geometry=pt_6, Motion=X_3)  # -> Geometry, Transform
divide_3 = DivideCurve(Curve=crv_3, Count=1, Kinks=True)  # -> Points, Tangents, Parameters
move_3 = Move(Geometry=pt_9, Motion=X_4)  # -> Geometry, Transform
addition_2 = Addition(A=graft(Y), B=X_7)
rotate_2 = Rotate(Geometry=X_10, Angle=multiplication_8, Plane=PlaneXY(0, 0, 0))  # -> Geometry, Transform
rotate_3 = Rotate(Geometry=X_8, Angle=multiplication_7, Plane=pt_4)  # -> Geometry, Transform
addition_3 = Addition(A=Slider(2, range=0..6), B=multiplication_9)
move_4 = Move(Geometry=rotate_3.Geometry, Motion=X_8)  # -> Geometry, Transform
move_5 = Move(Geometry=pt_7, Motion=X_5)  # -> Geometry, Transform
move_6 = Move(Geometry=pt_8, Motion=X_6)  # -> Geometry, Transform
pt_12 = Point([Point(19.86373187, 12.5105993, 0), Point(27.63125674, 20.92541791, 0), Point(37.6643097, 26.75106157, 0), Point(25.04208179, 37.43140827, 0), Point(23.74749431, 40.34423009, 0), Point(31.83866605, 41.96246444, 0)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])
pt_13 = Point([Point(19.86373187, 12.5105993, 0), Point(27.63125674, 20.92541791, 0), Point(37.6643097, 26.75106157, 0), Point(25.04208179, 37.43140827, 0), Point(23.74749431, 40.34423009, 0), Point(31.83866605, 41.96246444, 0)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])
multiplication_10 = Multiplication(A=Slider(4.322, range=0..10), B=series_15)
addition_4 = Addition(A=graft(Y_2), B=X_9)
ln_2 = Line(StartPoint=end.Start, EndPoint=end.End)
crv_4 = Curve(crv_3)
item = ListItem(List=multiplication_10, Index=-1, Wrap=True)
multiplication_11 = Multiplication(A=Slider(4.256, range=0..10), B=series_16)
item_2 = ListItem(List=multiplication_11, Index=-1, Wrap=True)
number_slider_5 = Slider(38.622, range=0..100)
multiplication_12 = Multiplication(A=sqrt, B=rotate.Geometry)
move_7 = Move(Geometry=rotate_2.Geometry, Motion=X_10)  # -> Geometry, Transform
number_slider_6 = Slider(10, range=0..10)
item_3 = ListItem(List=divide_2.Points, Index=addition, Wrap=True)
shift = ShiftList(List=item_3, Shift=number_slider_3, Wrap=True)
pt_14 = Point(shift)
ma = MassAddition(Input=pt_14)  # -> Result, PartialResults
lng = ListLength(List=pt_14)
division_4 = Division(A=ma.Result, B=lng)
item_4 = ListItem(List=divide_2.Points, Index=series_14, Wrap=True)
number_slider_7 = Slider(0, range=0..1)
rotate_4 = Rotate(Geometry=X_11, Angle=addition_3, Plane=PlaneXY(0, 0, 0))  # -> Geometry, Transform
number_slider_8 = Slider(63.481, range=0..100)
pt_15 = Point(addition_2)
panel = Panel(item_2)
pt_16 = Point(pt_13)
panel_2 = Panel(item)
merge = Merge(Data1=crv_4, Data2=ln_2)
Y_3 = UnitY(Factor=multiplication_10)
X_12 = UnitX(Factor=multiplication_11)
ln_3 = Line(StartPoint=pt_14, EndPoint=division_4)
move_8 = Move(Geometry=rotate_4.Geometry, Motion=X_11)  # -> Geometry, Transform
pt_17 = Point(addition_4)
dist = Distance(PointA=graft(pt_17), PointB=pt_12)
circle = CircleCNR(Center=multiplication_12, Normal=Vector(0, 0, 1), Radius=Slider(1, range=0..10))
pt_18 = Point(divide_3.Points)
join = JoinCurves(Curves=crv_4, Preserve=False)
division_5 = Division(A=number_slider_6, B=2)
sort = SortList(Keys=dist)  # -> Keys, ValuesA
pt_19 = Point([Point(19.86373187, 12.5105993, 0), Point(27.63125674, 20.92541791, 0), Point(37.6643097, 26.75106157, 0), Point(25.04208179, 37.43140827, 0), Point(23.74749431, 40.34423009, 0), Point(31.83866605, 41.96246444, 0)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])
ln_4 = Line(StartPoint=move_2.Geometry, EndPoint=pt_11)
ln_5 = Line(StartPoint=move.Geometry, EndPoint=move_3.Geometry)
ln_6 = Line(StartPoint=graft(move_5.Geometry), EndPoint=move_6.Geometry)
ln_7 = Line(StartPoint=rotate_3.Geometry, EndPoint=move_4.Geometry)
ln_8 = Line(StartPoint=rotate_2.Geometry, EndPoint=move_8.Geometry)
addition_5 = Addition(A=graft(Y_3), B=X_12)
shift_2 = ShiftList(List=pt_18, Shift=1, Wrap=True)
Z = UnitZ(Factor=Slider(63.481, range=0..100))
ma_2 = MassAddition(Input=pt_18)  # -> Result, PartialResults
lng_2 = ListLength(List=pt_18)
eval = EvaluateCurve(Curve=ln_3, Parameter=Slider(0, range=0..1))  # -> flatten(Point), Tangent, Angle
offset = OffsetCurve(Curve=join, Distance=number_slider_6, Plane=PlaneXY(0, 0, 0), Corners=1)
offset_2 = OffsetCurve(Curve=join, Distance=division_5, Plane=PlaneXY(0, 0, 0), Corners=1)
item_5 = ListItem(List=sort.Keys, Index=0, Wrap=True)
number_slider_9 = Slider(7, range=0..100)
addition_6 = Addition(A=shift_2, B=pt_18)
pdecon = Deconstruct(Point=pt_16)  # -> XComponent, YComponent, ZComponent
Z_2 = UnitZ(Factor=Slider(10, range=0..10))
Z_3 = UnitZ(Factor=Slider(15, range=0..100))
pt_20 = Point(addition_5)
image = ImageSampler(
    pt_20,
    FilePath="/Users/jonas/Desktop/Screenshot 2021-02-16 at 21.06.33.png",
    Filter="Colour",
    Interpolate=False,
    Umax=421.344,
    Umin=0,
    Vmax=427.878,
    Vmin=0,
    Wrap=1)
dist_2 = Distance(PointA=graft(pt_20), PointB=pt_19)
division_6 = Division(A=ma_2.Result, B=lng_2)
dist_3 = Distance(PointA=graft(pt_15), PointB=pt_16)
division_7 = Division(A=addition_6, B=2)
number_slider_10 = Slider(0.444, range=0..1)
move_9 = Move(Geometry=join, Motion=Z_2)  # -> Geometry, Transform
move_10 = Move(Geometry=offset_2, Motion=Z_3)  # -> Geometry, Transform
path_mapper = PathMapper(item_5, source="{A;B;C;D}", target="{A;B;C}")
division_8 = Division(A=Slider(28, range=0..100), B=path_mapper)
move_11 = Move(Geometry=offset, Motion=Z_2)  # -> Geometry, Transform
move_12 = Move(Geometry=eval.Point, Motion=Z)  # -> Geometry, Transform
sort_2 = SortList(Keys=dist_2)  # -> Keys, ValuesA
col = Colour(image)
pt_21 = Point(flatten(pt_18))
pt_22 = Point(flatten(division_7))
number_slider_11 = Slider(3, range=-10..10)
pt_23 = Point(image)
shift_3 = ShiftList(List=eval.Point, Shift=1, Wrap=True)  # -> flatten(List)
shift_4 = ShiftList(List=move_12.Geometry, Shift=1, Wrap=True)  # -> flatten(List)
number_slider_12 = Slider(38.622, range=0..100)
ln_9 = Line(StartPoint=pt_18, EndPoint=division_6)
ln_10 = Line(StartPoint=division_7, EndPoint=division_6)
min = Minimum(A=division_8, B=Slider(14, range=0..100))
Y_4 = UnitY(Factor=min)
addition_7 = Addition(A=pt_17, B=Y_4)
pline = PolyLine(Vertices=addition_7, Closed=False)
rev = ReverseList(List=move_12.Geometry)  # -> flatten(List)
multiplication_13 = Multiplication(A=pt_23, B=number_slider_9)
item_6 = ListItem(List=sort_2.Keys, Index=0, Wrap=True)
item_7 = ListItem(List=move_12.Geometry, Index=0, Wrap=True)  # -> Item, Item1, Item2, Item3
lng_3 = ListLength(List=pt_13)
merge_2 = Merge(Data1=join, Data2=move_9.Geometry, Data3=move_10.Geometry, Data4=move_11.Geometry, Data5=offset)  # -> flatten(Result)
pdecon_2 = Deconstruct(Point=pt_23)  # -> XComponent, YComponent, ZComponent
Y_5 = UnitY(Factor=multiplication_13)
pdecon_3 = Deconstruct(Point=pt_23)  # -> XComponent, YComponent, ZComponent
merge_3 = Merge(Data1=graft(eval.Point), Data2=graft(move_12.Geometry), Data3=graft(shift_4), Data4=graft(shift_3))
sort_3 = SortList(Keys=dist_3)  # -> Keys, ValuesA
pt_24 = ConstructPoint(XCoordinate=pdecon_2.XComponent, YCoordinate=pdecon_2.YComponent, ZCoordinate=0)
path_mapper_2 = PathMapper(item_6, source="{A;B;C;D}", target="{A;B;C}")
division_9 = Division(A=number_slider_9, B=path_mapper_2)
multiplication_14 = Multiplication(A=pt_23, B=number_slider_9)
pdecon_4 = Deconstruct(Point=graft(pt_15))  # -> XComponent, YComponent, ZComponent
subtraction = Subtraction(A=pdecon.YComponent, B=pdecon_4.YComponent)
abs = Absolute(Value=subtraction)
pt_25 = ConstructPoint(XCoordinate=pdecon_2.XComponent, YCoordinate=0, ZCoordinate=pdecon_2.ZComponent)
eval_2 = EvaluateCurve(Curve=ln_9, Parameter=number_slider_10)  # -> flatten(Point), Tangent, Angle
merge_4 = Merge(Data1=item_7.Item, Data2=item_7.Item1)
eval_3 = EvaluateCurve(Curve=ln_10, Parameter=number_slider_10)  # -> flatten(Point), Tangent, Angle
addition_8 = Addition(A=item_7.Item, B=item_7.Item1)
addition_9 = Addition(A=item_7.Item3, B=item_7.Item2)
loft = Loft(Curves=merge_2, Options={Adjust=False, Closed=True, LoftEnds=0, LoftSimp=0, LoftType=3, Rebuild=10, Refit=0.01})
pt_26 = ConstructPoint(XCoordinate=0, YCoordinate=pdecon_2.YComponent, ZCoordinate=pdecon_2.ZComponent)
item_8 = ListItem(List=sort_3.Keys, Index=0, Wrap=True)
addition_10 = Addition(A=pt_20, B=multiplication_14)
shift_5 = ShiftList(List=pt_22, Shift=number_slider_11, Wrap=True)  # -> flatten(List)
shift_6 = ShiftList(List=eval_3.Point, Shift=number_slider_11, Wrap=True)  # -> flatten(List)
item_9 = ListItem(List=merge_3, Index=0, Wrap=True)  # -> Item, Item1, Item2, Item3
min_2 = Minimum(A=division_9, B=Slider(14, range=0..100))
Z_4 = UnitZ(Factor=number_slider_12)
cap = CapHoles(Brep=loft)
Z_5 = UnitZ(Factor=number_slider_12)
path_mapper_3 = PathMapper(addition_10, source="{A;B;C}", target="{C}")
series_17 = Series(Start=0, Step=1, Count=lng_3)
equals = Equality(FirstNumber=item_8, SecondNumber=dist_3)  # -> Equality, Inequality
division_10 = Division(A=addition_8, B=2)
division_11 = Division(A=addition_9, B=2)
srf4pt = _4PointSurface(CornerA=item_9.Item, CornerB=item_9.Item1, CornerC=item_9.Item2, CornerD=item_9.Item3)
merge_5 = Merge(Data1=graft(eval_2.Point), Data2=graft(pt_21), Data3=graft(pt_22), Data4=graft(eval_3.Point))
multiplication_15 = Multiplication(A=series_17, B=equals.Equality)
addition_11 = Addition(A=Z_4, B=division_11)
addition_12 = Addition(A=Z_4, B=division_10)
graft = GraftTree(Tree=path_mapper_3, IncludeEmptyLists=True, IncludeNullItems=True)
ma_3 = MassAddition(Input=multiplication_15)  # -> Result, PartialResults
merge_6 = Merge(Data1=graft(shift_5), Data2=graft(pt_21), Data3=graft(eval_2.Point), Data4=graft(shift_6))
path_mapper_4 = PathMapper(graft, source="{A;B}", target="{B}")
pline_2 = PolyLine(Vertices=merge_5, Closed=False)  # -> flatten(Polyline)
cluster = Cluster(num=number_slider_5, F=number_slider_8, L=item_4, S=number_slider_3, crv=pline_2, t=number_slider_7)  # -> P, B
srf4pt_2 = _4PointSurface(CornerA=item_7.Item, CornerB=item_7.Item1, CornerC=addition_12)
srf4pt_3 = _4PointSurface(CornerA=item_7.Item3, CornerB=item_7.Item2, CornerC=addition_11)
srf4pt_4 = _4PointSurface(CornerA=item_7.Item3, CornerB=item_7.Item, CornerC=addition_12, CornerD=addition_11)
srf4pt_5 = _4PointSurface(CornerA=item_7.Item2, CornerB=item_7.Item1, CornerC=addition_12, CornerD=addition_11)
shift_7 = ShiftList(List=merge_6, Shift=1, Wrap=True)
item_10 = ListItem(List=pt_16, Index=ma_3.Result, Wrap=True)
item_11 = ListItem(List=pline_2, Index=0, Wrap=True)  # -> Item, Item1, Item2, Item3
merge_7 = Merge(Data1=srf4pt_2, Data2=srf4pt_3, Data3=srf4pt_4, Data4=srf4pt_5, Data5=flatten(srf4pt))
pline_3 = PolyLine(Vertices=shift_7, Closed=False)  # -> flatten(Polyline)
panel_3 = Panel(merge_5)
pline_4 = PolyLine(Vertices=path_mapper_4, Closed=False)
pline_5 = PolyLine(Vertices=addition_10, Closed=False)
pdecon_5 = Deconstruct(Point=item_10)  # -> XComponent, YComponent, ZComponent
join_2 = BrepJoin(Breps=merge_7)  # -> Breps, Closed
subtraction_2 = Subtraction(A=pdecon_4.XComponent, B=pdecon_5.XComponent)
subtraction_3 = Subtraction(A=pdecon_4.YComponent, B=pdecon_5.YComponent)
cluster_2 = Cluster_2(num=number_slider_5, F=number_slider_8, L=item_4, S=number_slider_3, crv=item_11.Item3, t=number_slider_7)  # -> P, B
cluster_3 = Cluster_2(num=number_slider_5, F=number_slider_8, L=item_4, S=number_slider_3, crv=item_11.Item, t=number_slider_7)  # -> P, B
cluster_4 = Cluster_2(num=number_slider_5, F=number_slider_8, L=item_4, S=number_slider_3, crv=item_11.Item2, t=number_slider_7)  # -> P, B
cluster_5 = Cluster_2(num=number_slider_5, F=number_slider_8, L=item_4, S=number_slider_3, crv=item_11.Item1, t=number_slider_7)  # -> P, B
item_12 = ListItem(List=pline_3, Index=0, Wrap=True)  # -> Item, Item1, Item2, Item3
cap_2 = CapHoles(Brep=join_2.Breps)
abs_2 = Absolute(Value=subtraction_2)
abs_3 = Absolute(Value=subtraction_3)
multiplication_16 = Multiplication(A=abs_3, B=0)
smaller = SmallerThan(FirstNumber=Slider(10, range=0..10), SecondNumber=abs_2)  # -> SmallerThan, OrEqualTo
merge_8 = Merge(Data1=abs_3, Data2=multiplication_16)
cluster_6 = Cluster_2(num=number_slider_5, F=number_slider_8, L=item_4, S=number_slider_3, crv=item_12.Item3, t=number_slider_7)  # -> P, B
cluster_7 = Cluster_2(num=number_slider_5, F=number_slider_8, L=item_4, S=number_slider_3, crv=item_12.Item, t=number_slider_7)  # -> P, B
cluster_8 = Cluster_2(num=number_slider_5, F=number_slider_8, L=item_4, S=number_slider_3, crv=item_12.Item2, t=number_slider_7)  # -> P, B
cluster_9 = Cluster_2(num=number_slider_5, F=number_slider_8, L=item_4, S=number_slider_3, crv=item_12.Item1, t=number_slider_7)  # -> P, B
item_13 = ListItem(List=merge_8, Index=smaller.OrEqualTo, Wrap=True)
merge_9 = Merge(Data1=cap_2, Data2=cluster.B)
merge_10 = Merge(
    Data1=cluster_3.B,
    Data2=cluster_5.B,
    Data3=cluster_4.B,
    Data4=cluster_2.B,
    Data5=cluster_7.B,
    Data6=cluster_9.B,
    Data7=cluster_8.B,
    Data8=cluster_6.B)
sunion = SolidUnion(Breps=merge_9)
number_slider_13 = Slider(75, range=0..100)
path_mapper_5 = PathMapper(item_13, source="{A;B;C;D}", target="{A;B;C}")
sunion_2 = SolidUnion(Breps=merge_10)
panel_4 = Panel(path_mapper_5)
min_3 = Minimum(A=path_mapper_5, B=Slider(74, range=0..100))
Y_6 = UnitY(Factor=min_3)
addition_13 = Addition(A=pt_15, B=Y_6)
pline_6 = PolyLine(Vertices=addition_13, Closed=False)

# ==== cluster Cluster
t = ClusterInput()
F = ClusterInput()
crv = ClusterInput()
crv_2 = Curve(crv)
divide = DivideCurve(Curve=crv_2, Count=1, Kinks=True)  # -> Points, Tangents, Parameters
P = ClusterOutput(divide.Points)
L = ClusterInput()
S = ClusterInput()
num = ClusterInput()
shift = ShiftList(List=L, Shift=S, Wrap=True)
pt = Point(divide.Points)
lng = ListLength(List=pt)
ma = MassAddition(Input=pt)  # -> Result, PartialResults
division = Division(A=ma.Result, B=lng)
ln = Line(StartPoint=pt, EndPoint=division)
Z = UnitZ(Factor=F)
eval = EvaluateCurve(Curve=ln, Parameter=t)  # -> flatten(Point), Tangent, Angle
num_2 = Number(num)
move = Move(Geometry=eval.Point, Motion=Z)  # -> Geometry, Transform
shift_2 = ShiftList(List=eval.Point, Shift=1, Wrap=True)  # -> flatten(List)
shift_3 = ShiftList(List=move.Geometry, Shift=1, Wrap=True)  # -> flatten(List)
rev = ReverseList(List=move.Geometry)  # -> flatten(List)
item = ListItem(List=move.Geometry, Index=0, Wrap=True)  # -> Item, Item1, Item2, Item3
merge = Merge(Data1=graft(eval.Point), Data2=graft(move.Geometry), Data3=graft(shift_3), Data4=graft(shift_2))
addition = Addition(A=item.Item, B=item.Item1)
addition_2 = Addition(A=item.Item3, B=item.Item2)
item_2 = ListItem(List=merge, Index=0, Wrap=True)  # -> Item, Item1, Item2, Item3
Z_2 = UnitZ(Factor=num_2)
Z_3 = UnitZ(Factor=num_2)
division_2 = Division(A=addition, B=2)
division_3 = Division(A=addition_2, B=2)
srf4pt = _4PointSurface(CornerA=item_2.Item, CornerB=item_2.Item1, CornerC=item_2.Item2, CornerD=item_2.Item3)
addition_3 = Addition(A=Z_2, B=division_3)
addition_4 = Addition(A=Z_2, B=division_2)
srf4pt_2 = _4PointSurface(CornerA=item.Item, CornerB=item.Item1, CornerC=addition_4)
srf4pt_3 = _4PointSurface(CornerA=item.Item3, CornerB=item.Item2, CornerC=addition_3)
srf4pt_4 = _4PointSurface(CornerA=item.Item3, CornerB=item.Item, CornerC=addition_4, CornerD=addition_3)
srf4pt_5 = _4PointSurface(CornerA=item.Item2, CornerB=item.Item1, CornerC=addition_4, CornerD=addition_3)
merge_2 = Merge(Data1=srf4pt_2, Data2=srf4pt_3, Data3=srf4pt_4, Data4=srf4pt_5, Data5=flatten(srf4pt))
join = BrepJoin(Breps=merge_2)  # -> Breps, Closed
cap = CapHoles(Brep=join.Breps)
B = ClusterOutput(cap)

# ==== cluster Cluster_2
crv = ClusterInput()
crv_2 = Curve(crv)
divide = DivideCurve(Curve=crv_2, Count=1, Kinks=True)  # -> Points, Tangents, Parameters
L = ClusterInput()
S = ClusterInput()
P = ClusterOutput(divide.Points)
shift = ShiftList(List=L, Shift=S, Wrap=True)
pt = Point(divide.Points)
lng = ListLength(List=pt)
ma = MassAddition(Input=pt)  # -> Result, PartialResults
division = Division(A=ma.Result, B=lng)
ln = Line(StartPoint=pt, EndPoint=division)
F = ClusterInput()
t = ClusterInput()
num = ClusterInput()
Z = UnitZ(Factor=F)
eval = EvaluateCurve(Curve=ln, Parameter=t)  # -> flatten(Point), Tangent, Angle
num_2 = Number(num)
move = Move(Geometry=eval.Point, Motion=Z)  # -> Geometry, Transform
shift_2 = ShiftList(List=eval.Point, Shift=1, Wrap=True)  # -> flatten(List)
shift_3 = ShiftList(List=move.Geometry, Shift=1, Wrap=True)  # -> flatten(List)
rev = ReverseList(List=move.Geometry)  # -> flatten(List)
item = ListItem(List=move.Geometry, Index=0, Wrap=True)  # -> Item, Item1, Item2, Item3
merge = Merge(Data1=graft(eval.Point), Data2=graft(move.Geometry), Data3=graft(shift_3), Data4=graft(shift_2))
addition = Addition(A=item.Item, B=item.Item1)
addition_2 = Addition(A=item.Item3, B=item.Item2)
item_2 = ListItem(List=merge, Index=0, Wrap=True)  # -> Item, Item1, Item2, Item3
Z_2 = UnitZ(Factor=num_2)
Z_3 = UnitZ(Factor=num_2)
division_2 = Division(A=addition, B=2)
division_3 = Division(A=addition_2, B=2)
srf4pt = _4PointSurface(CornerA=item_2.Item, CornerB=item_2.Item1, CornerC=item_2.Item2, CornerD=item_2.Item3)
addition_3 = Addition(A=Z_2, B=division_3)
addition_4 = Addition(A=Z_2, B=division_2)
srf4pt_2 = _4PointSurface(CornerA=item.Item, CornerB=item.Item1, CornerC=addition_4)
srf4pt_3 = _4PointSurface(CornerA=item.Item3, CornerB=item.Item2, CornerC=addition_3)
srf4pt_4 = _4PointSurface(CornerA=item.Item3, CornerB=item.Item, CornerC=addition_4, CornerD=addition_3)
srf4pt_5 = _4PointSurface(CornerA=item.Item2, CornerB=item.Item1, CornerC=addition_4, CornerD=addition_3)
merge_2 = Merge(Data1=srf4pt_2, Data2=srf4pt_3, Data3=srf4pt_4, Data4=srf4pt_5, Data5=flatten(srf4pt))
join = BrepJoin(Breps=merge_2)  # -> Breps, Closed
cap = CapHoles(Brep=join.Breps)
B = ClusterOutput(cap)
