# Grasshopper definition previewAndExamples point_experiments.gh (Grasshopper 1.0.7)
# plug-ins: Parakeet

number_slider = Slider(100, range=0..100)
number_slider_2 = Slider(100, range=0..100)
series = Series(Start=0, Step=1, Count=10)
series_2 = Series(Start=0, Step=1, Count=10)
series_3 = Series(Start=0, Step=1, Count=10)
number_slider_3 = Slider(1000, range=0..1000)
pt = Point(Point(32.52251971, -18.57844495, 0))
pt_2 = Point(Point(75.36257957, -74.80693068, 0))
X = UnitX(Factor=series)
X_2 = UnitX(Factor=series_2)
pt_3 = Point(Point(32.52251971, -18.57844495, 0))
X_3 = UnitX(Factor=series_3)
pt_4 = Point(Point(32.52251971, -18.57844495, 0))
number_slider_4 = Slider(10, range=0..50)
ln = Line(StartPoint=pt, EndPoint=pt_2)
pt_5 = Point(Point(40.61873793, -74.80693068, 0))
series_4 = Series(Start=0, Step=1, Count=Slider(12, range=0..100))
pt_6 = Point([Point(-43.67730231, 306.1352073, 0), Point(99.45265396, 372.7217522, 0)])
number_slider_5 = Slider(10, range=0..50)
number_slider_6 = Slider(4.86, range=0..5)
number_slider_7 = Slider(-2.164, range=-10..10)
number_slider_8 = Slider(-5.127, range=-10..10)
series_5 = Series(Start=0, Step=1, Count=number_slider_2)
pi = Pi(Factor=2)
pi_2 = Pi(Factor=2)
series_6 = Series(Start=0, Step=1, Count=number_slider)
pi_3 = Pi(Factor=2)
series_7 = Series(Start=0, Step=1, Count=number_slider)
number_slider_9 = Slider(5, range=0..10)
series_8 = Series(Start=0, Step=1, Count=number_slider_3)
move = Move(Geometry=pt_3, Motion=X)  # -> Geometry, Transform
move_2 = Move(Geometry=pt_4, Motion=X_2)  # -> Geometry, Transform
pt_7 = Point(Point(40.61873793, -74.80693068, 0))
move_3 = Move(Geometry=pt_5, Motion=X_3)  # -> Geometry, Transform
subtraction = Subtraction(A=number_slider_3, B=1)
number_slider_10 = Slider(1000, range=0..1000)
multiplication = Multiplication(A=series_4, B=Slider(2.807, range=0..10))
number_slider_11 = Slider(100, range=0..1000)
multiplication_2 = Multiplication(A=series_4, B=Slider(10, range=0..10))
yz = YZPlane(Origin=Point(0, 0, 0))
item = ListItem(List=pt_6, Index=0, Wrap=True)  # -> Item, Item1
division = Division(A=pi_2, B=number_slider_2)
division_2 = Division(A=pi_3, B=number_slider)
pt_8 = Point(Point(32.52251971, -18.57844495, 0))
neg = Negative(Value=number_slider_9)
series_9 = Series(Start=0, Step=1, Count=Slider(50, range=0..100))
division_3 = Division(A=pi, B=number_slider_2)
number_slider_12 = Slider(1000, range=0..1000)
X_4 = UnitX(Factor=series_6)
series_10 = Series(Start=0, Step=1, Count=Slider(100, range=0..100))
X_5 = UnitX(Factor=multiplication_2)
series_11 = Series(Start=0, Step=1, Count=Slider(50, range=0..100))
X_6 = UnitX(Factor=multiplication)
pt_9 = Point(Point(32.52251971, -18.57844495, 0))
pt_10 = Point(Point(32.52251971, -18.57844495, 0))
multiplication_3 = Multiplication(A=division, B=series_6)
series_12 = Series(Start=0, Step=1, Count=Slider(100, range=0..100))
pt_11 = Point(Point(40.61873793, -74.80693068, 0))
division_4 = Division(A=series_8, B=subtraction)
X_7 = UnitX(Factor=series_7)
p2p = GhPythonScript(pln=yz)  # -> out, x; inputs x: list of GeometryBase, pln: Plane
# ---------- p2p: Python ----------
from Rhino.Geometry.Transform import PlaneToPlane
from Rhino.Geometry.Plane import WorldXY

t_m = PlaneToPlane(WorldXY, pln)
[o.Transform(t_m) for o in x]
# ---------- end p2p ----------
series_13 = Series(Start=0, Step=1, Count=Slider(100, range=0..100))
multiplication_4 = Multiplication(A=division_2, B=series_7)
series_14 = Series(Start=0, Step=1, Count=Slider(100, range=0..100))
crv = Curve(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)
random = Random(Range=Slider(100, range=0..100), Number=Slider(100, range=0..100), Seed=Slider(1, range=0..10))
offset = OffsetCurve(Curve=crv, Distance=Slider(15, range=0..100), Plane=PlaneXY(0, 0, 0), Corners=1)
series_15 = Series(Start=0, Step=1, Count=Slider(34, range=0..100))
random_2 = Random(Range=Slider(100, range=0..100), Number=Slider(100, range=0..100), Seed=Slider(5, range=0..10))
merge = Merge(Data1=number_slider_9, Data2=neg)
X_8 = UnitX(Factor=series_5)
subtraction_2 = Subtraction(A=item.Item, B=item.Item1)
dist = Distance(PointA=item.Item1, PointB=item.Item)
multiplication_5 = Multiplication(A=division_3, B=series_5)
crv_2 = Curve(<curve referenced from the Rhino model>)
crv_3 = Curve(<curve referenced from the Rhino model>)
series_16 = Series(Start=0, Step=1, Count=Slider(32, range=0..100))
point = Point([Point(-136.0703988, 157.8360222, 0), Point(-83.93301317, 43.93588749, 0), Point(25.15443975, 137.7831815, 0)])
multiplication_6 = Multiplication(A=Slider(2, range=0..10), B=series_9)
X_9 = UnitX(Factor=Slider(1, range=0..1))
series_17 = Series(Start=0, Step=2.4, Count=Slider(1000, range=0..1000))
addition = Addition(A=Slider(2, range=0..6), B=multiplication_4)
X_10 = UnitX(Factor=Slider(1, range=0..1))
series_18 = Series(Start=0, Step=2.4, Count=Slider(1000, range=0..1000))
series_19 = Series(Start=0, Step=1, Count=Slider(1000, range=0..1000))
multiplication_7 = Multiplication(A=Slider(4.322, range=0..10), B=series_10)
series_20 = Series(Start=0, Step=1, Count=number_slider_10)
multiplication_8 = Multiplication(A=Slider(2, range=0..10), B=series_11)
multiplication_9 = Multiplication(A=Slider(1, range=0..10), B=series_12)
addition_2 = Addition(A=division_4, B=number_slider_8)
t = Number(addition_2)
item_2 = ListItem(List=multiplication_7, Index=-1, Wrap=True)
X_11 = UnitX(Factor=Slider(1, range=0..1))
series_21 = Series(Start=0, Step=2.4, Count=Slider(1000, range=0..1000))
multiplication_10 = Multiplication(A=Slider(4.256, range=0..10), B=series_13)
item_3 = ListItem(List=multiplication_10, Index=-1, Wrap=True)
series_22 = Series(Start=0, Step=1, Count=Slider(1000, range=0..1000))
multiplication_11 = Multiplication(A=Slider(1, range=0..10), B=series_14)
num = Number(number_slider_11)
multiplication_12 = Multiplication(A=Slider(4.322, range=0..10), B=series_15)
sort = SortList(Keys=random)  # -> Keys, ValuesA
crv_4 = Curve(offset)
sort_2 = SortList(Keys=random_2)  # -> Keys, ValuesA
ln_2 = Line(StartPoint=item.Item1, EndPoint=item.Item)
num_2 = Number(number_slider_11)
vec = Vector(subtraction_2)
rotate = Rotate(Geometry=X_4, Angle=multiplication_3, Plane=PlaneXY(0, 0, 0))  # -> Geometry, Transform
random_3 = Random(Range=Slider(4, range=0..10), Number=Slider(10000, range=0..10000), Seed=2)
patterngenh = PatternGenotypeH(BasePolylines=crv_3, Factor=0.5)
move_4 = Move(Geometry=pt_9, Motion=X_5)  # -> Geometry, Transform
X_12 = UnitX(Factor=merge)
Y = UnitY(Factor=merge)
patterngenl_pt = PatternGenotypeLPT(BasePolylines=crv_3, RotationFactor=Slider(0.94, range=0..1), ScaleFactor=Slider(0.4, range=0..10))
move_5 = Move(Geometry=pt_11, Motion=X_6)  # -> Geometry, Transform
multiplication_13 = Multiplication(A=Slider(4.256, range=0..10), B=series_16)
ln_3 = Line(StartPoint=move_2.Geometry, EndPoint=pt_7)
ln_4 = Line(StartPoint=move.Geometry, EndPoint=move_3.Geometry)
rotate_2 = Rotate(Geometry=X_8, Angle=multiplication_5, Plane=pt_10)  # -> Geometry, Transform
move_6 = Move(Geometry=rotate_2.Geometry, Motion=X_8)  # -> Geometry, Transform
_2d_aggregation = _2DAggregation(BaseCurve=crv_2, Iteration=Slider(5, range=0..100), BranchCount=Slider(4, range=0..10))  # -> AggregatedCurves, CurveCount
list_item = ListItem(List=point, Index=0, Wrap=True)  # -> Item, Item1, Item2
rotate_3 = Rotate(Geometry=X_7, Angle=addition, Plane=PlaneXY(0, 0, 0))  # -> Geometry, Transform
Y_2 = UnitY(Factor=multiplication_6)
X_13 = UnitX(Factor=Slider(1, range=0..1))
series_23 = Series(Start=0, Step=2.4, Count=Slider(1000, range=0..1000))
subtraction_3 = Subtraction(A=1, B=t)
X_14 = UnitX(Factor=multiplication_8)
series_24 = Series(Start=0, Step=1, Count=number_slider_12)
sqrt = SquareRoot(Value=series_19)
sqrt_2 = SquareRoot(Value=series_20)
panel = Panel(item_3)
sqrt_3 = SquareRoot(Value=number_slider_10)
panel_2 = Panel(item_2)
Y_3 = UnitY(Factor=multiplication_7)
X_15 = UnitX(Factor=multiplication_10)
Y_4 = UnitY(Factor=multiplication_9)
X_16 = UnitX(Factor=multiplication_11)
addition_3 = Addition(A=random_3, B=-0.5)
sqrt_4 = SquareRoot(Value=series_22)
divide = DivideCurve(Curve=crv, Count=num, Kinks=False)  # -> Points, Tangents, Parameters
multiplication_14 = Multiplication(A=vec, B=number_slider_7)
rotate_4 = Rotate(Geometry=X_9, Angle=series_17, Plane=PlaneXY(0, 0, 0))  # -> Geometry, Transform
rotate_5 = Rotate(Geometry=X_10, Angle=series_18, Plane=PlaneXY(0, 0, 0))  # -> Geometry, Transform
pt_12 = Point([Point(19.86373187, 12.5105993, 0), Point(27.63125674, 20.92541791, 0), Point(37.6643097, 26.75106157, 0), Point(25.04208179, 37.43140827, 0), Point(23.74749431, 40.34423009, 0), Point(31.83866605, 41.96246444, 0)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])
move_7 = Move(Geometry=rotate.Geometry, Motion=X_4)  # -> Geometry, Transform
divide_2 = DivideCurve(Curve=crv_4, Count=num_2, Kinks=False)  # -> Points, Tangents, Parameters
sift = SiftPattern(List=sort.Keys, SiftPattern=[0, 1])  # -> Output0, Output1
Y_5 = UnitY(Factor=multiplication_12)
sift_2 = SiftPattern(List=sort_2.Keys, SiftPattern=[0, 1])  # -> Output0, Output1
X_17 = UnitX(Factor=multiplication_13)
merge_2 = Merge(Data1=X_12, Data2=Y)
series_25 = Series(Start=0, Step=1, Count=Slider(50, range=0..100))
rotate_6 = Rotate(Geometry=X_11, Angle=series_21, Plane=PlaneXY(0, 0, 0))  # -> Geometry, Transform
subtraction_4 = Subtraction(A=num, B=1)
number_slider_13 = Slider(2, range=0..10)
crv_5 = Curve(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)
subtraction_5 = Subtraction(A=num_2, B=1)
series_26 = Series(Start=0, Step=1, Count=Slider(50, range=0..100))
number_slider_14 = Slider(2, range=0..10)
sqrt_5 = SquareRoot(Value=series_24)
round = Round(Number=addition_3)  # -> Nearest, Floor, Ceiling
number_slider_15 = Slider(1, range=0..10)
move_8 = Move(Geometry=rotate_3.Geometry, Motion=X_7)  # -> Geometry, Transform
number_slider_16 = Slider(1, range=0..1)
sqrt_6 = SquareRoot(Value=number_slider_12)
number_slider_17 = Slider(1, range=0..1)
addition_4 = Addition(A=graft(Y_2), B=X_14)
pt_13 = Point([Point(19.86373187, 12.5105993, 0), Point(27.63125674, 20.92541791, 0), Point(37.6643097, 26.75106157, 0), Point(25.04208179, 37.43140827, 0), Point(23.74749431, 40.34423009, 0), Point(31.83866605, 41.96246444, 0)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])
addition_5 = Addition(A=graft(Y_3), B=X_15)
pt_14 = Point([Point(19.86373187, 12.5105993, 0), Point(27.63125674, 20.92541791, 0), Point(37.6643097, 26.75106157, 0), Point(25.04208179, 37.43140827, 0), Point(23.74749431, 40.34423009, 0), Point(31.83866605, 41.96246444, 0)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])
number_slider_18 = Slider(1, range=0..10)
rotate_7 = Rotate(Geometry=X_13, Angle=series_23, Plane=PlaneXY(0, 0, 0))  # -> Geometry, Transform
number_slider_19 = Slider(1, range=0..1)
clean = CleanTree(RemoveNulls=True, RemoveInvalid=True, RemoveEmpty=False, Tree=sift_2.Output0)
clean_2 = CleanTree(RemoveNulls=True, RemoveInvalid=True, RemoveEmpty=False, Tree=sift_2.Output1)
division_5 = Division(A=series_23, B=6.283185307)
clean_3 = CleanTree(RemoveNulls=True, RemoveInvalid=True, RemoveEmpty=False, Tree=sift.Output0)
clean_4 = CleanTree(RemoveNulls=True, RemoveInvalid=True, RemoveEmpty=False, Tree=sift.Output1)
series_27 = Series(Start=0, Step=1, Count=Slider(50, range=0..100))
split = SplitList(List=divide.Parameters, Index=subtraction_4)  # -> ListA, ListB
addition_6 = Addition(A=graft(Y_4), B=X_16)
nurbs_curve = NurbsCurve(Vertices=point, Degree=Slider(2, range=0..10), Periodic=False)  # -> Curve, Length, Domain
eval = EvaluateCurve(Curve=ln_2, Parameter=number_slider_7)  # -> Point, Tangent, Angle
multiplication_15 = Multiplication(A=Slider(2, range=0..10), B=series_25)
hsv = ColourHSV(Alpha=1, Hue=series_18, Saturation=series_20, Value=1)
multiplication_16 = Multiplication(A=t, B=list_item.Item1)
pt_15 = Point([Point(19.86373187, 12.5105993, 0), Point(27.63125674, 20.92541791, 0), Point(37.6643097, 26.75106157, 0), Point(25.04208179, 37.43140827, 0), Point(23.74749431, 40.34423009, 0), Point(31.83866605, 41.96246444, 0)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])
multiplication_17 = Multiplication(A=subtraction_3, B=list_item.Item)
addition_7 = Addition(A=item.Item1, B=multiplication_14)
multiplication_18 = Multiplication(A=t, B=list_item.Item2)
split_2 = SplitList(List=divide_2.Parameters, Index=subtraction_5)  # -> ListA, ListB
multiplication_19 = Multiplication(A=subtraction_3, B=list_item.Item1)
division_6 = Division(A=num, B=number_slider_13)
multiplication_20 = Multiplication(A=sqrt, B=rotate_4.Geometry)
series_28 = Series(Start=0, Step=1, Count=Slider(50, range=0..100))
multiplication_21 = Multiplication(A=sqrt_2, B=rotate_5.Geometry)
crv_cp = CurveClosestPoint(Point=graft(addition_6), Curve=crv_5)  # -> Point, Parameter, Distance
division_7 = Division(A=num_2, B=number_slider_14)
pt_16 = Point(pt_12)
addition_8 = Addition(A=graft(Y_5), B=X_17)
multiplication_22 = Multiplication(A=Slider(2, range=0..10), B=series_26)
hsv_2 = ColourHSV(Alpha=1, Hue=series_21, Saturation=series_22, Value=1)
number_slider_20 = Slider(1000, range=0..1000)
number_slider_21 = Slider(1, range=0..10)
multiplication_23 = Multiplication(A=sqrt_4, B=rotate_6.Geometry)
ln_5 = Line(StartPoint=graft(move_4.Geometry), EndPoint=move_5.Geometry)
number_slider_22 = Slider(1, range=0..1)
ln_6 = Line(StartPoint=rotate_2.Geometry, EndPoint=move_6.Geometry)
number_slider_23 = Slider(7, range=0..100)
split_3 = SplitList(List=split.ListA, Index=1)  # -> ListA, ListB
multiplication_24 = Multiplication(A=Slider(2, range=0..10), B=series_27)
pdecon = Deconstruct(Point=multiplication_21)  # -> XComponent, YComponent, ZComponent
division_8 = Division(A=sqrt_5, B=sqrt_6)
split_4 = SplitList(List=split_2.ListA, Index=1)  # -> ListA, ListB
dom = ConstructDomain(DomainStart=clean, DomainEnd=clean_2)
pt_17 = Point(addition_4)
dist_2 = Distance(PointA=graft(pt_17), PointB=pt_13)
item_4 = ListItem(List=merge_2, Index=round.Nearest, Wrap=True)
multiplication_25 = Multiplication(A=Slider(2, range=0..10), B=series_28)
dom_2 = ConstructDomain(DomainStart=clean_3, DomainEnd=clean_4)
multiplication_26 = Multiplication(A=sqrt_5, B=rotate_7.Geometry)
Y_6 = UnitY(Factor=multiplication_15)
X_18 = UnitX(Factor=multiplication_22)
pt_18 = Point(addition_5)
image = ImageSampler(pt_18, Filter="Colour", Interpolate=False, Umax=421.344, Umin=0, Vmax=427.878, Vmin=0, Wrap=1)
dist_3 = Distance(PointA=graft(pt_18), PointB=pt_14)
addition_9 = Addition(A=multiplication_17, B=multiplication_16)
pt_19 = Point(addition_6)
dist_4 = Distance(PointA=graft(pt_19), PointB=pt_15)
ln_7 = Line(StartPoint=rotate.Geometry, EndPoint=move_8.Geometry)
addition_10 = Addition(A=multiplication_19, B=multiplication_18)
pt_20 = Point(addition_8)
shatter = Shatter(Curve=crv, Parameters=split_3.ListB)
series_29 = Series(Start=0, Step=number_slider_13, Count=division_6)
shatter_2 = Shatter(Curve=crv_4, Parameters=split_4.ListB)
sort_3 = SortList(Keys=dist_2)  # -> Keys, ValuesA
dots = DotDisplay(Point=multiplication_20, Colour=RGB(0, 0, 0), Size=Slider(1, range=0..10))
ma = MassAddition(Input=item_4)  # -> Result, PartialResults
addition_11 = Addition(A=pdecon.XComponent, B=sqrt_3)
multiplication_27 = Multiplication(A=sqrt_3, B=2)
series_30 = Series(Start=0, Step=number_slider_14, Count=division_7)
addition_12 = Addition(A=pdecon.YComponent, B=sqrt_3)
Y_7 = UnitY(Factor=multiplication_24)
X_19 = UnitX(Factor=multiplication_25)
sort_4 = SortList(Keys=dist_3)  # -> Keys, ValuesA
ext = ExtendCurve(Curve=nurbs_curve.Curve, Type=2, Start=number_slider_20, End=number_slider_20)
hsv_3 = ColourHSV(Alpha=1, Hue=division_5, Saturation=division_8, Value=1)
sort_5 = SortList(Keys=crv_cp.Distance)  # -> Keys, ValuesA
col = Colour(image)
rectangle = Rectangle(Plane=PlaneXY(0, 0, 0), XSize=dom, YSize=graft(dom_2), Radius=0)  # -> Rectangle, Length
pdecon_2 = Deconstruct(Point=pt_16)  # -> XComponent, YComponent, ZComponent
multiplication_28 = Multiplication(A=subtraction_3, B=addition_9)
pt_21 = Point(image)
addition_13 = Addition(A=graft(Y_6), B=X_18)
multiplication_29 = Multiplication(A=t, B=addition_10)
pt_22 = Point([Point(19.86373187, 12.5105993, 0), Point(27.63125674, 20.92541791, 0), Point(37.6643097, 26.75106157, 0), Point(25.04208179, 37.43140827, 0), Point(23.74749431, 40.34423009, 0), Point(31.83866605, 41.96246444, 0)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])
item_5 = ListItem(List=sort_3.Keys, Index=0, Wrap=True)
pdecon_3 = Deconstruct(Point=addition_13)  # -> XComponent, YComponent, ZComponent
expression = Expression(
    x=pdecon_3.XComponent,
    y=pdecon_3.YComponent,
    x_s=number_slider_4,
    y_s=number_slider_4,
    z=Slider(4.86, range=0..5),
    Expression="sin(x/x_s)*cos(y/y_s)+sin(y/y_s)*cos(z)+sin(z)*cos(x/x_s)")
multiplication_30 = Multiplication(A=pt_21, B=number_slider_23)
item_6 = ListItem(List=sort_4.Keys, Index=0, Wrap=True)
division_9 = Division(A=addition_12, B=multiplication_27)
division_10 = Division(A=addition_11, B=multiplication_27)
num_3 = Number(graft(expression))
pt_23 = Point(ma.PartialResults)
item_7 = ListItem(List=sort_5.Keys, Index=0, Wrap=True)
dots_2 = DotDisplay(Point=multiplication_23, Colour=hsv_2, Size=1)
dist_5 = Distance(PointA=graft(pt_20), PointB=pt_16)
item_8 = ListItem(List=shatter, Index=series_29, Wrap=True)
pdecon_4 = Deconstruct(Point=pt_21)  # -> XComponent, YComponent, ZComponent
Y_8 = UnitY(Factor=multiplication_30)
addition_14 = Addition(A=graft(Y_7), B=X_19)
item_9 = ListItem(List=shatter_2, Index=series_30, Wrap=True)
pt_24 = Point([Point(19.86373187, 12.5105993, 0), Point(27.63125674, 20.92541791, 0), Point(37.6643097, 26.75106157, 0), Point(25.04208179, 37.43140827, 0), Point(23.74749431, 40.34423009, 0), Point(31.83866605, 41.96246444, 0)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])
pdecon_5 = Deconstruct(Point=pt_21)  # -> XComponent, YComponent, ZComponent
pdecon_6 = Deconstruct(Point=addition_14)  # -> XComponent, YComponent, ZComponent
expression_2 = Expression(
    x=pdecon_6.XComponent,
    y=pdecon_6.YComponent,
    x_s=number_slider_5,
    y_s=number_slider_5,
    z=number_slider_6,
    Expression="sin(x/x_s)*cos(y/y_s)+sin(y/y_s)*cos(z)+sin(z)*cos(x/x_s)")
multiplication_31 = Multiplication(A=Slider(6.199, range=0..50), B=expression_2)
num_4 = Number(multiplication_31)
expression_3 = Expression(
    x=pdecon_6.XComponent,
    y=pdecon_6.YComponent,
    x_s=num_4,
    y_s=num_4,
    z=number_slider_6,
    Expression="sin(x/x_s)*cos(y/y_s)+sin(y/y_s)*cos(z)+sin(z)*cos(x/x_s)")
pline = PolyLine(Vertices=pt_23, Closed=False)
num_5 = Number(graft(expression_3))
dots_3 = DotDisplay(Point=multiplication_26, Colour=hsv_3, Size=1)
multiplication_32 = Multiplication(A=division_10, B=255)
multiplication_33 = Multiplication(A=division_9, B=255)
pt_25 = Point(addition_13)
dist_6 = Distance(PointA=graft(pt_25), PointB=pt_22)
addition_15 = Addition(A=multiplication_28, B=multiplication_29)
path_mapper = PathMapper(item_5, source="{A;B;C;D}", target="{A;B;C}")
division_11 = Division(A=Slider(28, range=0..100), B=path_mapper)
pt_26 = ConstructPoint(XCoordinate=pdecon_4.XComponent, YCoordinate=pdecon_4.YComponent, ZCoordinate=0)
multiplication_34 = Multiplication(A=pt_21, B=number_slider_23)
path_mapper_2 = PathMapper(item_6, source="{A;B;C;D}", target="{A;B;C}")
division_12 = Division(A=number_slider_23, B=path_mapper_2)
pt_27 = ConstructPoint(XCoordinate=pdecon_4.XComponent, YCoordinate=0, ZCoordinate=pdecon_4.ZComponent)
path_mapper_3 = PathMapper(item_7, source="{A;B;C;D}", target="{A;B;C}")
division_13 = Division(A=Slider(28, range=0..100), B=path_mapper_3)
pt_28 = ConstructPoint(XCoordinate=0, YCoordinate=pdecon_4.YComponent, ZCoordinate=pdecon_4.ZComponent)
end = EndPoints(Curve=item_9)  # -> Start, End
eval_2 = EvaluateCurve(Curve=ext, Parameter=number_slider_8)  # -> Point, Tangent, Angle
addition_16 = Addition(A=pt_18, B=multiplication_34)
pt_29 = Point(addition_14)
dist_7 = Distance(PointA=graft(pt_29), PointB=pt_24)
end_2 = EndPoints(Curve=item_8)  # -> Start, End
path_mapper_4 = PathMapper(num_3, source="{A;B;C;D}", target="{A;B;C}")
item_10 = ListItem(List=addition_15, Index=0, Wrap=True)
lng = ListLength(List=pt_12)
min = Minimum(A=division_11, B=Slider(14, range=0..100))
Y_9 = UnitY(Factor=min)
addition_17 = Addition(A=pt_17, B=Y_9)
rgb = ColourRGB(Alpha=255, Red=multiplication_32, Green=multiplication_33, Blue=Slider(127, range=0..255))
min_2 = Minimum(A=division_12, B=Slider(14, range=0..100))
polyline = PolyLine(Vertices=addition_15, Closed=False)
min_3 = Minimum(A=division_13, B=Slider(14, range=0..100))
Y_10 = UnitY(Factor=min_3)
addition_18 = Addition(A=pt_19, B=Y_10)
sort_6 = SortList(Keys=dist_5)  # -> Keys, ValuesA
path_mapper_5 = PathMapper(addition_16, source="{A;B;C}", target="{C}")
path_mapper_6 = PathMapper(num_5, source="{A;B;C;D}", target="{A;B;C}")
ln_8 = Line(StartPoint=end.End, EndPoint=end_2.End)
ln_9 = Line(StartPoint=end.Start, EndPoint=end_2.Start)
pdecon_7 = Deconstruct(Point=graft(pt_20))  # -> XComponent, YComponent, ZComponent
subtraction_6 = Subtraction(A=pdecon_2.YComponent, B=pdecon_7.YComponent)
abs = Absolute(Value=subtraction_6)
dots_4 = DotDisplay(Point=multiplication_21, Colour=rgb, Size=1)
pline_2 = PolyLine(Vertices=addition_17, Closed=False)
item_11 = ListItem(List=sort_6.Keys, Index=0, Wrap=True)
pline_3 = PolyLine(Vertices=addition_18, Closed=False)
graft = GraftTree(Tree=path_mapper_5, IncludeEmptyLists=True, IncludeNullItems=True)
multiplication_35 = Multiplication(A=Slider(6, range=0..10), B=path_mapper_4)
Y_11 = UnitY(Factor=multiplication_35)
addition_19 = Addition(A=pt_25, B=Y_11)
series_31 = Series(Start=0, Step=1, Count=lng)
equals = Equality(FirstNumber=item_11, SecondNumber=dist_5)  # -> Equality, Inequality
multiplication_36 = Multiplication(A=Slider(1.4, range=0..10), B=path_mapper_6)
Y_12 = UnitY(Factor=multiplication_36)
addition_20 = Addition(A=pt_29, B=Y_12)
path_mapper_7 = PathMapper(graft, source="{A;B}", target="{B}")
multiplication_37 = Multiplication(A=series_31, B=equals.Equality)
ma_2 = MassAddition(Input=multiplication_37)  # -> Result, PartialResults
pline_4 = PolyLine(Vertices=addition_19, Closed=False)
pline_5 = PolyLine(Vertices=addition_20, Closed=False)
pline_6 = PolyLine(Vertices=addition_16, Closed=False)
pline_7 = PolyLine(Vertices=path_mapper_7, Closed=False)
item_12 = ListItem(List=pt_16, Index=ma_2.Result, Wrap=True)
pdecon_8 = Deconstruct(Point=item_12)  # -> XComponent, YComponent, ZComponent
subtraction_7 = Subtraction(A=pdecon_7.XComponent, B=pdecon_8.XComponent)
subtraction_8 = Subtraction(A=pdecon_7.YComponent, B=pdecon_8.YComponent)
abs_2 = Absolute(Value=subtraction_7)
abs_3 = Absolute(Value=subtraction_8)
multiplication_38 = Multiplication(A=abs_3, B=0)
smaller = SmallerThan(FirstNumber=Slider(10, range=0..10), SecondNumber=abs_2)  # -> SmallerThan, OrEqualTo
merge_3 = Merge(Data1=abs_3, Data2=multiplication_38)
item_13 = ListItem(List=merge_3, Index=smaller.OrEqualTo, Wrap=True)
number_slider_24 = Slider(75, range=0..100)
path_mapper_8 = PathMapper(item_13, source="{A;B;C;D}", target="{A;B;C}")
panel_3 = Panel(path_mapper_8)
min_4 = Minimum(A=path_mapper_8, B=Slider(74, range=0..100))
Y_13 = UnitY(Factor=min_4)
addition_21 = Addition(A=pt_20, B=Y_13)
pline_8 = PolyLine(Vertices=addition_21, Closed=False)
