# Grasshopper definition random rectangles.gh (Grasshopper 1.0.7)

number_slider = Slider(20, range=0..100)
multiplication = Multiplication(A=number_slider, B=2)
srf = Surface(<surface referenced from the Rhino model>)
crv = Curve([<curve referenced from the Rhino model> x4])
random = Random(Range=Domain(0, 1), Number=multiplication, Seed=Slider(388, range=0..1000))
number_slider_2 = Slider(10, range=0..10)
number_slider_3 = Slider(63, range=0..100)
sort = SortList(Keys=random)  # -> Keys, ValuesA
loft = Loft(Curves=crv, Options={Adjust=False, Closed=False, LoftEnds=0, LoftSimp=0, LoftType=2, Rebuild=10, Refit=0.01})
series = Series(Start=5, Step=1, Count=10)  # -> graft(Series)
series_2 = Series(Start=0, Step=1, Count=number_slider)
series_3 = Series(Start=0, Step=1, Count=10)  # -> graft(Series)
series_4 = Series(Start=0, Step=1, Count=number_slider)
sift = SiftPattern(List=sort.Keys, SiftPattern=[0, 1])  # -> Output0, Output1
srf_2 = Surface(loft)
dim = Dimensions(Surface=srf_2)  # -> UDimension, VDimension
series_5 = Series(Start=0, Step=1, Count=number_slider)
clean = CleanTree(RemoveNulls=True, RemoveInvalid=True, RemoveEmpty=False, Tree=sift.Output0)
clean_2 = CleanTree(RemoveNulls=True, RemoveInvalid=True, RemoveEmpty=False, Tree=sift.Output1)
cluster = Cluster(R=Slider(0.56, range=0..1), num=Slider(25, range=0..100), num_2=series, int=series)  # -> R_2, R_3
graft = GraftTree(Tree=series_4, IncludeEmptyLists=True, IncludeNullItems=True)
multiplication_2 = Multiplication(A=number_slider, B=series_5)  # -> graft(Result)
multiplication_3 = Multiplication(A=number_slider, B=series_4)  # -> graft(Result)
col = Colour(RGB(255, 255, 255))
dom = ConstructDomain(DomainStart=clean, DomainEnd=clean_2)
addition = Addition(A=flatten(multiplication_3), B=graft)
X = UnitX(Factor=cluster.R_2)
X_2 = UnitX(Factor=cluster.R_3)
pt = ConstructPoint(XCoordinate=cluster.R_3, YCoordinate=series, ZCoordinate=0)
pt_2 = ConstructPoint(XCoordinate=cluster.R_2, YCoordinate=series, ZCoordinate=0)
addition_2 = Addition(A=multiplication_2, B=series_5)
series_6 = Series(Start=0, Step=1, Count=number_slider)
addition_3 = Addition(A=multiplication_3, B=series_4)
item = ListItem(List=series_4, Index=addition_3, Wrap=True)  # -> flatten(Item)
multiplication_4 = Multiplication(A=number_slider, B=addition_2)  # -> graft(Result)
ln = Line(StartPoint=X, EndPoint=X_2)
rectangle = Rectangle(Plane=PlaneXY(0, 0, 0), XSize=dom, YSize=dom, Radius=0)  # -> Rectangle, Length
ln_2 = Line(StartPoint=pt_2, EndPoint=pt)
item_2 = ListItem(List=dom, Index=addition, Wrap=True)  # -> flatten(Item)
dedomain = DeconstructDomain(Domain=item_2)  # -> Start, End
remap = RemapNumbers(Value=dedomain.End, Source=Domain(0, 1), Target=dim.UDimension)  # -> Mapped, Clipped
remap_2 = RemapNumbers(Value=dedomain.Start, Source=Domain(0, 1), Target=dim.UDimension)  # -> Mapped, Clipped
dom_2 = ConstructDomain(DomainStart=remap_2.Mapped, DomainEnd=remap.Mapped)
item_3 = ListItem(List=dom, Index=item, Wrap=True)  # -> flatten(Item)
dedomain_2 = DeconstructDomain(Domain=item_3)  # -> Start, End
remap_3 = RemapNumbers(Value=item_3, Source=Domain(0, 1), Target=dim.VDimension)  # -> Mapped, Clipped
remap_4 = RemapNumbers(Value=dedomain_2.End, Source=Domain(0, 1), Target=dim.VDimension)  # -> Mapped, Clipped
remap_5 = RemapNumbers(Value=dedomain_2.Start, Source=Domain(0, 1), Target=dim.VDimension)  # -> Mapped, Clipped
dom_3 = ConstructDomain(DomainStart=remap_5.Mapped, DomainEnd=remap_4.Mapped)
dom² = ConstructDomain²(DomainU=dom_2, DomainV=dom_3)
subsrf = Isotrim(Surface=srf_2, Domain=dom²)
preview = CustomPreview(Geometry=subsrf, Material=col)
addition_4 = Addition(A=multiplication_4, B=addition_2)
rectangle_2 = Rectangle(Plane=PlaneXY(0, 0, 0), XSize=flatten(item_2), YSize=item_3, Radius=0)  # -> Rectangle, Length

# ==== cluster Cluster
num = ClusterInput()
num_2 = ClusterInput()
int = ClusterInput()
R = ClusterInput()
num_3 = Number(num)
num_4 = Number(num_2)
int_2 = Integer(int)
subtraction = Subtraction(A=1, B=R)
addition = Addition(A=num_4, B=1)
addition_2 = Addition(A=int_2, B=1)
subtraction_2 = Subtraction(A=int_2, B=1)
division = Division(A=R, B=subtraction_2)
random = Random(Range=subtraction, Number=subtraction_2, Seed=addition)
ma = MassAddition(Input=random)  # -> Result, PartialResults
random_2 = Random(Range=R, Number=addition_2, Seed=num_4)
ma_2 = MassAddition(Input=ma.PartialResults)  # -> Result, PartialResults
sort = SortList(Keys=random_2)  # -> Keys, ValuesA
multiplication = Multiplication(A=0, B=ma_2.Result)
merge = Merge(Data1=multiplication, Data2=ma.PartialResults)
split = SplitList(List=sort.Keys, Index=1)  # -> ListA, ListB
split_2 = SplitList(List=sort.Keys, Index=int_2)  # -> ListA, ListB
num_5 = Number(1)
addition_3 = Addition(A=split.ListB, B=merge)
addition_4 = Addition(A=split_2.ListA, B=merge)
remap = RemapNumbers(Value=addition_3, Source=num_5, Target=num_3)  # -> Mapped, Clipped
remap_2 = RemapNumbers(Value=addition_4, Source=num_5, Target=num_3)  # -> Mapped, Clipped
R_2 = ClusterOutput(remap.Mapped)
R_3 = ClusterOutput(remap_2.Mapped)
