# Grasshopper definition random_houses.gh (Grasshopper 1.0.7)

number_slider = Slider(20, range=0..100)
line = Line([Line((5.867342632, -11.24298017, 0), (32.24040289, -16.23669572, 0)), Line((-5.368517361, -45.10661376, 0), (36.29779678, -28.56493099, 0))])
crv = Curve([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])
crvdom = CurveDomain(Curve=crv, Domain=Slider(1, range=0..1))  # -> Curve, Domain
multiplication = Multiplication(A=number_slider, B=2)
item = ListItem(List=crvdom.Curve, Index=0, Wrap=True)  # -> Item, Item1
srf = Surface(<surface referenced from the Rhino model>)
number_slider_2 = Slider(18, range=0..100)
crv_2 = Curve([<curve referenced from the Rhino model> x4])
number_slider_3 = Slider(33, range=0..100)
random = Random(Range=Domain(0, 1), Number=multiplication, Seed=Slider(388, range=0..1000))
random_2 = Random(Range=Domain(0, 1), Number=Slider(6, range=0..10), Seed=Slider(8, range=0..10))
number_slider_4 = Slider(10, range=0..10)
crv_3 = Curve(item.Item)
crv_4 = Curve(item.Item1)
dom = ConstructDomain(DomainStart=Slider(2, range=0..10), DomainEnd=Slider(32, range=0..100))
dom_2 = ConstructDomain(DomainStart=Slider(0, range=0..10), DomainEnd=Slider(14, range=0..100))
number_slider_5 = Slider(63, range=0..100)
sort = SortList(Keys=random)  # -> Keys, ValuesA
loft = Loft(Curves=crv_2, Options={Adjust=False, Closed=False, LoftEnds=0, LoftSimp=0, LoftType=2, Rebuild=10, Refit=0.01})
dom_3 = ConstructDomain(DomainStart=Slider(6, range=0..10), DomainEnd=Slider(19, range=0..100))
dom_4 = ConstructDomain(DomainStart=Slider(0, range=0..10), DomainEnd=Slider(23, range=0..100))
series = Series(Start=5, Step=1, Count=10)  # -> graft(Series)
sort_2 = SortList(Keys=random_2)  # -> Keys, ValuesA
end = EndPoints(Curve=crv_3)  # -> Start, End
end_2 = EndPoints(Curve=crv_4)  # -> Start, End
series_2 = Series(Start=0, Step=1, Count=10)  # -> graft(Series)
series_3 = Series(Start=5, Step=1, Count=Slider(20, range=0..100))  # -> graft(Series)
series_4 = Series(Start=0, Step=1, Count=number_slider)
random_3 = Random(Range=dom, Number=number_slider_2, Seed=2)
series_5 = Series(Start=0, Step=1, Count=number_slider)
random_4 = Random(Range=dom_2, Number=number_slider_2, Seed=Slider(8, range=0..100))
series_6 = Series(Start=0, Step=1, Count=10)  # -> graft(Series)
sift = SiftPattern(List=sort.Keys, SiftPattern=[0, 1])  # -> Output0, Output1
random_5 = Random(Range=dom_3, Number=number_slider_3, Seed=2)
srf_2 = Surface(loft)
dim = Dimensions(Surface=srf_2)  # -> UDimension, VDimension
random_6 = Random(Range=dom_4, Number=number_slider_3, Seed=Slider(8, range=0..100))
eval = EvaluateCurve(Curve=crv_3, Parameter=sort_2.Keys)  # -> Point, Tangent, Angle
eval_2 = EvaluateCurve(Curve=crv_4, Parameter=sort_2.Keys)  # -> Point, Tangent, Angle
series_7 = Series(Start=0, Step=1, Count=number_slider)
round = Round(Number=random_3)  # -> graft(Nearest), Floor, Ceiling
sort_3 = SortList(Keys=random_4)  # -> graft(Keys), ValuesA
clean = CleanTree(RemoveNulls=True, RemoveInvalid=True, RemoveEmpty=False, Tree=sift.Output0)
clean_2 = CleanTree(RemoveNulls=True, RemoveInvalid=True, RemoveEmpty=False, Tree=sift.Output1)
round_2 = Round(Number=random_5)  # -> graft(Nearest), Floor, Ceiling
sort_4 = SortList(Keys=random_6)  # -> graft(Keys), ValuesA
merge = Merge(Data1=end.Start, Data2=flatten(eval.Point), Data3=end.End)  # -> graft(Result)
merge_2 = Merge(Data1=end_2.Start, Data2=flatten(eval_2.Point), Data3=end_2.End)  # -> graft(Result)
cluster = Cluster(R=Slider(0.851, range=0..1), num=Slider(25, range=0..100), num_2=round.Nearest, int=Slider(15, range=0..100))  # -> R_2, R_3
graft = GraftTree(Tree=series_5, IncludeEmptyLists=True, IncludeNullItems=True)
multiplication_2 = Multiplication(A=number_slider, B=series_7)  # -> graft(Result)
random_7 = Random(Range=Domain(0, 1), Number=Slider(4, range=0..10), Seed=Slider(3, range=0..10))
cluster_2 = Cluster(R=Slider(0.886, range=0..1), num=Slider(14, range=0..100), num_2=round_2.Nearest, int=Slider(5, range=0..10))  # -> R_2, R_3
multiplication_3 = Multiplication(A=number_slider, B=series_5)  # -> graft(Result)
col = Colour(RGB(255, 255, 255))
dom_5 = ConstructDomain(DomainStart=clean, DomainEnd=clean_2)
addition = Addition(A=flatten(multiplication_3), B=graft)
sort_5 = SortList(Keys=random_7)  # -> Keys, ValuesA
addition_2 = Addition(A=multiplication_2, B=series_7)
X = UnitX(Factor=cluster.R_2)
X_2 = UnitX(Factor=cluster.R_3)
series_8 = Series(Start=0, Step=1, Count=number_slider)
pt = ConstructPoint(XCoordinate=cluster.R_3, YCoordinate=sort_3.Keys, ZCoordinate=0)
pt_2 = ConstructPoint(XCoordinate=cluster.R_2, YCoordinate=sort_3.Keys, ZCoordinate=0)
ln = Line(StartPoint=merge, EndPoint=merge_2)
addition_3 = Addition(A=multiplication_3, B=series_5)
X_3 = UnitX(Factor=cluster_2.R_2)
X_4 = UnitX(Factor=cluster_2.R_3)
pt_3 = ConstructPoint(XCoordinate=sort_4.Keys, YCoordinate=cluster_2.R_3, ZCoordinate=0)
pt_4 = ConstructPoint(XCoordinate=sort_4.Keys, YCoordinate=cluster_2.R_2, ZCoordinate=0)
item_2 = ListItem(List=series_5, Index=addition_3, Wrap=True)  # -> flatten(Item)
multiplication_4 = Multiplication(A=number_slider, B=addition_2)  # -> graft(Result)
merge_3 = Merge(Data1=0, Data2=flatten(sort_5.Keys), Data3=1)
number_slider_6 = Slider(0.04, range=0..1)
rectangle = Rectangle(Plane=PlaneXY(0, 0, 0), XSize=dom_5, YSize=dom_5, Radius=0)  # -> Rectangle, Length
ln_2 = Line(StartPoint=X, EndPoint=X_2)
line_2 = Line(flatten(ln))
ln_3 = Line(StartPoint=pt_2, EndPoint=pt)
lng = ListLength(List=line_2)
ln_4 = Line(StartPoint=X_3, EndPoint=X_4)
ln_5 = Line(StartPoint=pt_4, EndPoint=pt_3)
item_3 = ListItem(List=dom_5, Index=addition, Wrap=True)  # -> flatten(Item)
dedomain = DeconstructDomain(Domain=item_3)  # -> Start, End
remap = RemapNumbers(Value=dedomain.End, Source=Domain(0, 1), Target=dim.UDimension)  # -> Mapped, Clipped
remap_2 = RemapNumbers(Value=dedomain.Start, Source=Domain(0, 1), Target=dim.UDimension)  # -> Mapped, Clipped
dom_6 = ConstructDomain(DomainStart=remap_2.Mapped, DomainEnd=remap.Mapped)
item_4 = ListItem(List=dom_5, Index=item_2, Wrap=True)  # -> flatten(Item)
dedomain_2 = DeconstructDomain(Domain=item_4)  # -> Start, End
remap_3 = RemapNumbers(Value=item_4, Source=Domain(0, 1), Target=dim.VDimension)  # -> Mapped, Clipped
remap_4 = RemapNumbers(Value=dedomain_2.End, Source=Domain(0, 1), Target=dim.VDimension)  # -> Mapped, Clipped
remap_5 = RemapNumbers(Value=dedomain_2.Start, Source=Domain(0, 1), Target=dim.VDimension)  # -> Mapped, Clipped
dom_7 = ConstructDomain(DomainStart=remap_5.Mapped, DomainEnd=remap_4.Mapped)
dom² = ConstructDomain²(DomainU=dom_6, DomainV=dom_7)
subsrf = Isotrim(Surface=srf_2, Domain=dom²)
preview = CustomPreview(Geometry=subsrf, Material=col)
addition_4 = Addition(A=multiplication_4, B=addition_2)
num = Number(merge_3)
lng_2 = ListLength(List=num)
subtraction = Subtraction(A=lng_2, B=1)
subtraction_2 = Subtraction(A=lng, B=1)
rectangle_2 = Rectangle(Plane=PlaneXY(0, 0, 0), XSize=flatten(item_3), YSize=item_4, Radius=0)  # -> Rectangle, Length
split = SplitList(List=num, Index=1)  # -> ListA, graft(ListB)
split_2 = SplitList(List=num, Index=subtraction)  # -> graft(ListA), ListB
cluster_3 = Cluster_2(num=number_slider_6, crv=ln_5)
split_3 = SplitList(List=line_2, Index=1)  # -> ListA, ListB
split_4 = SplitList(List=line_2, Index=subtraction_2)  # -> ListA, ListB
cluster_4 = Cluster_3(num=number_slider_6, crv=ln_3)
crv_5 = Curve(cluster_3)
merge_4 = Merge(Data1=cluster_4, Data2=cluster_3)  # -> flatten(Result)
eval_3 = EvaluateCurve(Curve=split_3.ListB, Parameter=split.ListB)  # -> graft(Point), Tangent, Angle
eval_4 = EvaluateCurve(Curve=split_4.ListA, Parameter=split.ListB)  # -> graft(Point), Tangent, Angle
eval_5 = EvaluateCurve(Curve=split_3.ListB, Parameter=split_2.ListA)  # -> graft(Point), Tangent, Angle
eval_6 = EvaluateCurve(Curve=split_4.ListA, Parameter=split_2.ListA)  # -> graft(Point), Tangent, Angle
runion = RegionUnion(Curves=merge_4)
merge_5 = Merge(Data1=eval_3.Point, Data2=eval_5.Point, Data3=eval_6.Point, Data4=eval_4.Point)
rev = ReverseList(List=merge_5)
number_slider_7 = Slider(0.12, range=0..1)
pline = PolyLine(Vertices=rev, Closed=True)
crv_6 = Curve(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)
neg = Negative(Value=number_slider_7)
number_slider_8 = Slider(0.138, range=0..1)
cluster_5 = Cluster_3(num=number_slider_6, crv=crv_6)
offset = OffsetCurve(Curve=crv_6, Distance=neg, Plane=PlaneXY(0, 0, 0), Corners=1)
offset_2 = OffsetCurve(Curve=crv_6, Distance=number_slider_7, Plane=PlaneXY(0, 0, 0), Corners=1)
runion_2 = RegionUnion(Curves=flatten(pline))
crv_7 = Curve(cluster_5)
merge_6 = Merge(Data1=offset_2, Data2=offset)
neg_2 = Negative(Value=number_slider_8)
offset_3 = OffsetCurve(Curve=pline, Distance=number_slider_8, Plane=PlaneXY(0, 0, 0), Corners=1)
offset_4 = OffsetCurve(Curve=runion_2, Distance=neg_2, Plane=PlaneXY(0, 0, 0), Corners=1)
explode = Explode(Curve=pline, Recursive=True)  # -> graft(Segments), Vertices
rdiff = RegionDifference(CurvesA=runion, CurvesB=offset_2)
rint = RegionIntersection(CurvesA=runion, CurvesB=offset)
merge_7 = Merge(Data1=Slider(0.3, range=0..1), Data2=Slider(0.7, range=0..1))
merge_8 = Merge(Data1=rdiff, Data2=rint)
crvdom_2 = CurveDomain(Curve=explode.Segments, Domain=Slider(1, range=0..1))  # -> Curve, Domain
shatter = Shatter(Curve=crvdom_2.Curve, Parameters=merge_7)
panel = Panel(crvdom_2.Domain)
item_5 = ListItem(List=shatter, Index=1, Wrap=True)
cluster_6 = Cluster_3(num=Slider(0.33, range=0..1), crv=item_5)
merge_9 = Merge(Data1=cluster_6, Data2=offset_3)  # -> flatten(Result)
runion_3 = RegionUnion(Curves=merge_9)
rint_2 = RegionIntersection(CurvesA=runion_3, CurvesB=offset_4)
crv_8 = Curve(offset_4)

# ==== cluster Cluster
num = ClusterInput()
num_2 = ClusterInput()
int = ClusterInput()
R = ClusterInput()
num_3 = Number(num)
num_4 = Number(num_2)
int_2 = Integer(int)
subtraction = Subtraction(A=1, B=R)
addition = Addition(A=num_4, B=1)
addition_2 = Addition(A=int_2, B=1)
subtraction_2 = Subtraction(A=int_2, B=1)
division = Division(A=R, B=subtraction_2)
random = Random(Range=subtraction, Number=subtraction_2, Seed=addition)
random_2 = Random(Range=R, Number=addition_2, Seed=num_4)
sort = SortList(Keys=random)  # -> Keys, ValuesA
ma = MassAddition(Input=random)  # -> Result, PartialResults
sort_2 = SortList(Keys=random_2)  # -> Keys, ValuesA
multiplication = Multiplication(A=0, B=ma.Result)
merge = Merge(Data1=multiplication, Data2=sort.Keys)
split = SplitList(List=sort_2.Keys, Index=1)  # -> ListA, ListB
split_2 = SplitList(List=sort_2.Keys, Index=int_2)  # -> ListA, ListB
num_5 = Number(1)
addition_3 = Addition(A=split.ListB, B=merge)
addition_4 = Addition(A=split_2.ListA, B=merge)
remap = RemapNumbers(Value=addition_3, Source=num_5, Target=num_3)  # -> Mapped, Clipped
remap_2 = RemapNumbers(Value=addition_4, Source=num_5, Target=num_3)  # -> Mapped, Clipped
R_2 = ClusterOutput(remap.Mapped)
R_3 = ClusterOutput(remap_2.Mapped)

# ==== cluster Cluster_2
crv = ClusterInput()
num = ClusterInput()
num_2 = Number(num)
crv_2 = Curve(crv)
neg = Negative(Value=num_2)
offset = OffsetCurve(Curve=crv_2, Distance=num_2, Plane=PlaneXY(0, 0, 0), Corners=1)
offset_2 = OffsetCurve(Curve=crv_2, Distance=neg, Plane=PlaneXY(0, 0, 0), Corners=1)
end = EndPoints(Curve=offset_2)  # -> Start, End
end_2 = EndPoints(Curve=offset)  # -> Start, End
ln = Line(StartPoint=end_2.Start, EndPoint=end.Start)
ln_2 = Line(StartPoint=end_2.End, EndPoint=end.End)
merge = Merge(Data1=ln, Data2=ln_2, Data3=offset, Data4=offset_2)
join = JoinCurves(Curves=merge, Preserve=False)
C = ClusterOutput(join)

# ==== cluster Cluster_3
num = ClusterInput()
crv = ClusterInput()
num_2 = Number(num)
crv_2 = Curve(crv)
neg = Negative(Value=num_2)
offset = OffsetCurve(Curve=crv_2, Distance=num_2, Plane=PlaneXY(0, 0, 0), Corners=1)
offset_2 = OffsetCurve(Curve=crv_2, Distance=neg, Plane=PlaneXY(0, 0, 0), Corners=1)
end = EndPoints(Curve=offset_2)  # -> Start, End
end_2 = EndPoints(Curve=offset)  # -> Start, End
ln = Line(StartPoint=end_2.Start, EndPoint=end.Start)
ln_2 = Line(StartPoint=end_2.End, EndPoint=end.End)
merge = Merge(Data1=ln, Data2=ln_2, Data3=offset, Data4=offset_2)
join = JoinCurves(Curves=merge, Preserve=False)
C = ClusterOutput(join)
