# Grasshopper definition random_rectangles.gh (Grasshopper 1.0.7)

number_slider = Slider(100, range=0..100)
number_slider_2 = Slider(100, range=0..100)
random = Random(Range=number_slider, Number=number_slider_2, Seed=Slider(2, range=0..10))
random_2 = Random(Range=number_slider, Number=number_slider_2, Seed=Slider(3, range=0..10))
number_slider_3 = Slider(10, range=0..10)
rectangle = Rectangle(Plane=PlaneXY(0, 0, 0), XSize=random, YSize=random_2, Radius=0)  # -> Rectangle, Length
series = Series(Start=0, Step=1, Count=number_slider_3)
series_2 = Series(Start=0, Step=1, Count=number_slider_3)
multiplication = Multiplication(A=number_slider_3, B=series)  # -> graft(Result)
sift = SiftPattern(List=rectangle.Rectangle, SiftPattern=series_2)  # -> Output0, Output1, Output2, Output3, Output4, Output5, Output6, Output7, Output8, Output9
addition = Addition(A=series, B=multiplication)
item = ListItem(List=rectangle.Rectangle, Index=addition, Wrap=True)
runion = RegionUnion(Curves=item)  # -> flatten(Result)
panel = Panel(runion)
item_2 = ListItem(List=runion, Index=Slider(0, range=0..10), Wrap=True)
