# Grasshopper definition stuff.gh (Grasshopper 1.0.7)

crv = Curve(<curve referenced from the Rhino model>)
shatter = Shatter(Curve=crv, Parameters=Slider(65, range=0..100))
item = ListItem(List=shatter, Index=0, Wrap=True)
