# Grasshopper definition 2021.04.12 - 2 - surfaces.gh (Grasshopper 1.0.7)
# plug-ins: Parakeet

number_slider = Slider(8, range=0..100)
number_slider_2 = Slider(10, range=0..10)
number_slider_3 = Slider(20, range=0..100)
number_slider_4 = Slider(50, range=0..100)
number_slider_5 = Slider(59, range=0..100)
crv = Curve(<curve referenced from the Rhino model>)
crv_2 = Curve([<curve referenced from the Rhino model> x3])
neg = Negative(Value=number_slider)
number_slider_6 = Slider(100, range=0..100)
division = Division(A=number_slider_4, B=number_slider_3)
dom = ConstructDomain(DomainStart=number_slider, DomainEnd=neg)
Y = UnitY(Factor=Slider(100, range=0..100))
X = UnitX(Factor=number_slider_5)
crv_3 = Curve(<curve referenced from the Rhino model>)
Z = UnitZ(Factor=Slider(65, range=0..100))
Z_2 = UnitZ(Factor=number_slider_5)
Z_3 = UnitZ(Factor=0)
loft = Loft(Curves=crv_2, Options={Adjust=True, Closed=False, LoftEnds=0, LoftSimp=0, LoftType=0, Rebuild=10, Refit=0.01})
random = Random(Range=number_slider_4, Number=number_slider_3, Seed=Slider(200, range=0..1000))
series = Series(Start=0, Step=division, Count=number_slider_3)
domain² = Domain²(loft)
dedom2 = DeconstructDomain²(Domain=domain²)  # -> UComponent, VComponent
random_2 = Random(Range=dom, Number=number_slider_2, Seed=random)
addition = Addition(A=Y, B=X)
ln = Line(StartPoint=Z_3, EndPoint=Z)
srf = Surface(crv)
dom_2 = ConstructDomain(DomainStart=Slider(0, range=0..1), DomainEnd=Slider(6.283, range=0..6.283))
pt = Point(Point(695.987498, 575.7779394, 1477.416553))
sort = SortList(Keys=random)  # -> Keys, ValuesA
random_3 = Random(Range=dedom2.UComponent, Number=number_slider_6, Seed=Slider(66, range=0..100))
random_4 = Random(Range=dedom2.UComponent, Number=number_slider_6, Seed=Slider(78, range=0..100))
sort_2 = SortList(Keys=random_3)  # -> Keys, ValuesA
sort_3 = SortList(Keys=random_4)  # -> Keys, ValuesA
Z_4 = UnitZ(Factor=Slider(100, range=0..100))
X_2 = UnitX(Factor=Slider(69, range=0..100))
Y_2 = UnitY(Factor=Slider(53, range=0..100))
move = Move(Geometry=ln, Motion=addition)  # -> Geometry, Transform
bnd = Bounds(Numbers=sort.Keys)
crv_4 = Curve(<curve referenced from the Rhino model>)
bnd_2 = Bounds(Numbers=series)
pt_2 = ConstructPoint(XCoordinate=Slider(98, range=0..100), YCoordinate=Slider(2, range=0..100), ZCoordinate=0)
crv_5 = Curve([<curve referenced from the Rhino model> x2])
sift = SiftPattern(List=sort_3.Keys, SiftPattern=[0, 1])  # -> Output0, Output1
item = ListItem(List=sort_2.Keys, Index=0, Wrap=True)  # -> Item, Item1
item_2 = ListItem(List=sort_3.Keys, Index=0, Wrap=True)  # -> Item, Item1
bnd_3 = Bounds(Numbers=random_2)
pt_3 = ConstructPoint(XCoordinate=random_4, YCoordinate=random_3, ZCoordinate=0)
sift_2 = SiftPattern(List=sort_2.Keys, SiftPattern=[0, 1])  # -> Output0, Output1
addition_2 = Addition(A=Y_2, B=X_2, C=Z_4)
revsrf = Revolution(Curve=crv_3, Axis=move.Geometry, Domain=dom_2)
remap = RemapNumbers(Value=sort.Keys, Source=bnd, Target=number_slider_4)  # -> Mapped, Clipped
remap_2 = RemapNumbers(Value=series, Source=bnd_2, Target=number_slider_4)  # -> Mapped, Clipped
iso = IsoCurve(Surface=loft, UVPoint=pt_3)  # -> UIsocurve, VIsocurve
extrcrv = ExtrudeAlong(Base=crv, Curve=crv_4)
clean = CleanTree(RemoveNulls=True, RemoveInvalid=True, RemoveEmpty=False, Tree=sift.Output0)
clean_2 = CleanTree(RemoveNulls=True, RemoveInvalid=True, RemoveEmpty=False, Tree=sift.Output1)
extr = ExtrudePoint(Base=crv, Point=pt)
dom_3 = ConstructDomain(DomainStart=item.Item, DomainEnd=item.Item1)
remap_3 = RemapNumbers(Value=random_2, Source=bnd_3, Target=dom)  # -> Mapped, Clipped
clean_3 = CleanTree(RemoveNulls=True, RemoveInvalid=True, RemoveEmpty=False, Tree=sift_2.Output0)
iso_2 = IsoCurve(Surface=srf, UVPoint=pt_2)  # -> UIsocurve, VIsocurve
clean_4 = CleanTree(RemoveNulls=True, RemoveInvalid=True, RemoveEmpty=False, Tree=sift_2.Output1)
item_3 = ListItem(List=crv_5, Index=0, Wrap=True)  # -> Item, Item1
extr_2 = Extrude(Base=crv, Direction=addition_2)
pdecon = Deconstruct(Point=pt)  # -> XComponent, YComponent, ZComponent
pt_4 = ConstructPoint(XCoordinate=Slider(100, range=0..100), YCoordinate=Slider(13, range=0..100), ZCoordinate=0)
dom_4 = ConstructDomain(DomainStart=clean, DomainEnd=clean_2)
series_2 = Series(Start=0, Step=Slider(300, range=0..1000), Count=Slider(10, range=0..10))
crv_6 = Curve(<curve referenced from the Rhino model>)
dom_5 = ConstructDomain(DomainStart=clean_3, DomainEnd=clean_4)
dom² = ConstructDomain²(DomainU=dom_4, DomainV=graft(dom_5))
ccx = CurveCurve(CurveA=item_3.Item, CurveB=item_3.Item1)  # -> Points, ParamsA, ParamsB
pt_5 = ConstructPoint(XCoordinate=remap.Mapped, YCoordinate=remap_2.Mapped, ZCoordinate=0)
Z_5 = UnitZ(Factor=series_2)
Z_6 = UnitZ(Factor=pdecon.ZComponent)
iso_3 = IsoCurve(Surface=extr, UVPoint=pt_4)  # -> UIsocurve, VIsocurve
subsrf = Isotrim(Surface=loft, Domain=dom²)
intcrv = Interpolate(Vertices=pt_5, Degree=3, Periodic=False, KnotStyle=1)  # -> Curve, Length, Domain
crv_cp = CurveClosestPoint(Point=pt_5, Curve=intcrv.Curve)  # -> Point, Parameter, Distance
multiplication = Multiplication(A=series, B=0)
pt_6 = Point(Z_5)
xy = XYPlane(Origin=Z_5)
extr_3 = Extrude(Base=crv_6, Direction=Z_6)
crv_7 = Curve(iso_3.VIsocurve)
eval = EvaluateCurve(Curve=intcrv.Curve, Parameter=crv_cp.Parameter)  # -> Point, Tangent, Angle
sec = BrepPlane(Brep=extr, Plane=xy)  # -> flatten(Curves), Points
number_slider_7 = Slider(20, range=0..100)
subsrf_2 = Isotrim(Surface=subsrf, Domain=dom²)
series_3 = Series(Start=multiplication, Step=Slider(10, range=0..100), Count=number_slider_2)
rotate = Rotate(Geometry=eval.Tangent, Angle=1.570796327, Plane=PlaneXY(0, 0, 0))  # -> graft(Geometry), Transform
clean_5 = CleanTree(RemoveNulls=True, RemoveInvalid=True, RemoveEmpty=False, Tree=sec.Curves)
Z_7 = UnitZ(Factor=series_3)
number_slider_8 = Slider(31, range=0..100)
crv_8 = Curve(clean_5)
multiplication_2 = Multiplication(A=rotate.Geometry, B=remap_3.Mapped)
neg_2 = Negative(Value=number_slider_7)
bbx = BrepBrep(BrepA=clean_5, BrepB=extr_3)  # -> Curves, Points
srf_2 = Surface(clean_5)
lng = ListLength(List=crv_8)
merge = Merge(Data1=number_slider_7, Data2=neg_2)
srfsplit = SurfaceSplit(Surface=graft(clean_5), Curves=bbx.Curves)
addition_3 = Addition(A=graft(pt_5), B=multiplication_2)
divide = DivideCurve(Curve=crv_8, Count=Slider(200, range=0..1000), Kinks=False)  # -> Points, Tangents, Parameters
series_4 = Series(Start=0, Step=merge, Count=lng)
addition_4 = Addition(A=addition_3, B=Z_7)
item_4 = ListItem(List=srfsplit, Index=0, Wrap=True)
pt_7 = Point(addition_4)
pt_8 = Point(graft(pt_7))
flip = FlipMatrix(Data=series_4)
shift = ShiftList(List=divide.Points, Shift=flip, Wrap=True)
graft = GraftTree(Tree=shift, IncludeEmptyLists=True, IncludeNullItems=True)
flip_2 = FlipMatrix(Data=shift)
path_mapper = PathMapper(pt_8, source="{a;b;c;d}", target="{d}")
path_mapper_2 = PathMapper(graft, source="{A;B;C;D}", target="{D;C}")
pline = PolyLine(Vertices=pt_7, Closed=False)
pline_2 = PolyLine(Vertices=path_mapper, Closed=False)
pline_3 = PolyLine(Vertices=path_mapper_2, Closed=False)
path_mapper_3 = PathMapper(pline_3, source="{A;B}", target="{B}")
intcrv_2 = Interpolate(Vertices=pt_7, Degree=3, Periodic=False, KnotStyle=1)  # -> flatten(Curve), Length, Domain
intcrv_3 = Interpolate(Vertices=path_mapper, Degree=3, Periodic=False, KnotStyle=1)  # -> flatten(Curve), Length, Domain
item_5 = ListItem(List=pline_3, Index=Slider(48, range=0..100), Wrap=True)
bang = ExplodeTree(Data=path_mapper_3)  # -> Branch0, Branch1
crv_9 = Curve(path_mapper_3)
number_slider_9 = Slider(93.566, range=0..100)
number_slider_10 = Slider(37.376, range=0..100)
loft_2 = Loft(Curves=bang.Branch0, Options={Adjust=True, Closed=True, LoftEnds=0, LoftSimp=0, LoftType=1, Rebuild=10, Refit=0.01})
loft_3 = Loft(Curves=intcrv_2.Curve, Options={Adjust=False, Closed=False, LoftEnds=0, LoftSimp=0, LoftType=0, Rebuild=10, Refit=0.01})
loft_4 = Loft(Curves=intcrv_3.Curve, Options={Adjust=False, Closed=False, LoftEnds=0, LoftSimp=0, LoftType=0, Rebuild=10, Refit=0.01})
panel = Panel(path_mapper_3)
brep_topology = BrepTopology(Brep=loft_2)  # -> Vertices, Edges, Faces, PointPointTopology, PointLineTopology, PointFaceTopology, LinePointTopology, LineLineTopology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
pt_9 = ConstructPoint(XCoordinate=number_slider_9, YCoordinate=number_slider_10, ZCoordinate=0)
pt_10 = ConstructPoint(XCoordinate=number_slider_10, YCoordinate=number_slider_9, ZCoordinate=0)
iso_4 = IsoCurve(Surface=loft_3, UVPoint=pt_9)  # -> UIsocurve, VIsocurve
iso_5 = IsoCurve(Surface=loft_4, UVPoint=pt_10)  # -> UIsocurve, VIsocurve
merge_2 = Merge(Data1=iso_4.VIsocurve, Data2=iso_5.VIsocurve)
panel_2 = Panel(brep_topology.Faces)
pt_11 = ConstructPoint(XCoordinate=Slider(407.268, range=0..1000), YCoordinate=Slider(969.207, range=0..1000), ZCoordinate=0)
iso_6 = IsoCurve(Surface=brep_topology.Faces, UVPoint=pt_11)  # -> UIsocurve, VIsocurve
