# Grasshopper definition 2021.04.12 - surfaces.gh (Grasshopper 1.0.7)
# plug-ins: Parakeet

number_slider = Slider(59, range=0..100)
crv = Curve(<curve referenced from the Rhino model>)
crv_2 = Curve([<curve referenced from the Rhino model> x3])
number_slider_2 = Slider(100, range=0..100)
Y = UnitY(Factor=Slider(100, range=0..100))
X = UnitX(Factor=number_slider)
crv_3 = Curve(<curve referenced from the Rhino model>)
Z = UnitZ(Factor=Slider(65, range=0..100))
Z_2 = UnitZ(Factor=number_slider)
Z_3 = UnitZ(Factor=0)
loft = Loft(Curves=crv_2, Options={Adjust=True, Closed=False, LoftEnds=0, LoftSimp=0, LoftType=0, Rebuild=10, Refit=0.01})
domain² = Domain²(loft)
dedom2 = DeconstructDomain²(Domain=domain²)  # -> UComponent, VComponent
addition = Addition(A=Y, B=X)
ln = Line(StartPoint=Z_3, EndPoint=Z)
srf = Surface(crv)
dom = ConstructDomain(DomainStart=Slider(0, range=0..1), DomainEnd=Slider(6.283, range=0..6.283))
pt = Point(Point(695.987498, 575.7779394, 1477.416553))
random = Random(Range=dedom2.UComponent, Number=number_slider_2, Seed=Slider(66, range=0..100))
random_2 = Random(Range=dedom2.UComponent, Number=number_slider_2, Seed=Slider(78, range=0..100))
sort = SortList(Keys=random)  # -> Keys, ValuesA
sort_2 = SortList(Keys=random_2)  # -> Keys, ValuesA
Z_4 = UnitZ(Factor=Slider(100, range=0..100))
X_2 = UnitX(Factor=Slider(69, range=0..100))
Y_2 = UnitY(Factor=Slider(53, range=0..100))
move = Move(Geometry=ln, Motion=addition)  # -> Geometry, Transform
crv_4 = Curve(<curve referenced from the Rhino model>)
pt_2 = ConstructPoint(XCoordinate=Slider(98, range=0..100), YCoordinate=Slider(2, range=0..100), ZCoordinate=0)
crv_5 = Curve([<curve referenced from the Rhino model> x2])
sift = SiftPattern(List=sort_2.Keys, SiftPattern=[0, 1])  # -> Output0, Output1
item = ListItem(List=sort.Keys, Index=0, Wrap=True)  # -> Item, Item1
item_2 = ListItem(List=sort_2.Keys, Index=0, Wrap=True)  # -> Item, Item1
pt_3 = ConstructPoint(XCoordinate=random_2, YCoordinate=random, ZCoordinate=0)
sift_2 = SiftPattern(List=sort.Keys, SiftPattern=[0, 1])  # -> Output0, Output1
addition_2 = Addition(A=Y_2, B=X_2, C=Z_4)
revsrf = Revolution(Curve=crv_3, Axis=move.Geometry, Domain=dom)
iso = IsoCurve(Surface=loft, UVPoint=pt_3)  # -> UIsocurve, VIsocurve
extrcrv = ExtrudeAlong(Base=crv, Curve=crv_4)
clean = CleanTree(RemoveNulls=True, RemoveInvalid=True, RemoveEmpty=False, Tree=sift.Output0)
clean_2 = CleanTree(RemoveNulls=True, RemoveInvalid=True, RemoveEmpty=False, Tree=sift.Output1)
extr = ExtrudePoint(Base=crv, Point=pt)
dom_2 = ConstructDomain(DomainStart=item.Item, DomainEnd=item.Item1)
clean_3 = CleanTree(RemoveNulls=True, RemoveInvalid=True, RemoveEmpty=False, Tree=sift_2.Output0)
iso_2 = IsoCurve(Surface=srf, UVPoint=pt_2)  # -> UIsocurve, VIsocurve
clean_4 = CleanTree(RemoveNulls=True, RemoveInvalid=True, RemoveEmpty=False, Tree=sift_2.Output1)
item_3 = ListItem(List=crv_5, Index=0, Wrap=True)  # -> Item, Item1
extr_2 = Extrude(Base=crv, Direction=addition_2)
pdecon = Deconstruct(Point=pt)  # -> XComponent, YComponent, ZComponent
pt_4 = ConstructPoint(XCoordinate=Slider(100, range=0..100), YCoordinate=Slider(13, range=0..100), ZCoordinate=0)
dom_3 = ConstructDomain(DomainStart=clean, DomainEnd=clean_2)
series = Series(Start=0, Step=Slider(300, range=0..1000), Count=Slider(10, range=0..10))
crv_6 = Curve(<curve referenced from the Rhino model>)
dom_4 = ConstructDomain(DomainStart=clean_3, DomainEnd=clean_4)
dom² = ConstructDomain²(DomainU=dom_3, DomainV=graft(dom_4))
ccx = CurveCurve(CurveA=item_3.Item, CurveB=item_3.Item1)  # -> Points, ParamsA, ParamsB
Z_5 = UnitZ(Factor=series)
Z_6 = UnitZ(Factor=pdecon.ZComponent)
iso_3 = IsoCurve(Surface=extr, UVPoint=pt_4)  # -> UIsocurve, VIsocurve
subsrf = Isotrim(Surface=loft, Domain=dom²)
pt_5 = Point(Z_5)
xy = XYPlane(Origin=Z_5)
extr_3 = Extrude(Base=crv_6, Direction=Z_6)
crv_7 = Curve(iso_3.VIsocurve)
sec = BrepPlane(Brep=extr, Plane=xy)  # -> flatten(Curves), Points
number_slider_3 = Slider(20, range=0..100)
subsrf_2 = Isotrim(Surface=subsrf, Domain=dom²)
clean_5 = CleanTree(RemoveNulls=True, RemoveInvalid=True, RemoveEmpty=False, Tree=sec.Curves)
number_slider_4 = Slider(31, range=0..100)
crv_8 = Curve(clean_5)
neg = Negative(Value=number_slider_3)
bbx = BrepBrep(BrepA=clean_5, BrepB=extr_3)  # -> Curves, Points
srf_2 = Surface(clean_5)
lng = ListLength(List=crv_8)
merge = Merge(Data1=number_slider_3, Data2=neg)
srfsplit = SurfaceSplit(Surface=graft(clean_5), Curves=bbx.Curves)
divide = DivideCurve(Curve=crv_8, Count=Slider(200, range=0..1000), Kinks=False)  # -> Points, Tangents, Parameters
series_2 = Series(Start=0, Step=merge, Count=lng)
item_4 = ListItem(List=srfsplit, Index=0, Wrap=True)
flip = FlipMatrix(Data=series_2)
shift = ShiftList(List=divide.Points, Shift=flip, Wrap=True)
graft = GraftTree(Tree=shift, IncludeEmptyLists=True, IncludeNullItems=True)
flip_2 = FlipMatrix(Data=shift)
path_mapper = PathMapper(graft, source="{A;B;C;D}", target="{D;C}")
pline = PolyLine(Vertices=path_mapper, Closed=False)
path_mapper_2 = PathMapper(pline, source="{A;B}", target="{B}")
item_5 = ListItem(List=pline, Index=Slider(48, range=0..100), Wrap=True)
bang = ExplodeTree(Data=path_mapper_2)  # -> Branch0, Branch1
crv_9 = Curve(path_mapper_2)
loft_2 = Loft(Curves=bang.Branch0, Options={Adjust=True, Closed=True, LoftEnds=0, LoftSimp=0, LoftType=1, Rebuild=10, Refit=0.01})
panel = Panel(path_mapper_2)
brep_topology = BrepTopology(Brep=loft_2)  # -> Vertices, Edges, Faces, PointPointTopology, PointLineTopology, PointFaceTopology, LinePointTopology, LineLineTopology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
panel_2 = Panel(brep_topology.Faces)
pt_6 = ConstructPoint(XCoordinate=Slider(407.268, range=0..1000), YCoordinate=Slider(969.207, range=0..1000), ZCoordinate=0)
iso_4 = IsoCurve(Surface=brep_topology.Faces, UVPoint=pt_6)  # -> UIsocurve, VIsocurve
