# Grasshopper definition graphting_lists.gh (Grasshopper 1.0.7)

series = Series(Start=Slider(1, range=0..1), Step=1, Count=Slider(10, range=0..10))
series_2 = Series(Start=Slider(1, range=0..1), Step=1, Count=Slider(10, range=0..10))
series_3 = Series(Start=0, Step=Slider(10, range=0..10), Count=Slider(10, range=0..10))
series_4 = Series(Start=0, Step=Slider(10, range=0..10), Count=Slider(10, range=0..10))
series_5 = Series(Start=0, Step=Slider(10, range=0..10), Count=Slider(10, range=0..10))
series_6 = Series(Start=0, Step=Slider(10, range=0..10), Count=Slider(10, range=0..10))
series_7 = Series(Start=0, Step=Slider(10, range=0..10), Count=Slider(6, range=0..10))
series_8 = Series(Start=0, Step=Slider(10, range=0..10), Count=Slider(10, range=0..10))  # -> graft(Series)
series_9 = Series(Start=0, Step=Slider(10, range=0..10), Count=Slider(10, range=0..10))
series_10 = Series(Start=0, Step=Slider(10, range=0..10), Count=Slider(10, range=0..10))  # -> graft(Series)
series_11 = Series(Start=0, Step=Slider(10, range=0..10), Count=Slider(10, range=0..10))  # -> graft(Series)
series_12 = Series(Start=0, Step=Slider(10, range=0..10), Count=Slider(10, range=0..10))  # -> graft(Series)
series_13 = Series(Start=0, Step=Slider(10, range=0..10), Count=Slider(10, range=0..10))
series_14 = Series(Start=0, Step=Slider(10, range=0..10), Count=series)
series_15 = Series(Start=0, Step=Slider(10, range=0..10), Count=series_2)
python = GhPythonScript(x=Slider(10, range=0..10), y=Slider(10, range=0..10))  # -> out, pts; inputs x: Int32
# ---------- python: Python ----------
import Rhino.Geometry as rg

pts = []

for i in range(x):
    for j in range(x):
        for k in range(x):
            pts.append(rg.Point3d(i * y, j * y, k * y))
# ---------- end python ----------
pt = ConstructPoint(XCoordinate=Slider(100, range=0..100), YCoordinate=Slider(100, range=0..100), ZCoordinate=0)
pt_2 = ConstructPoint(XCoordinate=Slider(100, range=0..100), YCoordinate=series_3, ZCoordinate=0)
pt_3 = ConstructPoint(XCoordinate=series_4, YCoordinate=series_5, ZCoordinate=0)
pt_4 = ConstructPoint(XCoordinate=series_7, YCoordinate=series_6, ZCoordinate=0)
pt_5 = ConstructPoint(XCoordinate=series_15, YCoordinate=series_13, ZCoordinate=0)
pt_6 = ConstructPoint(XCoordinate=series_8, YCoordinate=series_9, ZCoordinate=0)
pt_7 = ConstructPoint(XCoordinate=series_11, YCoordinate=series_10, ZCoordinate=0)
pt_8 = ConstructPoint(XCoordinate=series_14, YCoordinate=series_12, ZCoordinate=0)
path_mapper = PathMapper(pt_8, source="{A;B;C}", target="{C}")
panel = Panel(pt_6)
panel_2 = Panel(path_mapper)
bang = ExplodeTree(Data=path_mapper)  # -> Branch0, Branch1, Branch2, Branch3, Branch4, Branch5, Branch6, Branch7, Branch8, Branch9
branch = TreeBranch(Tree=path_mapper, Path="{3}", MaintainPaths=True)
