# Grasshopper definition polygon_to_house.gh (Grasshopper 1.0.7)

crv = Curve(<curve referenced from the Rhino model>)
divide = DivideCurve(Curve=crv, Count=1, Kinks=True)  # -> Points, Tangents, Parameters
number_slider = Slider(3, range=0..10)
pt = Point()
int = Integer(4)
crv_2 = Curve(<curve referenced from the Rhino model>)
crv_3 = Curve(<curve referenced from the Rhino model>)
divide_2 = DivideCurve(Curve=crv_2, Count=1, Kinks=True)  # -> Points, Tangents, Parameters
series = Series(Start=Slider(9, range=0..10), Step=1, Count=int)
end = EndPoints(Curve=crv_3)  # -> Start, End
addition = Addition(A=series, B=3)
divide_3 = DivideCurve(Curve=crv_3, Count=1, Kinks=True)  # -> Points, Tangents, Parameters
ln = Line(StartPoint=end.Start, EndPoint=end.End)
crv_4 = Curve(crv_3)
number_slider_2 = Slider(38.622, range=0..100)
number_slider_3 = Slider(10, range=0..10)
item = ListItem(List=divide_2.Points, Index=addition, Wrap=True)
shift = ShiftList(List=item, Shift=number_slider, Wrap=True)
pt_2 = Point(shift)
ma = MassAddition(Input=pt_2)  # -> Result, PartialResults
lng = ListLength(List=pt_2)
division = Division(A=ma.Result, B=lng)
item_2 = ListItem(List=divide_2.Points, Index=series, Wrap=True)
number_slider_4 = Slider(0, range=0..1)
number_slider_5 = Slider(63.481, range=0..100)
merge = Merge(Data1=crv_4, Data2=ln)
ln_2 = Line(StartPoint=pt_2, EndPoint=division)
pt_3 = Point(divide_3.Points)
join = JoinCurves(Curves=crv_4, Preserve=False)
division_2 = Division(A=number_slider_3, B=2)
shift_2 = ShiftList(List=pt_3, Shift=1, Wrap=True)
Z = UnitZ(Factor=Slider(63.481, range=0..100))
ma_2 = MassAddition(Input=pt_3)  # -> Result, PartialResults
lng_2 = ListLength(List=pt_3)
eval = EvaluateCurve(Curve=ln_2, Parameter=Slider(0, range=0..1))  # -> flatten(Point), Tangent, Angle
offset = OffsetCurve(Curve=join, Distance=number_slider_3, Plane=PlaneXY(0, 0, 0), Corners=1)
offset_2 = OffsetCurve(Curve=join, Distance=division_2, Plane=PlaneXY(0, 0, 0), Corners=1)
addition_2 = Addition(A=shift_2, B=pt_3)
Z_2 = UnitZ(Factor=Slider(10, range=0..10))
Z_3 = UnitZ(Factor=Slider(15, range=0..100))
division_3 = Division(A=ma_2.Result, B=lng_2)
division_4 = Division(A=addition_2, B=2)
number_slider_6 = Slider(0.444, range=0..1)
move = Move(Geometry=join, Motion=Z_2)  # -> Geometry, Transform
move_2 = Move(Geometry=offset_2, Motion=Z_3)  # -> Geometry, Transform
move_3 = Move(Geometry=offset, Motion=Z_2)  # -> Geometry, Transform
move_4 = Move(Geometry=eval.Point, Motion=Z)  # -> Geometry, Transform
pt_4 = Point(flatten(pt_3))
pt_5 = Point(flatten(division_4))
number_slider_7 = Slider(3, range=-10..10)
shift_3 = ShiftList(List=eval.Point, Shift=1, Wrap=True)  # -> flatten(List)
shift_4 = ShiftList(List=move_4.Geometry, Shift=1, Wrap=True)  # -> flatten(List)
number_slider_8 = Slider(38.622, range=0..100)
ln_3 = Line(StartPoint=pt_3, EndPoint=division_3)
ln_4 = Line(StartPoint=division_4, EndPoint=division_3)
rev = ReverseList(List=move_4.Geometry)  # -> flatten(List)
item_3 = ListItem(List=move_4.Geometry, Index=0, Wrap=True)  # -> Item, Item1, Item2, Item3
merge_2 = Merge(Data1=join, Data2=move.Geometry, Data3=move_2.Geometry, Data4=move_3.Geometry, Data5=offset)  # -> flatten(Result)
merge_3 = Merge(Data1=graft(eval.Point), Data2=graft(move_4.Geometry), Data3=graft(shift_4), Data4=graft(shift_3))
eval_2 = EvaluateCurve(Curve=ln_3, Parameter=number_slider_6)  # -> flatten(Point), Tangent, Angle
merge_4 = Merge(Data1=item_3.Item, Data2=item_3.Item1)
eval_3 = EvaluateCurve(Curve=ln_4, Parameter=number_slider_6)  # -> flatten(Point), Tangent, Angle
addition_3 = Addition(A=item_3.Item, B=item_3.Item1)
addition_4 = Addition(A=item_3.Item3, B=item_3.Item2)
loft = Loft(Curves=merge_2, Options={Adjust=False, Closed=True, LoftEnds=0, LoftSimp=0, LoftType=3, Rebuild=10, Refit=0.01})
shift_5 = ShiftList(List=pt_5, Shift=number_slider_7, Wrap=True)  # -> flatten(List)
shift_6 = ShiftList(List=eval_3.Point, Shift=number_slider_7, Wrap=True)  # -> flatten(List)
item_4 = ListItem(List=merge_3, Index=0, Wrap=True)  # -> Item, Item1, Item2, Item3
Z_4 = UnitZ(Factor=number_slider_8)
cap = CapHoles(Brep=loft)
Z_5 = UnitZ(Factor=number_slider_8)
division_5 = Division(A=addition_3, B=2)
division_6 = Division(A=addition_4, B=2)
srf4pt = _4PointSurface(CornerA=item_4.Item, CornerB=item_4.Item1, CornerC=item_4.Item2, CornerD=item_4.Item3)
merge_5 = Merge(Data1=graft(eval_2.Point), Data2=graft(pt_4), Data3=graft(pt_5), Data4=graft(eval_3.Point))
addition_5 = Addition(A=Z_4, B=division_6)
addition_6 = Addition(A=Z_4, B=division_5)
merge_6 = Merge(Data1=graft(shift_5), Data2=graft(pt_4), Data3=graft(eval_2.Point), Data4=graft(shift_6))
pline = PolyLine(Vertices=merge_5, Closed=False)  # -> flatten(Polyline)
cluster = Cluster(num=number_slider_2, F=number_slider_5, L=item_2, S=number_slider, crv=pline, t=number_slider_4)  # -> P, B
srf4pt_2 = _4PointSurface(CornerA=item_3.Item, CornerB=item_3.Item1, CornerC=addition_6)
srf4pt_3 = _4PointSurface(CornerA=item_3.Item3, CornerB=item_3.Item2, CornerC=addition_5)
srf4pt_4 = _4PointSurface(CornerA=item_3.Item3, CornerB=item_3.Item, CornerC=addition_6, CornerD=addition_5)
srf4pt_5 = _4PointSurface(CornerA=item_3.Item2, CornerB=item_3.Item1, CornerC=addition_6, CornerD=addition_5)
shift_7 = ShiftList(List=merge_6, Shift=1, Wrap=True)
item_5 = ListItem(List=pline, Index=0, Wrap=True)  # -> Item, Item1, Item2, Item3
merge_7 = Merge(Data1=srf4pt_2, Data2=srf4pt_3, Data3=srf4pt_4, Data4=srf4pt_5, Data5=flatten(srf4pt))
pline_2 = PolyLine(Vertices=shift_7, Closed=False)  # -> flatten(Polyline)
panel = Panel(merge_5)
join_2 = BrepJoin(Breps=merge_7)  # -> Breps, Closed
cluster_2 = Cluster(num=number_slider_2, F=number_slider_5, L=item_2, S=number_slider, crv=item_5.Item3, t=number_slider_4)  # -> P, B
cluster_3 = Cluster(num=number_slider_2, F=number_slider_5, L=item_2, S=number_slider, crv=item_5.Item, t=number_slider_4)  # -> P, B
cluster_4 = Cluster(num=number_slider_2, F=number_slider_5, L=item_2, S=number_slider, crv=item_5.Item2, t=number_slider_4)  # -> P, B
cluster_5 = Cluster(num=number_slider_2, F=number_slider_5, L=item_2, S=number_slider, crv=item_5.Item1, t=number_slider_4)  # -> P, B
item_6 = ListItem(List=pline_2, Index=0, Wrap=True)  # -> Item, Item1, Item2, Item3
cap_2 = CapHoles(Brep=join_2.Breps)
cluster_6 = Cluster(num=number_slider_2, F=number_slider_5, L=item_2, S=number_slider, crv=item_6.Item3, t=number_slider_4)  # -> P, B
cluster_7 = Cluster(num=number_slider_2, F=number_slider_5, L=item_2, S=number_slider, crv=item_6.Item, t=number_slider_4)  # -> P, B
cluster_8 = Cluster(num=number_slider_2, F=number_slider_5, L=item_2, S=number_slider, crv=item_6.Item2, t=number_slider_4)  # -> P, B
cluster_9 = Cluster(num=number_slider_2, F=number_slider_5, L=item_2, S=number_slider, crv=item_6.Item1, t=number_slider_4)  # -> P, B
merge_8 = Merge(Data1=cap_2, Data2=cluster.B)
merge_9 = Merge(
    Data1=cluster_3.B,
    Data2=cluster_5.B,
    Data3=cluster_4.B,
    Data4=cluster_2.B,
    Data5=cluster_7.B,
    Data6=cluster_9.B,
    Data7=cluster_8.B,
    Data8=cluster_6.B)
sunion = SolidUnion(Breps=merge_8)
sunion_2 = SolidUnion(Breps=merge_9)

# ==== cluster Cluster
crv = ClusterInput()
crv_2 = Curve(crv)
divide = DivideCurve(Curve=crv_2, Count=1, Kinks=True)  # -> Points, Tangents, Parameters
L = ClusterInput()
S = ClusterInput()
P = ClusterOutput(divide.Points)
shift = ShiftList(List=L, Shift=S, Wrap=True)
pt = Point(divide.Points)
lng = ListLength(List=pt)
ma = MassAddition(Input=pt)  # -> Result, PartialResults
division = Division(A=ma.Result, B=lng)
ln = Line(StartPoint=pt, EndPoint=division)
F = ClusterInput()
t = ClusterInput()
num = ClusterInput()
Z = UnitZ(Factor=F)
eval = EvaluateCurve(Curve=ln, Parameter=t)  # -> flatten(Point), Tangent, Angle
num_2 = Number(num)
move = Move(Geometry=eval.Point, Motion=Z)  # -> Geometry, Transform
shift_2 = ShiftList(List=eval.Point, Shift=1, Wrap=True)  # -> flatten(List)
shift_3 = ShiftList(List=move.Geometry, Shift=1, Wrap=True)  # -> flatten(List)
rev = ReverseList(List=move.Geometry)  # -> flatten(List)
item = ListItem(List=move.Geometry, Index=0, Wrap=True)  # -> Item, Item1, Item2, Item3
merge = Merge(Data1=graft(eval.Point), Data2=graft(move.Geometry), Data3=graft(shift_3), Data4=graft(shift_2))
addition = Addition(A=item.Item, B=item.Item1)
addition_2 = Addition(A=item.Item3, B=item.Item2)
item_2 = ListItem(List=merge, Index=0, Wrap=True)  # -> Item, Item1, Item2, Item3
Z_2 = UnitZ(Factor=num_2)
Z_3 = UnitZ(Factor=num_2)
division_2 = Division(A=addition, B=2)
division_3 = Division(A=addition_2, B=2)
srf4pt = _4PointSurface(CornerA=item_2.Item, CornerB=item_2.Item1, CornerC=item_2.Item2, CornerD=item_2.Item3)
addition_3 = Addition(A=Z_2, B=division_3)
addition_4 = Addition(A=Z_2, B=division_2)
srf4pt_2 = _4PointSurface(CornerA=item.Item, CornerB=item.Item1, CornerC=addition_4)
srf4pt_3 = _4PointSurface(CornerA=item.Item3, CornerB=item.Item2, CornerC=addition_3)
srf4pt_4 = _4PointSurface(CornerA=item.Item3, CornerB=item.Item, CornerC=addition_4, CornerD=addition_3)
srf4pt_5 = _4PointSurface(CornerA=item.Item2, CornerB=item.Item1, CornerC=addition_4, CornerD=addition_3)
merge_2 = Merge(Data1=srf4pt_2, Data2=srf4pt_3, Data3=srf4pt_4, Data4=srf4pt_5, Data5=flatten(srf4pt))
join = BrepJoin(Breps=merge_2)  # -> Breps, Closed
cap = CapHoles(Brep=join.Breps)
B = ClusterOutput(cap)
